# Grasshopper definition 001_introduction.gh (Grasshopper 1.0.8)
# plug-ins: RhinoCodePluginGH

# Learn Python with Grasshopper
number_slider = Slider(3.8, range=0..10)
radial = Radial(Plane=PlaneXY(0, 0, 0), Size=Slider(100, range=0..100), ExtentR=5, ExtentP=20)  # -> Cells, Points
twisted_towers = Script(
    base_pointIn=radial.Points,
    num_slices=Slider(5, range=0..100),
    widthIn=Slider(28.54, range=0..100),
    heightIn=Slider(81.04, range=0..100),
    twist_angleIn=Slider(360, range=0..360))  # -> out, base_point, tower; inputs base_pointIn: Point3d, num_slices: Int32, widthIn: Double, heightIn: Double, twist_angleIn: Double
# ---------- twisted_towers: Python ----------
import Rhino.Geometry as rg
import math

def create_twisted_tower(base_point, width, height, twist_angle):
    """
    Create a twisted tower from a base point with specified dimensions and twist.
    Each horizontal section of the tower is rotated slightly more than the one below it.
    :param base_pointIn: Base point of the tower (Rhino.Geometry.Point3d)
    :param widthIn: Width of the tower's base (float)
    :param heightIn: Height of the tower (float)
    :param twist_angle: Total twist angle from bottom to top (degrees)
    :return: Twisted tower as a Rhino.Geometry Brep
    """
    #num_slices = 20
    slice_height = heightIn / num_slices
    angle_per_slice = math.radians(twist_angleIn) / num_slices

    points = [rg.Point3d(base_pointIn.X - widthIn/2, base_pointIn.Y - widthIn/2, base_point.Z),
              rg.Point3d(base_pointIn.X + widthIn/2, base_pointIn.Y - widthIn/2, base_point.Z),
              rg.Point3d(base_pointIn.X + widthIn/2, base_pointIn.Y + widthIn/2, base_point.Z),
              rg.Point3d(base_pointIn.X - widthIn/2, base_pointIn.Y + widthIn/2, base_point.Z)]

    faces = []

    for i in range(1, num_slices + 1):
        new_points = []
        for pt in points:
            # Rotate point around the base point
            new_pt = rg.Point3d(pt)
            angle = angle_per_slice * i
            new_pt.Transform(rg.Transform.Rotation(angle, rg.Vector3d(0,0,1), base_pointIn))
            new_pt.Z += slice_height * i
            new_points.append(new_pt)
        
        # Create a lofted surface between layers
        if i > 1:
            lower_curve = rg.PolylineCurve(points + [points[0]])  # Convert polyline to curve
            upper_curve = rg.PolylineCurve(new_points + [new_points[0]])  # Convert polyline to curve
            face = rg.Brep.CreateFromLoft([lower_curve, upper_curve], rg.Point3d.Unset, rg.Point3d.Unset, rg.LoftType.Normal, False)
            if face[0]:  # Check if loft succeeded
                faces.append(face[0])

        points = new_points  # Update points for next iteration

    tower = rg.Brep.JoinBreps(faces, 0.1)
    return tower[0] if tower else None

# Example usage
base_point = rg.Point3d(0, 0, 0)
tower = create_twisted_tower(base_point, 20, 100, 360)  # 360 degrees of twist over the height of the tower
# ---------- end twisted_towers ----------
staircase_steps = Script(radius=Slider(100, range=0..100), height=Slider(100, range=0..100), num_steps=Slider(37, range=0..100))  # -> out, staircase_steps; inputs radius: Double, height: Double, num_steps: Int32
# ---------- staircase_steps: Python ----------
import Rhino.Geometry as rg
import math

def create_spiral_staircase(radius, height, num_steps):
    """
    Create a spiral staircase with a given radius, total height, and number of steps.
    :param radius: the radius of the staircase
    :param height: total height of the staircase
    :param num_steps: number of steps
    :return: list of staircase steps as Rhino.Geometry Brep objects
    """
    steps = []
    step_height = height / num_steps
    angle_increment = (2 * math.pi) / num_steps  # Complete circle divided by number of steps

    for i in range(num_steps):
        # Calculate the position and rotation for each step
        angle = i * angle_increment
        x = radius * math.cos(angle)
        y = radius * math.sin(angle)
        z = i * step_height

        # Create a step using a box and transform it into position
        step_base = rg.Plane(rg.Point3d(x, y, z), rg.Vector3d(0, 0, 1))
        step = rg.Box(step_base, rg.Interval(-10, 10), rg.Interval(0, 30), rg.Interval(0, step_height))
        steps.append(step.ToBrep())

    return steps

# Parametric inputs from Grasshopper
#radius = 100  # Radius of the staircase
#height = 300  # Total height of the staircase
#num_steps = 20  # Number of steps

# Generating the staircase
staircase_steps = create_spiral_staircase(radius, height, num_steps)

# The following line would be connected to the output of the Grasshopper Python script component
# a = staircase_steps
# ---------- end staircase_steps ----------
my_point = Script(x=number_slider, y=Slider(7.08, range=0..10))  # -> out, my_point; inputs x: Double, y: Double
# ---------- my_point: Python ----------
import Rhino.Geometry as rg

class Point:
    def __init__(self, x=0, y=0):
        """
        Initialize a point with x and y coordinates.
        :param x: x-coordinate of the point
        :param y: y-coordinate of the point
        """
        self.x = x
        self.y = y

    def to_rg_point(self):
        """
        Convert the Point instance to a Rhino.Geometry Point3d object.
        """
        return rg.Point3d(self.x, self.y, 0)

# These lines simulate parametric inputs in Grasshopper
#x = 5  # Simulated input for x-coordinate
#y = 3  # Simulated input for y-coordinate

# Creating an instance of Point and converting to Rhino.Geometry Point3d
my_point = Point(x, y).to_rg_point()

# The following line would be connected to the output of the Grasshopper Python script component
# a = my_point
# ---------- end my_point ----------
panel = Panel(my_point.out)
panel_2 = Panel(my_point.my_point)
panel_3 = Panel(staircase_steps.staircase_steps)
panel_4 = Panel(twisted_towers.base_point)
panel_5 = Panel(staircase_steps.out)
panel_6 = Panel(twisted_towers.out)
panel_7 = Panel(twisted_towers.tower)
