# Grasshopper definition 002_Gettingg_Started.gh (Grasshopper 1.0.8)
# plug-ins: RhinoCodePluginGH

pauli_maticies_004 = Script(
    trig_paramIn=Slider(3.52, range=0.01..10),
    scale_factorIn=Slider(2.3, range=0.5..3),
    rot_angle_xIn=Slider(0.97, range=0.01..10),
    rot_angle_yIn=Slider(3.07, range=0.01..10),
    rot_angle_zIn=Slider(3.58, range=0.01..10))  # -> out, a, b, c; inputs trig_paramIn: Double, scale_factorIn: Double, rot_angle_xIn: Double, rot_angle_yIn: Double, rot_angle_zIn: Double
# ---------- pauli_maticies_004: Python ----------
import rhinoscriptsyntax as rs
import Rhino.Geometry as rg
import math
import cmath

def pauli_matrices_surfaces(base_pts, trig_param, scale_factor, rot_angle_x, rot_angle_y, rot_angle_z):
    # Define the Pauli matrices
    sigma_x = [[0, 1], [1, 0]]
    sigma_y = [[0, -1j], [1j, 0]]
    sigma_z = [[1, 0], [0, -1]]

    # Create a function to apply a matrix transformation to a 3D point
    def apply_transformation(matrix, point):
        x, y, z = point.X, point.Y, point.Z
        new_x = matrix[0][0] * x + matrix[0][1] * y
        new_y = matrix[1][0] * x + matrix[1][1] * y
        return rg.Point3d(new_x.real, new_y.real, z)

    # Create a function to apply trigonometric transformations to a 3D point
    def trig_transform(point, t):
        x, y, z = point.X, point.Y, point.Z
        new_x = x * math.cos(t) - y * math.sin(t)
        new_y = x * math.sin(t) + y * math.cos(t)
        new_z = z + math.sin(t)
        return rg.Point3d(new_x, new_y, new_z)
    
    # Create a function to apply scaling to a 3D point
    def scale_point(point, factor):
        scaling = rg.Transform.Scale(rg.Point3d(0, 0, 0), factor)
        point.Transform(scaling)
        return point

    # Create a function to apply rotations to a 3D point
    def rotate_point(point, angle, axis):
        rotation = rg.Transform.Rotation(angle, axis, rg.Point3d(0, 0, 0))
        point.Transform(rotation)
        return point

    # Apply the Pauli matrices transformations to the base points
    transformed_points_x = [apply_transformation(sigma_x, p) for p in base_pts]
    transformed_points_y = [apply_transformation(sigma_y, p) for p in base_pts]
    transformed_points_z = [apply_transformation(sigma_z, p) for p in base_pts]

    # Apply trigonometric transformations to add more complexity
    complex_points_x = [trig_transform(p, trig_param) for p in transformed_points_x]
    complex_points_y = [trig_transform(p, trig_param) for p in transformed_points_y]
    complex_points_z = [trig_transform(p, trig_param) for p in transformed_points_z]

    # Apply scaling
    scaled_points_x = [scale_point(p, scale_factor) for p in complex_points_x]
    scaled_points_y = [scale_point(p, scale_factor) for p in complex_points_y]
    scaled_points_z = [scale_point(p, scale_factor) for p in complex_points_z]

    # Apply rotations
    rotated_points_x = [rotate_point(p, rot_angle_x, rg.Vector3d(1, 0, 0)) for p in scaled_points_x]
    rotated_points_y = [rotate_point(p, rot_angle_y, rg.Vector3d(0, 1, 0)) for p in scaled_points_y]
    rotated_points_z = [rotate_point(p, rot_angle_z, rg.Vector3d(0, 0, 1)) for p in scaled_points_z]

    # Create surfaces by lofting between the original and transformed points
    loft_surfaces = []
    
    def create_surface(points1, points2):
        if len(points1) == len(points2):
            loft_curves = []
            for i in range(len(points1)):
                line = rg.Line(points1[i], points2[i])
                loft_curves.append(line.ToNurbsCurve())
            loft_surface = rg.Brep.CreateFromLoft(loft_curves, rg.Point3d.Unset, rg.Point3d.Unset, rg.LoftType.Normal, False)
            if loft_surface:
                return loft_surface[0]
        return None
    
    # Create surfaces using the transformations
    surface_x = create_surface(base_pts, rotated_points_x)
    surface_y = create_surface(base_pts, rotated_points_y)
    surface_z = create_surface(base_pts, rotated_points_z)

    if surface_x:
        loft_surfaces.append(surface_x)
    if surface_y:
        loft_surfaces.append(surface_y)
    if surface_z:
        loft_surfaces.append(surface_z)

    # Return the generated surfaces
    return loft_surfaces

# Input parameters
base_pts = [rg.Point3d(1, 0, 0), rg.Point3d(0, 1, 0), rg.Point3d(-1, 0, 0), rg.Point3d(0, -1, 0), rg.Point3d(1, 1, 1), rg.Point3d(-1, -1, -1)]
trig_param = math.pi / trig_paramIn  # Trigonometric parameter
scale_factor = scale_factorIn  # Scaling factor
rot_angle_x = math.pi / rot_angle_xIn  # Rotation angle around X-axis
rot_angle_y = math.pi / rot_angle_yIn  # Rotation angle around Y-axis
rot_angle_z = math.pi / rot_angle_zIn # Rotation angle around Z-axis

# Call the function and output the results
output = pauli_matrices_surfaces(base_pts, trig_param, scale_factor, rot_angle_x, rot_angle_y, rot_angle_z)

# Use Grasshopper component output
a = None
b = None
c = None

if output:
    if len(output) > 0:
        a = output[0]  # First output
    if len(output) > 1:
        b = output[1]  # Second output
    if len(output) > 2:
        c = output[2]  # Third output
# ---------- end pauli_maticies_004 ----------
# 002 Getting Started
# 
# Learning Python in Grasshopper with gpt-4o
pauli_maticies_001 = Script()  # -> out, a, b, c, d, e
# ---------- pauli_maticies_001: Python ----------
import rhinoscriptsyntax as rs
import Rhino.Geometry as rg
import math

def pauli_matrix_visualization():
    # Define the Pauli matrices
    sigma_x = [[0, 1], [1, 0]]
    sigma_y = [[0, -1j], [1j, 0]]
    sigma_z = [[1, 0], [0, -1]]

    # Create base points for the geometry
    base_points = [
        rg.Point3d(0, 0, 0),
        rg.Point3d(1, 1, 0),
        rg.Point3d(-1, 1, 0),
        rg.Point3d(-1, -1, 0),
        rg.Point3d(1, -1, 0)
    ]

    # Create a list to hold the transformed points
    transformed_points = []

    # Apply transformations using the Pauli matrices
    for p in base_points:
        x, y, z = p.X, p.Y, p.Z
        
        # Apply sigma_x transformation
        new_x = sigma_x[0][0] * x + sigma_x[0][1] * y
        new_y = sigma_x[1][0] * x + sigma_x[1][1] * y
        transformed_points.append(rg.Point3d(new_x, new_y, z))
        
        # Apply sigma_y transformation
        new_x = sigma_y[0][0] * x + sigma_y[0][1] * y
        new_y = sigma_y[1][0] * x + sigma_y[1][1] * y
        transformed_points.append(rg.Point3d(new_x.real, new_y.real, z))
        
        # Apply sigma_z transformation
        new_x = sigma_z[0][0] * x + sigma_z[0][1] * y
        new_y = sigma_z[1][0] * x + sigma_z[1][1] * y
        transformed_points.append(rg.Point3d(new_x, new_y, z))

    # Create curves from the base points and transformed points
    curves = []
    for i in range(len(base_points)):
        curve = rg.Curve.CreateInterpolatedCurve([base_points[i], transformed_points[i * 3], transformed_points[i * 3 + 1], transformed_points[i * 3 + 2]], 3)
        curves.append(curve)

    # Return the generated curves
    return curves

# Call the function and output the results
output = pauli_matrix_visualization()

# Use Grasshopper component output
for i, curve in enumerate(output):
    if i == 0:
        a = curve  # First output
    elif i == 1:
        b = curve  # Second output
    elif i == 2:
        c = curve  # Third output
    elif i == 3:
        d = curve  # Fourth output
    elif i == 4:
        e = curve  # Fifth output
# ---------- end pauli_maticies_001 ----------
pauli_maticies_003 = Script()  # -> out, a, b, c
# ---------- pauli_maticies_003: Python ----------
import rhinoscriptsyntax as rs
import Rhino.Geometry as rg
import math
import cmath

def pauli_matrices_surfaces():
    # Define the Pauli matrices
    sigma_x = [[0, 1], [1, 0]]
    sigma_y = [[0, -1j], [1j, 0]]
    sigma_z = [[1, 0], [0, -1]]

    # Create a function to apply a matrix transformation to a 3D point
    def apply_transformation(matrix, point):
        x, y, z = point.X, point.Y, point.Z
        new_x = matrix[0][0] * x + matrix[0][1] * y
        new_y = matrix[1][0] * x + matrix[1][1] * y
        return rg.Point3d(new_x.real, new_y.real, z)

    # Create a function to apply trigonometric transformations to a 3D point
    def trig_transform(point, t):
        x, y, z = point.X, point.Y, point.Z
        new_x = x * math.cos(t) - y * math.sin(t)
        new_y = x * math.sin(t) + y * math.cos(t)
        new_z = z + math.sin(t)
        return rg.Point3d(new_x, new_y, new_z)

    # Create base points for the geometry
    base_points = [
        rg.Point3d(1, 0, 0),
        rg.Point3d(0, 1, 0),
        rg.Point3d(-1, 0, 0),
        rg.Point3d(0, -1, 0),
        rg.Point3d(1, 1, 1),
        rg.Point3d(-1, -1, -1)
    ]

    # Apply the Pauli matrices transformations to the base points
    transformed_points_x = [apply_transformation(sigma_x, p) for p in base_points]
    transformed_points_y = [apply_transformation(sigma_y, p) for p in base_points]
    transformed_points_z = [apply_transformation(sigma_z, p) for p in base_points]

    # Apply trigonometric transformations to add more complexity
    t = math.pi / 4  # Example parameter for trig transformations
    complex_points_x = [trig_transform(p, t) for p in transformed_points_x]
    complex_points_y = [trig_transform(p, t) for p in transformed_points_y]
    complex_points_z = [trig_transform(p, t) for p in transformed_points_z]

    # Create surfaces by lofting between the original and transformed points
    loft_surfaces = []
    
    def create_surface(points1, points2):
        if len(points1) == len(points2):
            loft_curves = []
            for i in range(len(points1)):
                line = rg.Line(points1[i], points2[i])
                loft_curves.append(line.ToNurbsCurve())
            loft_surface = rg.Brep.CreateFromLoft(loft_curves, rg.Point3d.Unset, rg.Point3d.Unset, rg.LoftType.Normal, False)
            if loft_surface:
                return loft_surface[0]
        return None
    
    # Create surfaces using the transformations
    surface_x = create_surface(base_points, complex_points_x)
    surface_y = create_surface(base_points, complex_points_y)
    surface_z = create_surface(base_points, complex_points_z)

    if surface_x:
        loft_surfaces.append(surface_x)
    if surface_y:
        loft_surfaces.append(surface_y)
    if surface_z:
        loft_surfaces.append(surface_z)

    # Return the generated surfaces
    return loft_surfaces

# Call the function and output the results
output = pauli_matrices_surfaces()

# Use Grasshopper component output
a = None
b = None
c = None

if output:
    if len(output) > 0:
        a = output[0]  # First output
    if len(output) > 1:
        b = output[1]  # Second output
    if len(output) > 2:
        c = output[2]  # Third output
# ---------- end pauli_maticies_003 ----------
pauli_maticies_002 = Script()  # -> out, a, b, c, d, e
# ---------- pauli_maticies_002: Python ----------
import rhinoscriptsyntax as rs
import Rhino.Geometry as rg
import math
import cmath

def pauli_matrix_visualization():
    # Define the Pauli matrices
    sigma_x = [[0, 1], [1, 0]]
    sigma_y = [[0, -1j], [1j, 0]]
    sigma_z = [[1, 0], [0, -1]]

    # Create base points for the geometry
    base_points = [
        rg.Point3d(0, 0, 0),
        rg.Point3d(1, 1, 0),
        rg.Point3d(-1, 1, 0),
        rg.Point3d(-1, -1, 0),
        rg.Point3d(1, -1, 0)
    ]

    # Create a list to hold the transformed points
    transformed_points = []

    # Function to apply complex transformations
    def apply_transformation(matrix, point):
        x, y, z = point.X, point.Y, point.Z
        new_x = matrix[0][0] * x + matrix[0][1] * y
        new_y = matrix[1][0] * x + matrix[1][1] * y
        return rg.Point3d(new_x.real, new_y.real, z)

    # Apply transformations using the Pauli matrices
    for p in base_points:
        # Apply sigma_x transformation
        transformed_points.append(apply_transformation(sigma_x, p))
        
        # Apply sigma_y transformation
        transformed_points.append(apply_transformation(sigma_y, p))
        
        # Apply sigma_z transformation
        transformed_points.append(apply_transformation(sigma_z, p))

    # Add more complexity with rotations and scaling
    def rotate_point(point, angle, axis):
        rotation = rg.Transform.Rotation(angle, axis, rg.Point3d(0, 0, 0))
        point.Transform(rotation)
        return point

    def scale_point(point, factor):
        scaling = rg.Transform.Scale(rg.Point3d(0, 0, 0), factor)
        point.Transform(scaling)
        return point

    complex_points = []
    for tp in transformed_points:
        # Rotate around Z-axis
        angle = math.pi / 4  # 45 degrees
        rotated_point = rotate_point(tp, angle, rg.Vector3d(0, 0, 1))
        complex_points.append(rotated_point)
        
        # Rotate around Y-axis
        angle = math.pi / 6  # 30 degrees
        rotated_point = rotate_point(tp, angle, rg.Vector3d(0, 1, 0))
        complex_points.append(rotated_point)
        
        # Scale the point
        scaled_point = scale_point(tp, 1.5)
        complex_points.append(scaled_point)

    # Create curves from the base points and transformed points
    curves = []
    for i in range(len(base_points)):
        curve_points = [
            base_points[i],
            transformed_points[i * 3],
            transformed_points[i * 3 + 1],
            transformed_points[i * 3 + 2],
            complex_points[i * 3],
            complex_points[i * 3 + 1],
            complex_points[i * 3 + 2]
        ]
        # Ensure all points are valid
        valid_points = [pt for pt in curve_points if pt is not None]
        if len(valid_points) >= 2:
            curve = rg.Curve.CreateInterpolatedCurve(valid_points, 3)
            curves.append(curve)

    # Return the generated curves
    return curves

# Call the function and output the results
output = pauli_matrix_visualization()

# Use Grasshopper component output
for i, curve in enumerate(output):
    if i == 0:
        a = curve  # First output
    elif i == 1:
        b = curve  # Second output
    elif i == 2:
        c = curve  # Third output
    elif i == 3:
        d = curve  # Fourth output
    elif i == 4:
        e = curve  # Fifth output
# ---------- end pauli_maticies_002 ----------
panel = Panel(pauli_maticies_001.out)
panel_2 = Panel(pauli_maticies_002.out)
panel_3 = Panel(pauli_maticies_003.out)
panel_4 = Panel(pauli_maticies_004.out)
stream_filter = StreamFilter(
    Gate=Slider(4, range=0..4),
    Stream0=pauli_maticies_001.a,
    Stream1=pauli_maticies_001.b,
    Stream2=pauli_maticies_001.c,
    Stream3=pauli_maticies_001.d,
    Stream4=pauli_maticies_001.e)
stream_filter_2 = StreamFilter(
    Gate=Slider(0, range=0..4),
    Stream0=pauli_maticies_002.a,
    Stream1=pauli_maticies_002.b,
    Stream2=pauli_maticies_002.c,
    Stream3=pauli_maticies_002.d,
    Stream4=pauli_maticies_002.e)
stream_filter_3 = StreamFilter(Gate=Slider(0, range=0..2), Stream0=pauli_maticies_003.a, Stream1=pauli_maticies_003.b, Stream2=pauli_maticies_003.c)
geometry = Geometry(pauli_maticies_003.a)
stream_filter_4 = StreamFilter(Gate=Slider(0, range=0..2), Stream0=pauli_maticies_004.a, Stream1=pauli_maticies_004.b, Stream2=pauli_maticies_004.c)
geometry_2 = Geometry(pauli_maticies_004.a)
curve = Curve([pauli_maticies_002.d, pauli_maticies_002.e])
panel_5 = Panel(stream_filter)
panel_6 = Panel(stream_filter_2)
panel_7 = Panel(stream_filter_3)
panel_8 = Panel(stream_filter_4)
