# Grasshopper definition 003_TheHeatEquation.gh (Grasshopper 1.0.8)
# plug-ins: RhinoCodePluginGH

# 002 Getting Started
# 
# Learning Python in Grasshopper with gpt-4o
# 
# THE HEAT EXCHANGE
# 
# Let's create a Python script for the Grasshopper
#  node editor in Rhino 8 that demonstrates
# interesting geometry inspired by the heat
# equation shown in the image. The heat equation
#  is a partial differential equation that describes
# how heat diffuses through a given region.
# 
# We'll use a simplified interpretation of the heat
# equation to generate a 3D surface based on a
# heat distribution function. The surface will be
# dynamically generated using parametric
# inputsfor time and diffusion coefficients.
number_slider = Slider(6.25, range=0..100)
theheatexchange_002 = Script(
    sizeIn=Slider(21.57, range=0..100),
    resolutionIn=Slider(18, range=0..30),
    alpha=Slider(2.51, range=-5..5.01),
    beta=Slider(2.29, range=0..3),
    gamma=Slider(-4.17, range=-5..5.01),
    delta=Slider(2.55, range=-5..5.01))  # -> out, a; inputs sizeIn: Double, resolutionIn: Int32, alpha: Double, beta: Double, gamma: Double, delta: Double
# ---------- theheatexchange_002: Python ----------
import rhinoscriptsyntax as rs
import Rhino.Geometry as rg
import math
import numpy as np

def complex_surface(size, resolution, alpha, beta, gamma, delta):
    # Generate a grid of points
    points = []

    for i in range(resolution + 1):
        for j in range(resolution + 1):
            x = size * (i / resolution - 0.5)
            y = size * (j / resolution - 0.5)
            z = complex_function(x, y, alpha, beta, gamma, delta)
            points.append(rg.Point3d(x, y, z))

    # Create a list of curves
    curves = []
    for i in range(resolution + 1):
        curve_points = [points[i * (resolution + 1) + j] for j in range(resolution + 1)]
        curve = rg.Curve.CreateInterpolatedCurve(curve_points, 3)
        curves.append(curve)
        
    # Create a surface from the curves
    surface = rg.Brep.CreateFromLoft(curves, rg.Point3d.Unset, rg.Point3d.Unset, rg.LoftType.Normal, False)
    
    if surface:
        return surface[0]
    return None

def complex_function(x, y, alpha, beta, gamma, delta):
    # Multi-variable calculus function incorporating inverse tangent and trigonometric functions
    r = math.sqrt(x**2 + y**2)
    if r == 0:
        return 0  # Avoid division by zero
    return alpha * math.atan(beta * r) + gamma * math.sin(delta * r) * math.exp(-r)

# Input parameters
size = sizeIn      # Size of the grid
resolution = resolutionIn  # Resolution of the grid
alpha = alpha    # Coefficient for atan term
beta = beta     # Coefficient inside atan
gamma = gamma    # Coefficient for sine term
delta = delta    # Frequency for sine term

# Call the function and output the results
surface = complex_surface(size, resolution, alpha, beta, gamma, delta)

# Use Grasshopper component output
a = surface
# ---------- end theheatexchange_002 ----------
theheatexchange_001 = Script(sizeIn=number_slider, n_termsIn=Slider(1.184, range=0..5), a0In=Slider(1.38, range=0.01..5.01))  # -> out, a; inputs sizeIn: Double, n_termsIn: Double, a0In: Double
# ---------- theheatexchange_001: Python ----------
import rhinoscriptsyntax as rs
import Rhino.Geometry as rg
import math
import numpy as np

def heat_equation_surface(size, time, alpha):
    # Generate a grid of points
    resolution = 50
    points = []

    for i in range(resolution + 1):
        for j in range(resolution + 1):
            x = size * (i / resolution - 0.5)
            y = size * (j / resolution - 0.5)
            z = heat_distribution(x, y, time, alpha)
            points.append(rg.Point3d(x, y, z))

    # Create a list of curves
    curves = []
    for i in range(resolution + 1):
        curve_points = [points[i * (resolution + 1) + j] for j in range(resolution + 1)]
        curve = rg.Curve.CreateInterpolatedCurve(curve_points, 3)
        curves.append(curve)
        
    # Create a surface from the curves
    surface = rg.Brep.CreateFromLoft(curves, rg.Point3d.Unset, rg.Point3d.Unset, rg.LoftType.Normal, False)
    
    if surface:
        return surface[0]
    return None

def heat_distribution(x, y, t, alpha):
    # Simple heat distribution function inspired by the heat equation
    r = math.sqrt(x**2 + y**2)
    return math.exp(-alpha * r**2 / t) * math.sin(math.pi * r / t)

# Input parameters
size = sizeIn  # Size of the grid
time = n_termsIn   # Time parameter
alpha = a0In  # Diffusion coefficient

# Call the function and output the results
surface = heat_equation_surface(size, time, alpha)

# Use Grasshopper component output
a = surface
# ---------- end theheatexchange_001 ----------
panel = Panel(theheatexchange_001.out)
panel_2 = Panel(theheatexchange_001.a)
panel_3 = Panel(theheatexchange_002.out)
panel_4 = Panel(theheatexchange_002.a)
