# Grasshopper definition 004_RuffinisRule.gh (Grasshopper 1.0.8)
# plug-ins: RhinoCodePluginGH

# 002 Getting Started
# 
# Learning Python in Grasshopper with gpt-4o
# 
# RUFFINI'S RULE
# 
# To create a Python script for the Grasshopper
# node editor in Rhino 8 that demonstrates
# interesting geometry inspired by Ruffini's Rule,
# we'll interpret the polynomial division process
# geometrically. We'll use the coefficients of a
# polynomial to create a dynamic and visually
# engaging surface.
# 
# Here's a script that uses the coefficients of a
# polynomial and Ruffini's Rule to create a
# parametric surface:
number_slider = Slider(5.42, range=0..100)
ruffinis_rule_002 = Script(
    size=Slider(8.5, range=0..100),
    resolution=Slider(10, range=0..10),
    coefficients=[Slider(0.833, range=-5..5), Slider(1.105, range=-5..5), Slider(-0.458, range=-5..5), Slider(5, range=-5..5)],
    alpha=Slider(1.96, range=-2..2),
    height=Slider(2.22, range=0..100),
    num_floors=Slider(6, range=0..10),
    elevation_factor=Slider(0.18, range=0..10))  # -> out, a, b, c, d; inputs size: Double, resolution: Int32, coefficients: list of Double, alpha: Double, height: Double, num_floors: Int32, elevation_factor: Double
# ---------- ruffinis_rule_002: Python ----------
import rhinoscriptsyntax as rs
import Rhino.Geometry as rg
import math

def ruffini_surface(size, resolution, coefficients, alpha, height, num_floors, elevation_factor):
    # Generate a grid of points
    points = []

    for i in range(resolution + 1):
        for j in range(resolution + 1):
            x = size * (i / resolution - 0.5)
            y = size * (j / resolution - 0.5)
            z = ruffini_polynomial(x, coefficients, alpha) * elevation_factor
            points.append(rg.Point3d(x, y, z))

    # Create a list of curves
    curves = []
    for i in range(resolution + 1):
        curve_points = [points[i * (resolution + 1) + j] for j in range(resolution + 1)]
        curve = rg.Curve.CreateInterpolatedCurve(curve_points, 3)
        curves.append(curve)
        
    # Create a surface from the curves
    surface = rg.Brep.CreateFromLoft(curves, rg.Point3d.Unset, rg.Point3d.Unset, rg.LoftType.Normal, False)
    
    if surface and len(surface) > 0:
        surface = surface[0]
        elevations = create_elevations(surface, height)
        floor_plans = create_floor_plans(surface, height, num_floors)
        sections = create_sections(surface, height, size)
        return surface, elevations, floor_plans, sections
    return None, [], [], []

def ruffini_polynomial(x, coefficients, alpha):
    # Perform polynomial division using Ruffini's Rule
    n = len(coefficients)
    b = [0] * n
    b[0] = coefficients[0]
    for i in range(1, n):
        b[i] = coefficients[i] + alpha * b[i - 1]
    remainder = b[-1]

    # Use the quotient polynomial to define the z-coordinate
    z = sum(b[i] * (x ** (n - i - 1)) for i in range(n - 1))
    return z + remainder

def create_elevations(surface, height):
    # Generate elevations from the surface
    elevations = []
    for i in range(4):
        angle = i * math.pi / 2
        rotated_surface = surface.DuplicateBrep()
        rotation = rg.Transform.Rotation(angle, rg.Vector3d.ZAxis, rg.Point3d(0, 0, 0))
        rotated_surface.Transform(rotation)
        elevations.append(rotated_surface)
    return elevations

def create_floor_plans(surface, height, num_floors):
    # Generate floor plans at different heights
    floor_plans = []
    for i in range(num_floors):
        z = i * height / num_floors
        plane = rg.Plane(rg.Point3d(0, 0, z), rg.Vector3d.ZAxis)
        contour = rg.Brep.CreateContourCurves(surface, plane)
        floor_plans.extend(contour)
    return floor_plans

def create_sections(surface, height, size):
    # Generate sections through the surface
    sections = []
    num_sections = 5
    for i in range(num_sections):
        x = size * (i / (num_sections - 1) - 0.5)
        plane = rg.Plane(rg.Point3d(x, 0, 0), rg.Vector3d.XAxis)
        section = rg.Brep.CreateContourCurves(surface, plane)
        sections.extend(section)
    return sections

# Input parameters
size = size                    # Size of the grid
resolution = resolution              # Resolution of the grid
coefficients = coefficients # Coefficients of the polynomial
alpha = alpha                  # Alpha value for Ruffini's Rule
height = height                  # Height of the architectural elements
num_floors = num_floors               # Number of floors
elevation_factor = elevation_factor       # Factor to scale elevations

# Call the function and output the results
surface, elevations, floor_plans, sections = ruffini_surface(size, resolution, coefficients, alpha, height, num_floors, elevation_factor)

# Use Grasshopper component output
a = surface
b = elevations
c = floor_plans
d = sections
# ---------- end ruffinis_rule_002 ----------
ruffinis_rule_001 = Script(
    size=number_slider,
    resolution=Slider(8, range=0..10),
    coefficients=[Slider(0.624, range=-5..5), Slider(-1.622, range=-5..5), Slider(0.287, range=-5..5), Slider(0.657, range=-5..5)],
    alpha=Slider(1.66, range=-2..2))  # -> out, a; inputs size: Double, resolution: Int32, coefficients: list of Double, alpha: Double
# ---------- ruffinis_rule_001: Python ----------
import rhinoscriptsyntax as rs
import Rhino.Geometry as rg
import math

def ruffini_surface(size, resolution, coefficients, alpha):
    # Generate a grid of points
    points = []

    for i in range(resolution + 1):
        for j in range(resolution + 1):
            x = size * (i / resolution - 0.5)
            y = size * (j / resolution - 0.5)
            z = ruffini_polynomial(x, coefficients, alpha)
            points.append(rg.Point3d(x, y, z))

    # Create a list of curves
    curves = []
    for i in range(resolution + 1):
        curve_points = [points[i * (resolution + 1) + j] for j in range(resolution + 1)]
        curve = rg.Curve.CreateInterpolatedCurve(curve_points, 3)
        curves.append(curve)
        
    # Create a surface from the curves
    surface = rg.Brep.CreateFromLoft(curves, rg.Point3d.Unset, rg.Point3d.Unset, rg.LoftType.Normal, False)
    
    if surface:
        return surface[0]
    return None

def ruffini_polynomial(x, coefficients, alpha):
    # Perform polynomial division using Ruffini's Rule
    n = len(coefficients)
    b = [0] * n
    b[0] = coefficients[0]
    for i in range(1, n):
        b[i] = coefficients[i] + alpha * b[i - 1]
    remainder = b[-1]

    # Use the quotient polynomial to define the z-coordinate
    z = sum(b[i] * (x ** (n - i - 1)) for i in range(n - 1))
    return z + remainder

# Input parameters
size = size                    # Size of the grid
resolution = resolution              # Resolution of the grid
coefficients = coefficients # Coefficients of the polynomial
alpha = alpha                  # Alpha value for Ruffini's Rule

# Call the function and output the results
surface = ruffini_surface(size, resolution, coefficients, alpha)

# Use Grasshopper component output
a = surface
# ---------- end ruffinis_rule_001 ----------
panel = Panel(ruffinis_rule_001.out)
panel_2 = Panel(ruffinis_rule_001.a)
panel_3 = Panel(ruffinis_rule_002.out)
geometry = Geometry(ruffinis_rule_002.a)
geometry_2 = Geometry(ruffinis_rule_002.c)
curve = Curve(ruffinis_rule_002.b)
curve_2 = Curve(ruffinis_rule_002.d)
panel_4 = Panel(geometry_2)
panel_5 = Panel(geometry)
panel_6 = Panel(curve_2)
panel_7 = Panel(curve)
