# Grasshopper definition 004_TheFourierSeries.gh (Grasshopper 1.0.8)
# plug-ins: RhinoCodePluginGH

# 002 Getting Started
# 
# Learning Python in Grasshopper with gpt-4o
# 
# THE FOURIER SERIES
# 
# Let's create a Python script for the Grasshopper
#  node editor in Rhino 8 that demonstrates
# interesting geometry inspired by the Fourier
# series formula shown in the image. The Fourier
# series is used to approximate periodic functions
# by summing sines and cosines. We'll use this
# idea to generate a complex and visually
# appealing surface.
# 
# Here’s the script that uses the Fourier series to
# generate a parametric surface:ric inputs
# for time and diffusion coefficients.
number_slider = Slider(11.57, range=0..100)
thefourierseries_002 = Script(
    sizeIn=Slider(21.97, range=0..100),
    resolutionIn=Slider(18, range=0..30),
    n_termsIn=Slider(5, range=0..5),
    a0In=Slider(0.4, range=-5..5.01),
    scale_factorIn=Slider(2.04, range=0..3),
    freq_xIn=Slider(0.31, range=-5..5.01),
    freq_yIn=Slider(-0.35, range=-5..5.01))  # -> out, a; inputs sizeIn: Double, resolutionIn: Int32, n_termsIn: Int32, a0In: Double, scale_factorIn: Double, freq_xIn: Double, freq_yIn: Double
# ---------- thefourierseries_002: Python ----------
import rhinoscriptsyntax as rs
import Rhino.Geometry as rg
import math
import cmath

def complex_fourier_series_surface(size, resolution, n_terms, a0, ak_real, ak_imag, bk_real, bk_imag, scale_factor, freq_x, freq_y):
    # Generate a grid of points
    points = []

    for i in range(resolution + 1):
        for j in range(resolution + 1):
            x = size * (i / resolution - 0.5)
            y = size * (j / resolution - 0.5)
            z = complex_fourier_series(x, y, n_terms, a0, ak_real, ak_imag, bk_real, bk_imag, scale_factor, freq_x, freq_y)
            points.append(rg.Point3d(x, y, z))

    # Create a list of curves
    curves = []
    for i in range(resolution + 1):
        curve_points = [points[i * (resolution + 1) + j] for j in range(resolution + 1)]
        curve = rg.Curve.CreateInterpolatedCurve(curve_points, 3)
        curves.append(curve)
        
    # Create a surface from the curves
    surface = rg.Brep.CreateFromLoft(curves, rg.Point3d.Unset, rg.Point3d.Unset, rg.LoftType.Normal, False)
    
    if surface:
        return surface[0]
    return None

def complex_fourier_series(x, y, n_terms, a0, ak_real, ak_imag, bk_real, bk_imag, scale_factor, freq_x, freq_y):
    # Compute the complex Fourier series at a given (x, y) point
    result = a0 / 2.0
    for k in range(1, n_terms + 1):
        ak = complex(ak_real[k-1], ak_imag[k-1])
        bk = complex(bk_real[k-1], bk_imag[k-1])
        result += (ak * cmath.exp(complex(0, k * freq_x * x)) + bk * cmath.exp(complex(0, k * freq_y * y))).real
    return scale_factor * result

# Input parameters
size = sizeIn              # Size of the grid
resolution = resolutionIn        # Resolution of the grid
n_terms = n_termsIn            # Number of terms in the Fourier series
a0 = a0In               # a0 coefficient
scale_factor = scale_factorIn    # Scaling factor for the surface
freq_x = freq_xIn           # Frequency multiplier for the x-axis
freq_y = freq_yIn           # Frequency multiplier for the y-axis

# Example coefficients for ak and bk (real and imaginary parts)
ak_real = [1.0, 0.5, 0.25, 0.125, 0.0625]
ak_imag = [0.0, 0.1, 0.05, 0.025, 0.0125]
bk_real = [0.5, 0.25, 0.125, 0.0625, 0.03125]
bk_imag = [0.0, 0.05, 0.025, 0.0125, 0.00625]

# Call the function and output the results
surface = complex_fourier_series_surface(size, resolution, n_terms, a0, ak_real, ak_imag, bk_real, bk_imag, scale_factor, freq_x, freq_y)

# Use Grasshopper component output
a = surface
# ---------- end thefourierseries_002 ----------
thefourierseries_001 = Script(
    sizeIn=number_slider,
    resolutionIn=Slider(21, range=0..30),
    n_termsIn=Slider(2, range=0..5),
    a0In=Slider(3.76, range=-5..5.01))  # -> out, a; inputs sizeIn: Double, resolutionIn: Int32, n_termsIn: Int32, a0In: Double
# ---------- thefourierseries_001: Python ----------
import rhinoscriptsyntax as rs
import Rhino.Geometry as rg
import math

def fourier_series_surface(size, resolution, n_terms, a0, ak_coeffs, bk_coeffs):
    # Generate a grid of points
    points = []

    for i in range(resolution + 1):
        for j in range(resolution + 1):
            x = size * (i / resolution - 0.5)
            y = size * (j / resolution - 0.5)
            z = fourier_series(x, y, n_terms, a0, ak_coeffs, bk_coeffs)
            points.append(rg.Point3d(x, y, z))

    # Create a list of curves
    curves = []
    for i in range(resolution + 1):
        curve_points = [points[i * (resolution + 1) + j] for j in range(resolution + 1)]
        curve = rg.Curve.CreateInterpolatedCurve(curve_points, 3)
        curves.append(curve)
        
    # Create a surface from the curves
    surface = rg.Brep.CreateFromLoft(curves, rg.Point3d.Unset, rg.Point3d.Unset, rg.LoftType.Normal, False)
    
    if surface:
        return surface[0]
    return None

def fourier_series(x, y, n_terms, a0, ak_coeffs, bk_coeffs):
    # Compute the Fourier series at a given (x, y) point
    result = a0 / 2.0
    for k in range(1, n_terms + 1):
        result += ak_coeffs[k-1] * math.cos(k * x) + bk_coeffs[k-1] * math.sin(k * y)
    return result

# Input parameters
size = sizeIn              # Size of the grid
resolution = resolutionIn        # Resolution of the grid
n_terms = n_termsIn            # Number of terms in the Fourier series
a0 = a0In               # a0 coefficient

# Example coefficients for ak and bk (could be inputs)
ak_coeffs = [1.0, 0.5, 0.25, 0.125, 0.0625]
bk_coeffs = [0.5, 0.25, 0.125, 0.0625, 0.03125]

# Call the function and output the results
surface = fourier_series_surface(size, resolution, n_terms, a0, ak_coeffs, bk_coeffs)

# Use Grasshopper component output
a = surface
# ---------- end thefourierseries_001 ----------
panel = Panel(thefourierseries_001.out)
panel_2 = Panel(thefourierseries_001.a)
panel_3 = Panel(thefourierseries_002.out)
panel_4 = Panel(thefourierseries_002.a)
