# Grasshopper definition 005_ThetrisectrixofMaclaurin.gh (Grasshopper 1.0.8)
# plug-ins: RhinoCodePluginGH

# 002 Getting Started
# 
# Learning Python in Grasshopper with gpt-4o
# 
# The trisectrix of Maclaurin
# 
# Let's create a Python script for the Grasshopper
#  node editor in Rhino 8 that generates
# interesting geometry inspired by the Trisectrix of
# Maclaurin. We will use both the Cartesian and
# polar forms of the equation to generate curves
# and surfaces.
number_slider = Slider(6.97, range=0..10)
the_trisectrix_of_maclaurin_001 = Script(a=number_slider, resolution=Slider(100, range=0..100))  # -> out, aOut, bOut, cOut, dOut; inputs a: Double, resolution: Int32
# ---------- the_trisectrix_of_maclaurin_001: Python ----------
import rhinoscriptsyntax as rs
import Rhino.Geometry as rg
import math

def generate_trisectrix_points(a, resolution):
    points_cartesian = []
    points_polar = []
    for i in range(resolution + 1):
        theta = i * 2 * math.pi / resolution - math.pi
        r = (a / 2) * (4 * math.cos(theta) - 1 / math.cos(theta))
        x = r * math.cos(theta)
        y = r * math.sin(theta)
        points_cartesian.append(rg.Point3d(x, y, 0))
        points_polar.append(rg.Point3d(x, y, 0))
    return points_cartesian, points_polar

def generate_trisectrix_curves(points_cartesian, points_polar):
    curve_cartesian = rg.Curve.CreateInterpolatedCurve(points_cartesian, 3)
    curve_polar = rg.Curve.CreateInterpolatedCurve(points_polar, 3)
    return curve_cartesian, curve_polar

def main(a, resolution):
    points_cartesian, points_polar = generate_trisectrix_points(a, resolution)
    curve_cartesian, curve_polar = generate_trisectrix_curves(points_cartesian, points_polar)
    return points_cartesian, points_polar, curve_cartesian, curve_polar

# Input parameters
a = a                # Parameter 'a' in the trisectrix equation
resolution = resolution      # Resolution of the curves

# Call the main function and output the results
points_cartesian, points_polar, curve_cartesian, curve_polar = main(a, resolution)

# Use Grasshopper component output
aOut = points_cartesian
bOut = points_polar
cOut = curve_cartesian
dOut = curve_polar
# ---------- end the_trisectrix_of_maclaurin_001 ----------
number = Number(the_trisectrix_of_maclaurin_001.dOut)
panel = Panel(the_trisectrix_of_maclaurin_001.out)
panel_2 = Panel(number)
param_viewer = ParamViewer(the_trisectrix_of_maclaurin_001.bOut)
