# Grasshopper definition 006_FermisGoldenRule.gh (Grasshopper 1.0.8)
# plug-ins: RhinoCodePluginGH

# 002 Getting Started
# 
# Learning Python in Grasshopper with gpt-4o
# 
# Ferm'is Golden Rule
# 
# Let's create a Python script for the Grasshoppe
# r node editor in Rhino 8 that generates
# interesting geometry inspired by Fermi's Golden
# Rule. We'll interpret the elements of the
# equation and use them to create a dynamic
# geometric pattern. The key components of the
# equation involve a transition rate, a density of
# states, and a perturbing Hamiltonian. We will
# use these concepts to define points and curves
#  in a visually engaging way.
number_slider = Slider(10, range=0..10)
pi = Pi(Factor=Slider(1, range=0..10))
fermisgoldenrule_001 = Script(
    a=number_slider,
    resolution=Slider(100, range=0..100),
    perturbation=Slider(-3, range=-3..3),
    density_states=Slider(7.13, range=0..10),
    transition_rate=Slider(3, range=-3..3))  # -> out, a, b; inputs a: Double, resolution: Int32, perturbation: Double, density_states: Double, transition_rate: Double
# ---------- fermisgoldenrule_001: Python ----------
import rhinoscriptsyntax as rs
import Rhino.Geometry as rg
import math
import cmath
import random

def generate_fermi_points(resolution, perturbation, density_states):
    points = []
    for i in range(resolution + 1):
        theta = i * 2 * math.pi / resolution
        r = density_states * math.cos(perturbation * theta)
        x = r * math.cos(theta)
        y = r * math.sin(theta)
        z = density_states * math.sin(perturbation * theta)
        points.append(rg.Point3d(x, y, z))
    return points

def generate_fermi_curves(points, transition_rate):
    curves = []
    for i in range(len(points) - 1):
        start_point = points[i]
        end_point = points[i + 1]
        mid_point = rg.Point3d((start_point.X + end_point.X) / 2, (start_point.Y + end_point.Y) / 2, transition_rate * random.uniform(-1, 1))
        curve = rg.Curve.CreateInterpolatedCurve([start_point, mid_point, end_point], 3)
        curves.append(curve)
    return curves

def main(resolution, perturbation, density_states, transition_rate):
    points = generate_fermi_points(resolution, perturbation, density_states)
    curves = generate_fermi_curves(points, transition_rate)
    return points, curves

# Input parameters
resolution = resolution             # Resolution of the curves
perturbation = perturbation           # Perturbation parameter
density_states = density_states        # Density of states parameter
transition_rate = transition_rate        # Transition rate parameter

# Call the main function and output the results
points, curves = main(resolution, perturbation, density_states, transition_rate)

# Use Grasshopper component output
a = points
b = curves
# ---------- end fermisgoldenrule_001 ----------
fermisgoldenrule_002 = Script(
    a=Slider(10, range=0..10),
    resolution=Slider(100, range=0..100),
    perturbation=Slider(0, range=-3..3),
    density_states=Slider(7.13, range=0..10),
    transition_rate=Slider(3, range=-3..3))  # -> out, a, b, c, d; inputs a: Double, resolution: Int32, perturbation: Double, density_states: Double, transition_rate: Double; same code as fermisgoldenrule_001
fermisgoldenrule_003 = Script(
    resolution=Slider(34, range=0..100),
    perturbation=pi,
    density_states=Slider(6.5, range=0..10),
    height=Slider(10, range=0..10),
    num_levels=Slider(3, range=0..10))  # -> out, a, b, c, d; inputs resolution: Int32, perturbation: Double, density_states: Double, height: Double, num_levels: Int32
# ---------- fermisgoldenrule_003: Python ----------
import rhinoscriptsyntax as rs
import Rhino.Geometry as rg
import math

def generate_fermi_points(resolution, perturbation, density_states, height, num_levels):
    points = []
    for i in range(resolution + 1):
        theta = i * 2 * math.pi / resolution
        r = density_states * math.cos(perturbation * theta)
        x = r * math.cos(theta)
        y = r * math.sin(theta)
        for j in range(num_levels + 1):
            z = j * height / num_levels
            points.append(rg.Point3d(x, y, z))
    return points

def generate_vertical_elements(points, num_levels):
    vertical_elements = []
    for i in range(0, len(points), num_levels + 1):
        column_points = [points[i + j] for j in range(num_levels + 1)]
        vertical_element = rg.Curve.CreateInterpolatedCurve(column_points, 1)
        vertical_elements.append(vertical_element)
    return vertical_elements

def generate_horizontal_elements(points, resolution, num_levels):
    horizontal_elements = []
    for j in range(num_levels + 1):
        for i in range(resolution):
            start_point = points[j + i * (num_levels + 1)]
            end_point = points[j + (i + 1) * (num_levels + 1)]
            beam = rg.LineCurve(start_point, end_point)
            horizontal_elements.append(beam)
    return horizontal_elements

def generate_cross_bracing(points, resolution, num_levels):
    cross_bracing = []
    for i in range(resolution):
        for j in range(num_levels):
            start_point = points[j + i * (num_levels + 1)]
            end_point = points[(j + 1) + (i + 1) * (num_levels + 1)]
            brace = rg.LineCurve(start_point, end_point)
            cross_bracing.append(brace)
            start_point = points[(j + 1) + i * (num_levels + 1)]
            end_point = points[j + (i + 1) * (num_levels + 1)]
            brace = rg.LineCurve(start_point, end_point)
            cross_bracing.append(brace)
    return cross_bracing

def main(resolution, perturbation, density_states, height, num_levels):
    points = generate_fermi_points(resolution, perturbation, density_states, height, num_levels)
    vertical_elements = generate_vertical_elements(points, num_levels)
    horizontal_elements = generate_horizontal_elements(points, resolution, num_levels)
    cross_bracing = generate_cross_bracing(points, resolution, num_levels)
    return points, vertical_elements, horizontal_elements, cross_bracing

# Input parameters
resolution = resolution            # Resolution of the facade
perturbation = perturbation        # Perturbation parameter
density_states = density_states      # Density of states parameter
height = height              # Height of the facade
num_levels = num_levels             # Number of vertical levels

# Call the main function and output the results
points, vertical_elements, horizontal_elements, cross_bracing = main(resolution, perturbation, density_states, height, num_levels)

# Use Grasshopper component output
a = points
b = vertical_elements
c = horizontal_elements
d = cross_bracing
# ---------- end fermisgoldenrule_003 ----------
panel = Panel(fermisgoldenrule_001.out)
panel_2 = Panel(fermisgoldenrule_001.b)
panel_3 = Panel(fermisgoldenrule_001.a)
panel_4 = Panel(fermisgoldenrule_002.out)
panel_5 = Panel(fermisgoldenrule_003.out)
panel_6 = Panel(fermisgoldenrule_002.b)
panel_7 = Panel(fermisgoldenrule_002.a)
point = Point(fermisgoldenrule_003.a)
curve = Curve(fermisgoldenrule_003.b)
curve_2 = Curve(fermisgoldenrule_003.c)
curve_3 = Curve(fermisgoldenrule_003.d)
panel_8 = Panel(fermisgoldenrule_003.b)
panel_9 = Panel(fermisgoldenrule_003.a)
param_viewer = ParamViewer()
param_viewer_2 = ParamViewer()
panel_10 = Panel(fermisgoldenrule_003.d)
panel_11 = Panel(fermisgoldenrule_003.c)
