# Grasshopper definition 007_Orbit_Equation.gh (Grasshopper 1.0.8)
# plug-ins: RhinoCodePluginGH

# 002 Getting Started
# 
# Learning Python in Grasshopper with gpt-4o
# 
# Orbit Equation
# 
# Let's create a Python script for the Grasshopper
#  node editor in Rhino 8 that generates
# interesting geometry inspired by the orbit
# equation. We'll use the equation to create a
# series of parametric curves and points that can
# represent the orbits of celestial bodies. This will
# provide a visually appealing and dynamic model.
number_slider = Slider(4, range=0..10)
orbit_equation_001 = Script(
    num_orbits=Slider(5, range=0..10),
    l=Slider(0.75, range=0..1),
    m=Slider(0.56, range=0..1),
    mu=Slider(6.81, range=0..10),
    e=Slider(0.74, range=0..1),
    resolution=Slider(79, range=0..100),
    spacing=Slider(1.13, range=0..10),
    noise_amplitude=Slider(1.12, range=0..10),
    seed=Slider(20, range=0..100),
    min_radius=Slider(0.42, range=0..1),
    max_radius=Slider(1.24, range=0..10))  # -> out, aOut, bOut; inputs num_orbits: Int32, l: Double, m: Double, mu: Double, e: Double, resolution: Int32, spacing: Double, noise_amplitude: Double, seed: Int32, min_radius: Double, max_radius: Double
# ---------- orbit_equation_001: Python ----------
import rhinoscriptsyntax as rs
import Rhino.Geometry as rg
import math
import random

def generate_orbit_points(l, m, mu, e, resolution, noise_amplitude, seed):
    random.seed(seed)
    points = []
    for i in range(resolution + 1):
        theta = i * 2 * math.pi / resolution
        r = (l ** 2 / (m ** 2 * mu)) * (1 / (1 + e * math.cos(theta)))
        x = r * math.cos(theta)
        y = r * math.sin(theta)
        z = noise_amplitude * (random.random() - 0.5)
        points.append(rg.Point3d(x, y, z))
    return points

def generate_orbit_curves(points):
    curve = rg.Curve.CreateInterpolatedCurve(points, 3)
    return curve

def generate_planets(orbits, min_radius, max_radius, seed):
    random.seed(seed)
    planets = []
    for orbit in orbits:
        t = random.random()
        point = orbit.PointAt(t * orbit.GetLength())
        radius = random.uniform(min_radius, max_radius)
        planet = rg.Sphere(point, radius).ToBrep()
        planets.append(planet)
    return planets

def generate_orbits(num_orbits, l, m, mu, e, resolution, spacing, noise_amplitude, seed):
    orbits = []
    for i in range(num_orbits):
        points = generate_orbit_points(l, m, mu, e, resolution, noise_amplitude, seed)
        orbit_curve = generate_orbit_curves(points)
        translation = rg.Transform.Translation(0, 0, i * spacing)
        orbit_curve.Transform(translation)
        orbits.append(orbit_curve)
        l += spacing
        m += spacing / 10.0
    return orbits

def main(num_orbits, l, m, mu, e, resolution, spacing, noise_amplitude, seed, min_radius, max_radius):
    orbits = generate_orbits(num_orbits, l, m, mu, e, resolution, spacing, noise_amplitude, seed)
    planets = generate_planets(orbits, min_radius, max_radius, seed)
    return orbits, planets

# Input parameters
num_orbits = num_orbits           # Number of orbits
l = l                  # Angular momentum
m = m                  # Mass of the orbiting body
mu = mu                # Constant
e = e                  # Eccentricity of the orbit
resolution = resolution         # Resolution of the curves
spacing = spacing           # Spacing between orbits
noise_amplitude = noise_amplitude   # Amplitude of noise to add to the orbits
seed = seed                # Seed for random number generator
min_radius = min_radius         # Minimum radius of planets
max_radius = max_radius        # Maximum radius of planets

# Call the main function and output the results
orbitsOut, planetsOut = main(num_orbits, l, m, mu, e, resolution, spacing, noise_amplitude, seed, min_radius, max_radius)

# Use Grasshopper component output
aOut = orbitsOut
bOut = planetsOut
# ---------- end orbit_equation_001 ----------
orbit_equation_001_2 = Script(
    num_orbits=number_slider,
    l=Slider(0.9, range=0..1),
    m=Slider(0.73, range=0..1),
    mu=Slider(0.98, range=0..1),
    e=Slider(0.85, range=0..1),
    resolution=Slider(60, range=0..100),
    spacing=Slider(1, range=0..10))  # -> out, aOut; inputs num_orbits: Int32, l: Double, m: Double, mu: Double, e: Double, resolution: Int32, spacing: Double
# ---------- orbit_equation_001_2: Python ----------
import rhinoscriptsyntax as rs
import Rhino.Geometry as rg
import math

def generate_orbit_points(l, m, mu, e, resolution):
    points = []
    for i in range(resolution + 1):
        theta = i * 2 * math.pi / resolution
        r = (l ** 2 / (m ** 2 * mu)) * (1 / (1 + e * math.cos(theta)))
        x = r * math.cos(theta)
        y = r * math.sin(theta)
        points.append(rg.Point3d(x, y, 0))
    return points

def generate_orbit_curves(points):
    curve = rg.Curve.CreateInterpolatedCurve(points, 3)
    return curve

def generate_orbits(num_orbits, l, m, mu, e, resolution, spacing):
    orbits = []
    for i in range(num_orbits):
        points = generate_orbit_points(l, m, mu, e, resolution)
        orbit_curve = generate_orbit_curves(points)
        translation = rg.Transform.Translation(0, 0, i * spacing)
        orbit_curve.Transform(translation)
        orbits.append(orbit_curve)
        l += spacing
        m += spacing / 10.0
    return orbits

def main(num_orbits, l, m, mu, e, resolution, spacing):
    orbits = generate_orbits(num_orbits, l, m, mu, e, resolution, spacing)
    return orbits

# Input parameters
num_orbits = num_orbits           # Number of orbits
l = l                  # Angular momentum
m = m                  # Mass of the orbiting body
mu = mu                 # Constant
e = e                  # Eccentricity of the orbit
resolution = resolution        # Resolution of the curves
spacing = spacing           # Spacing between orbits

# Call the main function and output the results
orbits = main(num_orbits, l, m, mu, e, resolution, spacing)

# Use Grasshopper component output
aOut = orbits
# ---------- end orbit_equation_001_2 ----------
panel = Panel(orbit_equation_001_2.out)
panel_2 = Panel(orbit_equation_001.out)
geometry = Geometry(orbit_equation_001.bOut)
panel_3 = Panel(orbit_equation_001_2.aOut)
panel_4 = Panel(geometry)
loft = Loft(
    Curves=orbit_equation_001.aOut,
    Options={Adjust=False, Closed=False, LoftEnds=0, LoftSimp=0, LoftType=0, Rebuild=10, Refit=0.01})
param_viewer = ParamViewer(orbit_equation_001_2.aOut)
param_viewer_2 = ParamViewer(orbit_equation_001.aOut)
