# Grasshopper definition 009_UncertaintyPrinciple.gh (Grasshopper 1.0.8)
# plug-ins: RhinoCodePluginGH, Kangaroo2 Components

# 002 Getting Started
# 
# Learning Python in Grasshopper with gpt-4o
# 
# Topological Spaces
# 
# To create a Python script for the Grasshopper
# node editor in Rhino 8 that demonstrates
# interesting geometry inspired by the concept of
# topological spaces, we can use the properties
# of open sets and their interactions. We'll generate
# a set of points and curves that represent these
# topological properties visually.
number_slider = Slider(100, range=0..100)
number_slider_2 = Slider(1.89, range=0..10)
topological_spaces_002 = Script(
    num_points=Slider(7, range=0..20),
    radius=Slider(100, range=0..100),
    height=Slider(74.87, range=0..100),
    num_levels=Slider(3, range=0..10),
    seed=Slider(42, range=0..100),
    cable_offset=Slider(6, range=0..10),
    rod_offset=Slider(8, range=0..10))  # -> out, aOut, bOut, cOut; inputs num_points: Int32, radius: Double, height: Double, num_levels: Int32, seed: Int32, cable_offset: Int32, rod_offset: Int32
# ---------- topological_spaces_002: Python ----------
import rhinoscriptsyntax as rs
import Rhino.Geometry as rg
import math
import random

def generate_base_points(num_points, radius, height, seed):
    random.seed(seed)
    points = []
    for i in range(num_points):
        theta = i * 2 * math.pi / num_points
        r = radius * math.cos(theta)
        x = r * math.cos(theta)
        y = r * math.sin(theta)
        z = random.uniform(0, height)
        points.append(rg.Point3d(x, y, z))
    return points

def generate_tensegrity_structure(base_points, height, num_levels, cable_offset, rod_offset):
    cables = []
    rods = []
    num_points = len(base_points)
    
    for i in range(num_points):
        for j in range(num_levels):
            # Generate rods
            start_point = base_points[i] + rg.Point3d(0, 0, j * height / num_levels)
            end_point = base_points[(i + rod_offset) % num_points] + rg.Point3d(0, 0, (j + 1) * height / num_levels)
            rod = rg.LineCurve(start_point, end_point)
            rods.append(rod)
            
            # Generate cables
            start_point = base_points[i] + rg.Point3d(0, 0, j * height / num_levels)
            end_point = base_points[(i + cable_offset) % num_points] + rg.Point3d(0, 0, j * height / num_levels)
            cable = rg.Curve.CreateInterpolatedCurve([start_point, end_point], 1)
            cables.append(cable)
            
            start_point = base_points[i] + rg.Point3d(0, 0, j * height / num_levels)
            end_point = base_points[(i + cable_offset + 1) % num_points] + rg.Point3d(0, 0, (j + 1) * height / num_levels)
            cable = rg.Curve.CreateInterpolatedCurve([start_point, end_point], 1)
            cables.append(cable)
    
    return rods, cables

def main(num_points, radius, height, num_levels, cable_offset, rod_offset, seed):
    base_points = generate_base_points(num_points, radius, height, seed)
    rods, cables = generate_tensegrity_structure(base_points, height, num_levels, cable_offset, rod_offset)
    return base_points, rods, cables

# Input parameters
num_points = num_points           # Number of base points
radius = radius            # Radius of the base circle
height = height            # Height of the structure
num_levels = num_levels          # Number of levels in the structure
cable_offset = cable_offset         # Offset for connecting cables
rod_offset = rod_offset           # Offset for connecting rods
seed = seed                # Seed for random number generator

# Call the main function and output the results
base_pointsOut, rodsOut, cablesOut = main(num_points, radius, height, num_levels, cable_offset, rod_offset, seed)

# Use Grasshopper component output
aOut = base_pointsOut
bOut = rodsOut
cOut = cablesOut
# ---------- end topological_spaces_002 ----------
topological_spaces_001 = Script(
    num_points=number_slider,
    radius=Slider(10.02, range=0..100),
    height=Slider(12.97, range=0..100),
    seed=Slider(62, range=0..100),
    num_sets=Slider(10, range=0..10),
    set_radius=Slider(4.29, range=0..10))  # -> out, aOut, bOut, cOut; inputs num_points: Int32, radius: Double, height: Double, seed: Int32, num_sets: Int32, set_radius: Double
# ---------- topological_spaces_001: Python ----------
import rhinoscriptsyntax as rs
import Rhino.Geometry as rg
import math
import random

def generate_topological_points(num_points, radius, height, seed):
    random.seed(seed)
    points = []
    for _ in range(num_points):
        theta = random.uniform(0, 2 * math.pi)
        r = radius * math.sqrt(random.uniform(0, 1))
        x = r * math.cos(theta)
        y = r * math.sin(theta)
        z = random.uniform(0, height)
        points.append(rg.Point3d(x, y, z))
    return points

def generate_open_sets(points, num_sets, set_radius):
    open_sets = []
    for _ in range(num_sets):
        center_point = random.choice(points)
        set_points = []
        for point in points:
            if center_point.DistanceTo(point) <= set_radius:
                set_points.append(point)
        open_sets.append(set_points)
    return open_sets

def generate_open_set_curves(open_sets):
    curves = []
    for set_points in open_sets:
        if len(set_points) > 2:
            curve = rg.Curve.CreateInterpolatedCurve(set_points, 3)
            curves.append(curve)
    return curves

def generate_topological_space(num_points, radius, height, seed, num_sets, set_radius):
    points = generate_topological_points(num_points, radius, height, seed)
    open_sets = generate_open_sets(points, num_sets, set_radius)
    curves = generate_open_set_curves(open_sets)
    return points, open_sets, curves

# Input parameters
num_points = num_points           # Number of points
radius = radius             # Radius of the area where points are generated
height = height             # Height of the area where points are generated
seed = seed                  # Seed for random number generator
num_sets = num_sets             # Number of open sets
set_radius = set_radius          # Radius of each open set

# Call the main function and output the results
pointsOut, open_setsOut, curvesOut = generate_topological_space(num_points, radius, height, seed, num_sets, set_radius)

# Use Grasshopper component output
aOut = pointsOut
bOut = open_setsOut
cOut = curvesOut
# ---------- end topological_spaces_001 ----------
panel = Panel(topological_spaces_002.out)
panel_2 = Panel(topological_spaces_001.out)
point = Point(topological_spaces_002.aOut)
curve = Curve(topological_spaces_002.bOut)
curve_2 = Curve(topological_spaces_002.cOut)
curve_3 = Curve(topological_spaces_001.cOut)
point_2 = Point(topological_spaces_001.aOut)
multiplication = Multiplication(A=number_slider_2, B="3")
division = Division(A=number_slider_2, B="3")
panel_3 = Panel(curve_3)
param_viewer = ParamViewer(topological_spaces_002.aOut)
param_viewer_2 = ParamViewer(topological_spaces_001.aOut)
unit_z = UnitZ(Factor=Slider(75.41, range=0..100))
circle = Circle(Plane=point, Radius=multiplication)
panel_4 = Panel(curve)
boundary_surfaces = BoundarySurfaces(Edges=circle)
negative = Negative(Value=unit_z)
extrude = Extrude(Base=boundary_surfaces, Direction=negative)
polygon = Polygon(Plane=PlaneXY(0, 0, 0), Radius=Slider(331.42, range=0..1100), Segments=6, FilletRadius=0)  # -> Polygon, Length

multipipe = MultiPipe(Curves=curve, NodeSize=division, EndOffset=1, StrutSize=1, Segment=0, KinkAngle=0.6, CubeFit=0, Caps=0)
boundary_surfaces_2 = BoundarySurfaces(Edges=polygon.Polygon)
pipe = Pipe(Curve=curve_2, Radius=number_slider_2, Caps=0)
geometry = Geometry(extrude)
