# Grasshopper definition 010_Dirac Equation.gh (Grasshopper 1.0.8)
# plug-ins: RhinoCodePluginGH

# 002 Getting Started
# 
# Learning Python in Grasshopper with gpt-4o
# 
# Dirac Equation
# 
# To create a Python script for the Grasshopper
# node editor in Rhino 8 that demonstrates
# interesting geometry inspired by the Dirac
# equation, we can interpret the components of
# the equation in a geometric context. The Dirac
# equation involves complex functions and
# gamma matrices, suggesting a structure with
# complex relationships and wave-like properties.
number_slider = Slider(15, range=0..100)
dirac_equation_001 = Script(
    num_points=number_slider,
    wave_length=Slider(15, range=0..100),
    wave_amplitude=Slider(3.55, range=0..10),
    phase_shift_DEN=Slider(3.56, range=0.001..10),
    num_curves=Slider(13, range=0..100),
    num_surfaces=Slider(9, range=0..100),
    seed=Slider(42, range=0..100))  # -> out, aOut, bOut, cOut; inputs num_points: Int32, wave_length: Double, wave_amplitude: Double, phase_shift_DEN: Double, num_curves: Int32, num_surfaces: Int32, seed: Int32
# ---------- dirac_equation_001: Python ----------
import rhinoscriptsyntax as rs
import Rhino.Geometry as rg
import math
import random
import cmath

def generate_wave_points(num_points, wave_length, wave_amplitude, phase_shift, seed):
    random.seed(seed)
    points = []
    for i in range(num_points):
        theta = i * 2 * math.pi / num_points
        x = wave_length * theta / (2 * math.pi)
        y = wave_amplitude * math.sin(theta + phase_shift)
        z = wave_amplitude * math.cos(theta + phase_shift)
        points.append(rg.Point3d(x, y, z))
    return points

def generate_wave_curves(points, num_curves, wave_amplitude):
    curves = []
    for i in range(num_curves):
        curve_points = []
        for p in points:
            offset = wave_amplitude * (random.random() - 0.5)
            curve_points.append(rg.Point3d(p.X, p.Y + offset, p.Z + offset))
        curve = rg.Curve.CreateInterpolatedCurve(curve_points, 3)
        curves.append(curve)
    return curves

def generate_complex_surfaces(curves, num_surfaces, wave_amplitude):
    surfaces = []
    for i in range(num_surfaces):
        curve1 = random.choice(curves)
        curve2 = random.choice(curves)
        surface = rg.Brep.CreateFromLoft([curve1, curve2], rg.Point3d.Unset, rg.Point3d.Unset, rg.LoftType.Normal, False)
        if surface:
            surfaces.append(surface[0])
    return surfaces

def main(num_points, wave_length, wave_amplitude, phase_shift, num_curves, num_surfaces, seed):
    points = generate_wave_points(num_points, wave_length, wave_amplitude, phase_shift, seed)
    curves = generate_wave_curves(points, num_curves, wave_amplitude)
    surfaces = generate_complex_surfaces(curves, num_surfaces, wave_amplitude)
    return points, curves, surfaces

# Input parameters
num_points = num_points           # Number of points to generate
wave_length = wave_length         # Length of the wave
wave_amplitude = wave_amplitude      # Amplitude of the wave
phase_shift = math.pi / phase_shift_DEN  # Phase shift of the wave
num_curves = num_curves           # Number of curves to generate           # Number of curves to generate
num_surfaces = num_surfaces          # Number of surfaces to generate
seed = seed                 # Seed for random number generator

# Call the main function and output the results
pointsOut, curvesOut, surfacesOut = main(num_points, wave_length, wave_amplitude, phase_shift, num_curves, num_surfaces, seed)

# Use Grasshopper component output
aOut = pointsOut
bOut = curvesOut
cOut = surfacesOut
# ---------- end dirac_equation_001 ----------
dirac_equation_002 = Script(
    num_points=Slider(15, range=0..100),
    wave_length=Slider(15, range=0..100),
    wave_amplitude=Slider(2.17, range=0..10),
    phase_shift_DEN=Slider(3.56, range=0.001..10),
    num_curves=Slider(6, range=0..10),
    num_surfaces=Slider(5, range=0..10),
    seed=Slider(42, range=0..100),
    min_height=Slider(3, range=0..10),
    max_height=Slider(6.97, range=0..10))  # -> out, aOut, bOut, cOut, dOut; inputs num_points: Int32, wave_length: Double, wave_amplitude: Double, phase_shift_DEN: Double, num_curves: Int32, num_surfaces: Int32, seed: Int32, min_height: Double, max_height: Double
# ---------- dirac_equation_002: Python ----------
import rhinoscriptsyntax as rs
import Rhino.Geometry as rg
import math
import random

def generate_wave_points(num_points, wave_length, wave_amplitude, phase_shift, seed):
    random.seed(seed)
    points = []
    for i in range(num_points):
        theta = i * 2 * math.pi / num_points
        x = wave_length * theta / (2 * math.pi)
        y = wave_amplitude * math.sin(theta + phase_shift)
        z = wave_amplitude * math.cos(theta + phase_shift)
        points.append(rg.Point3d(x, y, z))
    return points

def generate_wave_curves(points, num_curves, wave_amplitude):
    curves = []
    for i in range(num_curves):
        curve_points = []
        for p in points:
            offset = wave_amplitude * (random.random() - 0.5)
            curve_points.append(rg.Point3d(p.X, p.Y + offset, p.Z + offset))
        curve = rg.Curve.CreateInterpolatedCurve(curve_points, 3)
        curves.append(curve)
    return curves

def generate_complex_surfaces(curves, num_surfaces):
    surfaces = []
    for i in range(num_surfaces):
        curve1 = random.choice(curves)
        curve2 = random.choice(curves)
        loft = rg.Brep.CreateFromLoft([curve1, curve2], rg.Point3d.Unset, rg.Point3d.Unset, rg.LoftType.Normal, False)
        if loft:
            surfaces.append(loft[0])
    return surfaces

def extrude_surfaces(surfaces, min_height, max_height):
    extrusions = []
    for surface in surfaces:
        normal = surface.Faces[0].NormalAt(0.5, 0.5)
        height = random.uniform(min_height, max_height)
        extrusion_vector = normal * height
        extruded_surface = surface.Faces[0].CreateExtrusion(rg.Line(rg.Point3d(0, 0, 0), extrusion_vector).ToNurbsCurve(), True)
        if extruded_surface:
            extrusions.append(extruded_surface)
    return extrusions

def main(num_points, wave_length, wave_amplitude, phase_shift, num_curves, num_surfaces, seed, min_height, max_height):
    points = generate_wave_points(num_points, wave_length, wave_amplitude, phase_shift, seed)
    curves = generate_wave_curves(points, num_curves, wave_amplitude)
    surfaces = generate_complex_surfaces(curves, num_surfaces)
    extrusions = extrude_surfaces(surfaces, min_height, max_height)
    return points, curves, surfaces, extrusions

# Input parameters
num_points = num_points           # Number of points to generate
wave_length = wave_length         # Length of the wave
wave_amplitude = wave_amplitude      # Amplitude of the wave
phase_shift = math.pi / phase_shift_DEN  # Phase shift of the wave
num_curves = num_curves            # Number of curves to generate
num_surfaces = num_surfaces          # Number of surfaces to generate
seed = seed                  # Seed for random number generator
min_height = min_height           # Minimum height of extrusion
max_height = max_height           # Maximum height of extrusion

# Call the main function and output the results
pointsOut, curvesOut, surfacesOut, extrusionsOut = main(num_points, wave_length, wave_amplitude, phase_shift, num_curves, num_surfaces, seed, min_height, max_height)

# Use Grasshopper component output
aOut = pointsOut
bOut = curvesOut
cOut = surfacesOut
dOut = extrusionsOut
# ---------- end dirac_equation_002 ----------
panel = Panel(dirac_equation_001.out)
panel_2 = Panel(dirac_equation_002.out)
point = Point(dirac_equation_001.aOut)
curve = Curve(dirac_equation_001.bOut)
geometry = Geometry(dirac_equation_001.cOut)
point_2 = Point(dirac_equation_002.aOut)
curve_2 = Curve(dirac_equation_002.bOut)
geometry_2 = Geometry(dirac_equation_002.cOut)
geometry_3 = Geometry(dirac_equation_002.cOut)
geometry_4 = Geometry(dirac_equation_002.dOut)
panel_3 = Panel(curve)
panel_4 = Panel(geometry_4)
param_viewer = ParamViewer(curve)
param_viewer_2 = ParamViewer(curve_2)
