# Grasshopper definition 012_DiscreteFourierTransform.gh (Grasshopper 1.0.8)
# plug-ins: RhinoCodePluginGH

# 002 Getting Started
# 
# Learning Python in Grasshopper with gpt-4o
# 
# DiscreteFourierTransform
# 
# To create a Python script for the Grasshopper
# node editor in Rhino 8 that demonstrates
# interesting geometry inspired by the Discrete
# Fourier Transform (DFT), we can interpret the
# DFT formula in a geometric context. The DFT
# involves summing complex exponentials, which
# suggests using periodic and wave-like patterns.
number_slider = Slider(8, range=0..10)
discretefouriertransform_001 = Script(
    n=number_slider,
    N=Slider(48, range=3..100),
    scale_factor=Slider(2.2, range=0..10),
    num_curves=Slider(5, range=2..12),
    radius=Slider(2.18, range=1..5),
    seed=Slider(70, range=0..100))  # -> out, aOut, bOut, cOut; inputs n: Int32, N: Int32, scale_factor: Double, num_curves: Int32, radius: Double, seed: Int32
# ---------- discretefouriertransform_001: Python ----------
import rhinoscriptsyntax as rs
import Rhino.Geometry as rg
import math
import cmath
import random

def generate_dft_points(n, N, scale_factor):
    points = []
    for k in range(N):
        X_k = sum(cmath.exp(-2j * math.pi * k * n_val / N) for n_val in range(n))
        x_coord = scale_factor * X_k.real
        y_coord = scale_factor * X_k.imag
        z_coord = scale_factor * random.uniform(-0.5, 0.5)
        points.append(rg.Point3d(x_coord, y_coord, z_coord))
    return points

def generate_dft_curves(points, num_curves):
    curves = []
    for i in range(num_curves):
        curve_points = random.sample(points, len(points))
        curve = rg.Curve.CreateInterpolatedCurve(curve_points, 3)
        curves.append(curve)
    return curves

def polar_array_curves(curves, num_curves, radius):
    polar_curves = []
    angle_step = 2 * math.pi / num_curves
    for i in range(num_curves):
        angle = i * angle_step
        rotation = rg.Transform.Rotation(angle, rg.Vector3d.ZAxis, rg.Point3d(0, 0, 0))
        translation = rg.Transform.Translation(rg.Vector3d(radius * math.cos(angle), radius * math.sin(angle), 0))
        for curve in curves:
            curve_copy = curve.DuplicateCurve()
            curve_copy.Transform(rotation)
            curve_copy.Transform(translation)
            polar_curves.append(curve_copy)
    return polar_curves

def loft_curves_to_surfaces(curves, num_curves):
    surfaces = []
    for i in range(num_curves):
        curve1 = curves[i]
        curve2 = curves[(i + 1) % num_curves]
        loft = rg.Brep.CreateFromLoft([curve1, curve2], rg.Point3d.Unset, rg.Point3d.Unset, rg.LoftType.Normal, False)
        if loft:
            surfaces.append(loft[0])
    return surfaces

def main(n, N, scale_factor, num_curves, radius, seed):
    random.seed(seed)
    points = generate_dft_points(n, N, scale_factor)
    base_curves = generate_dft_curves(points, 1)  # Generate one base curve from points
    polar_curves = polar_array_curves(base_curves, num_curves, radius)
    surfaces = loft_curves_to_surfaces(polar_curves, num_curves)
    return points, polar_curves, surfaces

# Input parameters
n = n                    # Number of samples in the time domain
N = N                   # Number of points in the frequency domain
scale_factor = scale_factor      # Scale factor for the points
num_curves = num_curves          # Number of curves to generate
radius = radius            # Radius for polar array
seed = seed                 # Seed for random number generator

# Call the main function and output the results
pointsOut, polarCurvesOut, surfacesOut = main(n, N, scale_factor, num_curves, radius, seed)

# Use Grasshopper component output
aOut = pointsOut
bOut = polarCurvesOut
cOut = surfacesOut
# ---------- end discretefouriertransform_001 ----------
panel = Panel(discretefouriertransform_001.out)
point = Point(discretefouriertransform_001.aOut)
curve = Curve(discretefouriertransform_001.bOut)
geometry = Geometry(discretefouriertransform_001.cOut)
panel_2 = Panel(curve)
param_viewer = ParamViewer(curve)
