# Grasshopper definition 013_DAlembertsFormula.gh (Grasshopper 1.0.8)
# plug-ins: RhinoCodePluginGH

# 002 Getting Started
# 
# Learning Python in Grasshopper with gpt-4o
# 
# D'Alembert's Formula
# 
# To create a Python script for the Grasshopper
# node editor in Rhino 8 that demonstrates
# interesting geometry inspired by D'Alembert's
# Formula, we can interpret the wave equation
# and the solution given by D'Alembert's formula
# in a geometric context. The wave equation
# suggests wave-like patterns, and we can use
# this to generate dynamic geometries.
number_slider = Slider(0, range=0..10)
dalembertsformula_002 = Script(
    minX=Slider(0, range=0..10),
    maxX=Slider(50, range=0..50),
    num_curves=Slider(8, range=2..12),
    minT=Slider(0, range=0..10),
    maxT=Slider(50, range=0..50),
    c=Slider(3.39, range=1..5))  # -> out, aOut, bOut; inputs minX: Int32, maxX: Int32, num_curves: Int32, minT: Int32, maxT: Int32, c: Double
# ---------- dalembertsformula_002: Python ----------
import rhinoscriptsyntax as rs
import Rhino.Geometry as rg
import math
import random

def d_alembert_wave(x, t, c, g, h, f, x_range):
    wave_points = []
    for x_val in x_range:
        u_x_t = 0.5 * (g(x_val + c * t) + g(x_val - c * t)) + \
                (1 / (2 * c)) * sum([f(y) for y in range(int(x_val - c * t), int(x_val + c * t))]) + \
                (1 / (2 * c)) * sum([h(y) for y in range(int(x_val - c * t), int(x_val + c * t))])
        wave_points.append(rg.Point3d(x_val, u_x_t, t))
    return wave_points

def generate_wave_curves(num_curves, x_range, t_range, c, g, h, f):
    curves = []
    for i in range(num_curves):
        t = t_range[i]
        wave_points = d_alembert_wave(0, t, c, g, h, f, x_range)
        curve = rg.Curve.CreateInterpolatedCurve(wave_points, 3)
        curves.append(curve)
    return curves

def loft_curves_to_surfaces(curves):
    surfaces = []
    for i in range(len(curves) - 1):
        curve1 = curves[i]
        curve2 = curves[i + 1]
        loft = rg.Brep.CreateFromLoft([curve1, curve2], rg.Point3d.Unset, rg.Point3d.Unset, rg.LoftType.Normal, False)
        if loft:
            surfaces.append(loft[0])
    return surfaces

def g(x):
    return math.sin(x)

def h(x):
    return math.cos(x)

def f(x):
    return math.sin(x) * math.cos(x)

def main(num_curves, x_range, t_range, c):
    t_step = len(t_range) // num_curves
    t_values = [t_range[i * t_step] for i in range(num_curves)]
    curves = generate_wave_curves(num_curves, x_range, t_values, c, g, h, f)
    surfaces = loft_curves_to_surfaces(curves)
    return curves, surfaces

# Input parameters
num_curves = num_curves            # Number of curves to generate
x_range = range(minX, maxX)     # Range of x values
t_range = range(minT, maxT)     # Range of t values
c = c                    # Wave speed

# Call the main function and output the results
curvesOut, surfacesOut = main(num_curves, x_range, t_range, c)

# Use Grasshopper component output
aOut = curvesOut
bOut = surfacesOut
# ---------- end dalembertsformula_002 ----------
dalembertsformula_003 = Script(
    minX=Slider(0, range=0..10),
    maxX=Slider(50, range=0..50),
    num_curves=Slider(12, range=2..12),
    minT=Slider(0, range=0..10),
    maxT=Slider(50, range=0..50),
    c=Slider(2.18, range=1..5))  # -> out, aOut, bOut; inputs minX: Int32, maxX: Int32, num_curves: Int32, minT: Int32, maxT: Int32, c: Double
# ---------- dalembertsformula_003: Python ----------
import rhinoscriptsyntax as rs
import Rhino.Geometry as rg
import math
import random

def complex_trig_polynomial(x, t, c):
    return math.sin(x + c * t) + 0.5 * math.sin(2 * x - c * t) + 0.25 * math.sin(3 * x + 2 * c * t)

def d_alembert_wave(x, t, c, g, h, f, x_range):
    wave_points = []
    for x_val in x_range:
        u_x_t = 0.5 * (g(x_val + c * t) + g(x_val - c * t)) + \
                (1 / (2 * c)) * sum([f(y) for y in range(int(x_val - c * t), int(x_val + c * t))]) + \
                (1 / (2 * c)) * sum([h(y) for y in range(int(x_val - c * t), int(x_val + c * t))]) + \
                complex_trig_polynomial(x_val, t, c)
        wave_points.append(rg.Point3d(x_val, u_x_t, t))
    return wave_points

def generate_wave_curves(num_curves, x_range, t_values, c, g, h, f):
    curves = []
    for t in t_values:
        wave_points = d_alembert_wave(0, t, c, g, h, f, x_range)
        curve = rg.Curve.CreateInterpolatedCurve(wave_points, 3)
        curves.append(curve)
    return curves

def loft_curves_to_surfaces(curves):
    surfaces = []
    for i in range(len(curves) - 1):
        curve1 = curves[i]
        curve2 = curves[i + 1]
        loft = rg.Brep.CreateFromLoft([curve1, curve2], rg.Point3d.Unset, rg.Point3d.Unset, rg.LoftType.Normal, False)
        if loft:
            surfaces.append(loft[0])
    return surfaces

def g(x):
    return math.sin(x) + 0.5 * math.cos(2 * x)

def h(x):
    return math.cos(x) - 0.5 * math.sin(2 * x)

def f(x):
    return math.sin(x) * math.cos(x) + 0.5 * math.sin(2 * x) * math.cos(2 * x)

def main(num_curves, x_range, t_range, c):
    t_step = len(t_range) // num_curves
    t_values = [t_range[i * t_step] for i in range(num_curves)]
    curves = generate_wave_curves(num_curves, x_range, t_values, c, g, h, f)
    surfaces = loft_curves_to_surfaces(curves)
    return curves, surfaces

# Input parameters
num_curves = num_curves            # Number of curves to generate
x_range = range(minX, maxX)     # Range of x values
t_range = range(minT, maxT)     # Range of t values
c = c                    # Wave speed

# Call the main function and output the results
curvesOut, surfacesOut = main(num_curves, x_range, t_range, c)

# Use Grasshopper component output
aOut = curvesOut
bOut = surfacesOut
# ---------- end dalembertsformula_003 ----------
dalembertsformula_001 = Script(
    minX=number_slider,
    maxX=Slider(31, range=0..50),
    num_curves=Slider(8, range=2..12),
    minT=Slider(0, range=0..10),
    maxT=Slider(10, range=0..10),
    c=Slider(4.24, range=1..5))  # -> out, aOut, bOut; inputs minX: Int32, maxX: Int32, num_curves: Int32, minT: Int32, maxT: Int32, c: Double
# ---------- dalembertsformula_001: Python ----------
import rhinoscriptsyntax as rs
import Rhino.Geometry as rg
import math
import random

def d_alembert_wave(x, t, c, g, h, f, x_range):
    wave_points = []
    for x_val in x_range:
        u_x_t = 0.5 * (g(x_val + c * t) + g(x_val - c * t)) + \
                (1 / (2 * c)) * sum([f(y) for y in range(int(x_val - c * t), int(x_val + c * t))]) + \
                (1 / (2 * c)) * sum([h(y) for y in range(int(x_val - c * t), int(x_val + c * t))])
        wave_points.append(rg.Point3d(x_val, u_x_t, t))
    return wave_points

def generate_wave_curves(num_curves, x_range, t_range, c, g, h, f):
    curves = []
    for t in t_range:
        wave_points = d_alembert_wave(0, t, c, g, h, f, x_range)
        curve = rg.Curve.CreateInterpolatedCurve(wave_points, 3)
        curves.append(curve)
    return curves

def loft_curves_to_surfaces(curves):
    surfaces = []
    for i in range(len(curves) - 1):
        curve1 = curves[i]
        curve2 = curves[i + 1]
        loft = rg.Brep.CreateFromLoft([curve1, curve2], rg.Point3d.Unset, rg.Point3d.Unset, rg.LoftType.Normal, False)
        if loft:
            surfaces.append(loft[0])
    return surfaces

def g(x):
    return math.sin(x)

def h(x):
    return math.cos(x)

def f(x):
    return math.sin(x) * math.cos(x)

def main(num_curves, x_range, t_range, c):
    curves = generate_wave_curves(num_curves, x_range, t_range, c, g, h, f)
    surfaces = loft_curves_to_surfaces(curves)
    return curves, surfaces

# Input parameters
num_curves = num_curves            # Number of curves to generate
x_range = range(minX, maxX)     # Range of x values
t_range = range(minT, maxT)     # Range of t values
c = c                    # Wave speed

# Call the main function and output the results
curvesOut, surfacesOut = main(num_curves, x_range, t_range, c)

# Use Grasshopper component output
aOut = curvesOut
bOut = surfacesOut
# ---------- end dalembertsformula_001 ----------
panel = Panel(dalembertsformula_002.out)
panel_2 = Panel(dalembertsformula_003.out)
panel_3 = Panel(dalembertsformula_001.out)
geometry = Geometry(dalembertsformula_002.bOut)
curve = Curve(dalembertsformula_002.aOut)
geometry_2 = Geometry(dalembertsformula_003.bOut)
curve_2 = Curve(dalembertsformula_003.aOut)
geometry_3 = Geometry(dalembertsformula_001.bOut)
curve_3 = Curve(dalembertsformula_001.aOut)
panel_4 = Panel(geometry)
panel_5 = Panel(geometry_2)
param_viewer = ParamViewer(curve)
param_viewer_2 = ParamViewer(curve_2)
panel_6 = Panel(geometry_3)
param_viewer_3 = ParamViewer(curve_3)
