# Grasshopper definition 014_Wirtingers_Inequality.gh (Grasshopper 1.0.8)
# plug-ins: RhinoCodePluginGH

trigger = Trigger(Interval=20, TimerInterval=20, Target=data_recorder)  # disabled
data_recorder = DataRecorder("1", DataLimit=10000000, RecordData=False)
list_length = ListLength(List=data_recorder)
division = Division(A=list_length, B=Slider(83, range=0..1000))
cosine = Cosine(Value=division)
sine = Sine(Value=division)
absolute = Absolute(Value=sine)
absolute_2 = Absolute(Value=cosine)
panel = Panel([absolute, absolute_2])
multiplication = Multiplication(A=Slider(10, range=0..10), B=absolute)
multiplication_2 = Multiplication(A=Slider(10, range=0..10), B=absolute_2)
vector_xyz = VectorXYZ(XComponent=multiplication_2, YComponent=multiplication, ZComponent=Slider(10, range=0..10))  # -> Vector, Length
# 002 Getting Started
# 
# Learning Python in Grasshopper with gpt-4o
# 
# Wirtingers_Inequality
# 
# To create a Python script for the Grasshopper
# node editor in Rhino 8 that demonstrates
# interesting geometry inspired by Wirtinger's
# Inequality, we can use the concept of periodic
# functions and their integrals to generate
# dynamic and visually appealing geometries.
number_slider = Slider(0, range=0..10)
wirtingers_inequality_001 = Script(a=number_slider, bFactor=Slider(6, range=0..6), num_points=Slider(31, range=0..100), num_curves=Slider(4, range=2..12))  # -> out, aOut, bOut, cOut; inputs a: Int32, bFactor: Int32, num_points: Int32, num_curves: Int32
# ---------- wirtingers_inequality_001: Python ----------
import rhinoscriptsyntax as rs
import Rhino.Geometry as rg
import math
import random

def periodic_function(t, a, b):
    return math.sin(t) + 0.5 * math.sin(2 * t) + 0.25 * math.sin(3 * t)

def generate_points(periodic_func, a, b, num_points):
    points = []
    step = (b - a) / num_points
    for i in range(num_points + 1):
        t = a + i * step
        y = periodic_func(t, a, b)
        z = periodic_func(t + math.pi / 2, a, b)  # Phase shifted version for z-coordinate
        points.append(rg.Point3d(t, y, z))
    return points

def generate_curves(points, num_curves):
    curves = []
    for i in range(num_curves):
        curve_points = points[i::num_curves]  # Distribute points among curves
        if len(curve_points) > 1:
            curve = rg.Curve.CreateInterpolatedCurve(curve_points, 3)
            curves.append(curve)
    return curves

def loft_curves_to_surfaces(curves):
    surfaces = []
    for i in range(len(curves) - 1):
        curve1 = curves[i]
        curve2 = curves[i + 1]
        loft = rg.Brep.CreateFromLoft([curve1, curve2], rg.Point3d.Unset, rg.Point3d.Unset, rg.LoftType.Normal, False)
        if loft:
            surfaces.append(loft[0])
    return surfaces

def main(a, b, num_points, num_curves):
    points = generate_points(periodic_function, a, b, num_points)
    curves = generate_curves(points, num_curves)
    surfaces = loft_curves_to_surfaces(curves)
    return points, curves, surfaces

# Input parameters
a = a                     # Start of the interval
b = bFactor * math.pi           # End of the interval
num_points = num_points          # Number of points to generate
num_curves = num_curves           # Number of curves to generate
           # Number of curves to generate

# Call the main function and output the results
pointsOut, curvesOut, surfacesOut = main(a, b, num_points, num_curves)

# Use Grasshopper component output
aOut = pointsOut
bOut = curvesOut
cOut = surfacesOut
# ---------- end wirtingers_inequality_001 ----------
wirtingers_inequality_002 = Script(
    a=Slider(3, range=0..10),
    bFactor=Slider(4.68, range=0..6),
    num_points=Slider(13, range=0..100),
    num_curves=Slider(4, range=2..12),
    move_vector=vector_xyz.Vector,
    num_move_arrays=Slider(2, range=0..10),
    num_polar_arrays=Slider(15, range=0..15),
    radius=Slider(0, range=0..100))  # -> out, aOut, bOut, cOut; inputs a: Int32, bFactor: Int32, num_points: Int32, num_curves: Int32, move_vector: Vector3d, num_move_arrays: Int32, num_polar_arrays: Int32, radius: Double
# ---------- wirtingers_inequality_002: Python ----------
import rhinoscriptsyntax as rs
import Rhino.Geometry as rg
import math
import random

def periodic_function(t, a, b):
    return math.sin(t) + 0.5 * math.sin(2 * t) + 0.25 * math.sin(3 * t)

def generate_points(periodic_func, a, b, num_points):
    points = []
    step = (b - a) / num_points
    for i in range(num_points + 1):
        t = a + i * step
        y = periodic_func(t, a, b)
        z = periodic_func(t + math.pi / 2, a, b)  # Phase shifted version for z-coordinate
        points.append(rg.Point3d(t, y, z))
    return points

def generate_curves(points, num_curves):
    curves = []
    for i in range(num_curves):
        curve_points = points[i::num_curves]  # Distribute points among curves
        if len(curve_points) > 1:
            curve = rg.Curve.CreateInterpolatedCurve(curve_points, 3)
            curves.append(curve)
    return curves

def loft_curves_to_surfaces(curves):
    surfaces = []
    for i in range(len(curves) - 1):
        curve1 = curves[i]
        curve2 = curves[i + 1]
        loft = rg.Brep.CreateFromLoft([curve1, curve2], rg.Point3d.Unset, rg.Point3d.Unset, rg.LoftType.Normal, False)
        if loft:
            surfaces.append(loft[0])
    return surfaces

def move_and_array_surfaces(surfaces, move_vector, num_arrays):
    moved_surfaces = []
    for i in range(num_arrays):
        translation = rg.Transform.Translation(move_vector * i)
        for surface in surfaces:
            surface_copy = surface.Duplicate()
            surface_copy.Transform(translation)
            moved_surfaces.append(surface_copy)
    return moved_surfaces

def polar_array_surfaces(surfaces, num_arrays, radius):
    polar_surfaces = []
    angle_step = 2 * math.pi / num_arrays
    for i in range(num_arrays):
        angle = i * angle_step
        rotation = rg.Transform.Rotation(angle, rg.Vector3d.ZAxis, rg.Point3d(0, 0, 0))
        translation = rg.Transform.Translation(rg.Vector3d(radius * math.cos(angle), radius * math.sin(angle), 0))
        for surface in surfaces:
            surface_copy = surface.Duplicate()
            surface_copy.Transform(rotation)
            surface_copy.Transform(translation)
            polar_surfaces.append(surface_copy)
    return polar_surfaces

def main(a, b, num_points, num_curves, move_vector, num_move_arrays, num_polar_arrays, radius):
    points = generate_points(periodic_function, a, b, num_points)
    curves = generate_curves(points, num_curves)
    surfaces = loft_curves_to_surfaces(curves)
    moved_surfaces = move_and_array_surfaces(surfaces, move_vector, num_move_arrays)
    polar_surfaces = polar_array_surfaces(moved_surfaces, num_polar_arrays, radius)
    return points, curves, polar_surfaces

# Input parameters
a = a                     # Start of the interval
b = bFactor * math.pi           # End of the interval
num_points = num_points          # Number of points to generate
num_curves = num_curves           # Number of curves to generate

move_vector = move_vector  # Vector to move surfaces along
num_move_arrays = num_move_arrays       # Number of arrays created by moving surfaces
num_polar_arrays = num_polar_arrays    # Number of polar arrays
radius = radius            # Radius for polar array

# Call the main function and output the results
pointsOut, curvesOut, surfacesOut = main(a, b, num_points, num_curves, move_vector, num_move_arrays, num_polar_arrays, radius)

# Use Grasshopper component output
aOut = pointsOut
bOut = curvesOut
cOut = surfacesOut
# ---------- end wirtingers_inequality_002 ----------
panel_2 = Panel(wirtingers_inequality_001.out)
panel_3 = Panel(wirtingers_inequality_002.out)
geometry = Geometry(wirtingers_inequality_001.cOut)
curve = Curve(wirtingers_inequality_001.bOut)
point = Point(wirtingers_inequality_001.aOut)
geometry_2 = Geometry(wirtingers_inequality_002.cOut)
curve_2 = Curve(wirtingers_inequality_002.bOut)
point_2 = Point(wirtingers_inequality_002.aOut)
panel_4 = Panel(geometry_2)
param_viewer = ParamViewer(curve_2)
panel_5 = Panel(geometry)
param_viewer_2 = ParamViewer(curve)
