# Grasshopper definition 015_Platonic_Solids.gh (Grasshopper 1.0.8)
# plug-ins: RhinoCodePluginGH

trigger = Trigger(Interval=20, TimerInterval=20, Target=data_recorder)
data_recorder = DataRecorder("1", DataLimit=10000000, RecordData=True)
list_length = ListLength(List=data_recorder)
division = Division(A=list_length, B=Slider(110, range=0..1000))
cosine = Cosine(Value=division)
sine = Sine(Value=division)
absolute = Absolute(Value=cosine)
absolute_2 = Absolute(Value=sine)
panel = Panel([absolute_2, absolute])
number_slider = Slider(10, range=0..10)
multiplication = Multiplication(A=Slider(10, range=0..10), B=sine)
number_slider_2 = Slider(10, range=0..10)  # disabled
number_slider_3 = Slider(-62, range=-90..90)  # disabled
number_slider_4 = Slider(-90, range=-90..90)  # disabled
number_slider_5 = Slider(10, range=0..10)  # disabled
number_slider_6 = Slider(10, range=0..10)  # disabled
number_slider_7 = Slider(-90, range=-90..90)  # disabled
number_slider_8 = Slider(10, range=0..10)  # disabled
number_slider_9 = Slider(90, range=-90..90)  # disabled
number_slider_10 = Slider(10, range=0..10)  # disabled
# 002 Getting Started
# 
# Learning Python in Grasshopper with gpt-4o
# 
# Platonic_Solids
# 
# To create a Python script for the Grasshopper
# node editor in Rhino 8 that demonstrates
# interesting geometry inspired by Platonic solids
# and incorporates origami patterns, we will
# generate the Platonic solids and then apply
# some transformations to create origami-like
# folds.
platonic_solids_001 = Script()  # -> out, aOut, bOut; disabled
# ---------- platonic_solids_001: Python ----------
import Rhino.Geometry as rg

def create_cube(center_point, edge_length):
    half = edge_length / 2.0
    
    # Define the 8 vertices of the cube
    vertices = [
        rg.Point3d(center_point.X - half, center_point.Y - half, center_point.Z - half),
        rg.Point3d(center_point.X + half, center_point.Y - half, center_point.Z - half),
        rg.Point3d(center_point.X + half, center_point.Y + half, center_point.Z - half),
        rg.Point3d(center_point.X - half, center_point.Y + half, center_point.Z - half),
        rg.Point3d(center_point.X - half, center_point.Y - half, center_point.Z + half),
        rg.Point3d(center_point.X + half, center_point.Y - half, center_point.Z + half),
        rg.Point3d(center_point.X + half, center_point.Y + half, center_point.Z + half),
        rg.Point3d(center_point.X - half, center_point.Y + half, center_point.Z + half)
    ]
    
    # Define the 12 edges of the cube
    edges = [
        (vertices[0], vertices[1]), (vertices[1], vertices[2]), (vertices[2], vertices[3]), (vertices[3], vertices[0]),
        (vertices[4], vertices[5]), (vertices[5], vertices[6]), (vertices[6], vertices[7]), (vertices[7], vertices[4]),
        (vertices[0], vertices[4]), (vertices[1], vertices[5]), (vertices[2], vertices[6]), (vertices[3], vertices[7])
    ]
    
    lines = []
    for edge in edges:
        lines.append(rg.LineCurve(edge[0], edge[1]))
    
    # Define the 6 faces of the cube
    faces = [
        [vertices[0], vertices[1], vertices[2], vertices[3]],
        [vertices[4], vertices[5], vertices[6], vertices[7]],
        [vertices[0], vertices[1], vertices[5], vertices[4]],
        [vertices[2], vertices[3], vertices[7], vertices[6]],
        [vertices[1], vertices[2], vertices[6], vertices[5]],
        [vertices[3], vertices[0], vertices[4], vertices[7]]
    ]
    
    surfaces = []
    for face in faces:
        surfaces.append(rg.Brep.CreateFromCornerPoints(face[0], face[1], face[2], face[3], 0.01))
    
    return lines, surfaces

# Inputs
center_point = rg.Point3d(0, 0, 0)  # Modify this as needed
edge_length = 10.0  # Modify this as needed

# Create the cube
cube_edges, cube_surfaces = create_cube(center_point, edge_length)

# Output the geometries
aOut = cube_edges
bOut = cube_surfaces

# If you have more geometries, you can output them as cOut, dOut, etc.
# ---------- end platonic_solids_001 ----------
multiplication_2 = Multiplication(A=number_slider_9, B=cosine)  # disabled
panel_2 = Panel(platonic_solids_001.out)  # disabled
geometry = Geometry(platonic_solids_001.bOut)  # disabled
geometry_2 = Geometry(platonic_solids_001.aOut)  # disabled
platonic_solids_004 = Script(edge_length=number_slider_5, fold_angle=number_slider_3)  # -> out, aOut, bOut; inputs edge_length: Double, fold_angle: Double; disabled
# ---------- platonic_solids_004: Python ----------
import Rhino.Geometry as rg
import math

def create_cube(center_point, edge_length):
    half = edge_length / 2.0
    
    # Define the 8 vertices of the cube
    vertices = [
        rg.Point3d(center_point.X - half, center_point.Y - half, center_point.Z - half),
        rg.Point3d(center_point.X + half, center_point.Y - half, center_point.Z - half),
        rg.Point3d(center_point.X + half, center_point.Y + half, center_point.Z - half),
        rg.Point3d(center_point.X - half, center_point.Y + half, center_point.Z - half),
        rg.Point3d(center_point.X - half, center_point.Y - half, center_point.Z + half),
        rg.Point3d(center_point.X + half, center_point.Y - half, center_point.Z + half),
        rg.Point3d(center_point.X + half, center_point.Y + half, center_point.Z + half),
        rg.Point3d(center_point.X - half, center_point.Y + half, center_point.Z + half)
    ]
    
    # Define the 12 edges of the cube
    edges = [
        (vertices[0], vertices[1]), (vertices[1], vertices[2]), (vertices[2], vertices[3]), (vertices[3], vertices[0]),
        (vertices[4], vertices[5]), (vertices[5], vertices[6]), (vertices[6], vertices[7]), (vertices[7], vertices[4]),
        (vertices[0], vertices[4]), (vertices[1], vertices[5]), (vertices[2], vertices[6]), (vertices[3], vertices[7])
    ]
    
    lines = []
    for edge in edges:
        lines.append(rg.LineCurve(edge[0], edge[1]))
    
    # Define the 6 faces of the cube
    faces = [
        [vertices[0], vertices[1], vertices[2], vertices[3]],  # bottom face
        [vertices[4], vertices[5], vertices[6], vertices[7]],  # top face
        [vertices[0], vertices[1], vertices[5], vertices[4]],  # side face 1
        [vertices[1], vertices[2], vertices[6], vertices[5]],  # side face 2
        [vertices[2], vertices[3], vertices[7], vertices[6]],  # side face 3
        [vertices[3], vertices[0], vertices[4], vertices[7]]   # side face 4
    ]
    
    surfaces = []
    for face in faces:
        surfaces.append(rg.Brep.CreateFromCornerPoints(face[0], face[1], face[2], face[3], 0.01))
    
    return lines, surfaces, vertices, faces

def fold_face(face_vertices, axis_start, axis_end, angle_degrees):
    # Define the fold axis (the edge of the face to be folded)
    fold_axis = rg.Line(axis_start, axis_end)
    
    # Convert angle to radians
    angle_radians = math.radians(angle_degrees)
    
    # Create a rotation transform
    rotation = rg.Transform.Rotation(angle_radians, fold_axis.Direction, fold_axis.PointAt(0.5))
    
    # Apply rotation to the face vertices
    folded_vertices = [vertex.Clone() for vertex in face_vertices]
    for i in range(4):
        folded_vertices[i].Transform(rotation)
    
    return folded_vertices

# Inputs
center_point = rg.Point3d(0, 0, 0)  # Modify this as needed
edge_length = edge_length  # Modify this as needed
fold_angle = fold_angle  # Fold angle in degrees, parametric input
  # Fold angle in degrees, parametric input

# Create the cube
cube_edges, cube_surfaces, cube_vertices, cube_faces = create_cube(center_point, edge_length)

# Step 1: Unfold the top and bottom faces
top_face_vertices = fold_face(cube_faces[1], cube_faces[0][0], cube_faces[0][1], -fold_angle)
bottom_face_vertices = fold_face(cube_faces[0], cube_faces[0][0], cube_faces[0][1], fold_angle)

top_face = rg.Brep.CreateFromCornerPoints(top_face_vertices[0], top_face_vertices[1], top_face_vertices[2], top_face_vertices[3], 0.01)
bottom_face = rg.Brep.CreateFromCornerPoints(bottom_face_vertices[0], bottom_face_vertices[1], bottom_face_vertices[2], bottom_face_vertices[3], 0.01)

# Step 2: Unfold the side faces
side_faces = []
for i in range(2, 6):
    angle = fold_angle if i % 2 == 0 else -fold_angle
    side_face_vertices = fold_face(cube_faces[i], cube_faces[i][0], cube_faces[i][1], angle)
    side_face = rg.Brep.CreateFromCornerPoints(side_face_vertices[0], side_face_vertices[1], side_face_vertices[2], side_face_vertices[3], 0.01)
    side_faces.append(side_face)

# Output the geometries
aOut = cube_edges
bOut = cube_surfaces + [top_face, bottom_face] + side_faces

# If you have more geometries, you can output them as cOut, dOut, etc.
# ---------- end platonic_solids_004 ----------
platonic_solids_003 = Script(edge_length=number_slider_6, fold_angle=number_slider_4)  # -> out, aOut, bOut; inputs edge_length: Double, fold_angle: Double; disabled
# ---------- platonic_solids_003: Python ----------
import Rhino.Geometry as rg
import math

def create_cube(center_point, edge_length):
    half = edge_length / 2.0
    
    # Define the 8 vertices of the cube
    vertices = [
        rg.Point3d(center_point.X - half, center_point.Y - half, center_point.Z - half),
        rg.Point3d(center_point.X + half, center_point.Y - half, center_point.Z - half),
        rg.Point3d(center_point.X + half, center_point.Y + half, center_point.Z - half),
        rg.Point3d(center_point.X - half, center_point.Y + half, center_point.Z - half),
        rg.Point3d(center_point.X - half, center_point.Y - half, center_point.Z + half),
        rg.Point3d(center_point.X + half, center_point.Y - half, center_point.Z + half),
        rg.Point3d(center_point.X + half, center_point.Y + half, center_point.Z + half),
        rg.Point3d(center_point.X - half, center_point.Y + half, center_point.Z + half)
    ]
    
    # Define the 12 edges of the cube
    edges = [
        (vertices[0], vertices[1]), (vertices[1], vertices[2]), (vertices[2], vertices[3]), (vertices[3], vertices[0]),
        (vertices[4], vertices[5]), (vertices[5], vertices[6]), (vertices[6], vertices[7]), (vertices[7], vertices[4]),
        (vertices[0], vertices[4]), (vertices[1], vertices[5]), (vertices[2], vertices[6]), (vertices[3], vertices[7])
    ]
    
    lines = []
    for edge in edges:
        lines.append(rg.LineCurve(edge[0], edge[1]))
    
    # Define the 6 faces of the cube
    faces = [
        [vertices[0], vertices[1], vertices[2], vertices[3]],  # bottom face
        [vertices[4], vertices[5], vertices[6], vertices[7]],  # top face
        [vertices[0], vertices[1], vertices[5], vertices[4]],  # side face 1
        [vertices[1], vertices[2], vertices[6], vertices[5]],  # side face 2
        [vertices[2], vertices[3], vertices[7], vertices[6]],  # side face 3
        [vertices[3], vertices[0], vertices[4], vertices[7]]   # side face 4
    ]
    
    surfaces = []
    for face in faces:
        surfaces.append(rg.Brep.CreateFromCornerPoints(face[0], face[1], face[2], face[3], 0.01))
    
    return lines, surfaces, vertices, faces

def fold_face(face_vertices, axis_start, axis_end, angle_degrees):
    # Define the fold axis (the edge of the face to be folded)
    fold_axis = rg.Line(axis_start, axis_end)
    
    # Convert angle to radians
    angle_radians = math.radians(angle_degrees)
    
    # Create a rotation transform
    rotation = rg.Transform.Rotation(angle_radians, fold_axis.Direction, fold_axis.PointAt(0.5))
    
    # Apply rotation to the face vertices
    folded_vertices = [vertex.Clone() for vertex in face_vertices]
    for i in range(4):
        folded_vertices[i].Transform(rotation)
    
    return folded_vertices

# Inputs
center_point = rg.Point3d(0, 0, 0)  # Modify this as needed
edge_length = edge_length  # Modify this as needed
fold_angle = fold_angle  # Fold angle in degrees

# Create the cube
cube_edges, cube_surfaces, cube_vertices, cube_faces = create_cube(center_point, edge_length)

# Define fold angles for unfolding the cube
angles = [fold_angle, -fold_angle, fold_angle, -fold_angle, fold_angle]

# Fold each face of the cube to lay it flat
folded_faces = []
for i in range(5):
    folded_face_vertices = fold_face(cube_faces[i + 1], cube_faces[0][i % 2], cube_faces[0][(i % 2) + 1], angles[i])
    folded_face = rg.Brep.CreateFromCornerPoints(folded_face_vertices[0], folded_face_vertices[1], folded_face_vertices[2], folded_face_vertices[3], 0.01)
    folded_faces.append(folded_face)

# Output the geometries
aOut = cube_edges
bOut = cube_surfaces + folded_faces

# If you have more geometries, you can output them as cOut, dOut, etc.
# ---------- end platonic_solids_003 ----------
platonic_solids_002 = Script(edge_length=number_slider_8, fold_angle=number_slider_7)  # -> out, aOut, bOut; inputs edge_length: Double, fold_angle: Double; disabled
# ---------- platonic_solids_002: Python ----------
import Rhino.Geometry as rg
import math

def create_cube(center_point, edge_length):
    half = edge_length / 2.0
    
    # Define the 8 vertices of the cube
    vertices = [
        rg.Point3d(center_point.X - half, center_point.Y - half, center_point.Z - half),
        rg.Point3d(center_point.X + half, center_point.Y - half, center_point.Z - half),
        rg.Point3d(center_point.X + half, center_point.Y + half, center_point.Z - half),
        rg.Point3d(center_point.X - half, center_point.Y + half, center_point.Z - half),
        rg.Point3d(center_point.X - half, center_point.Y - half, center_point.Z + half),
        rg.Point3d(center_point.X + half, center_point.Y - half, center_point.Z + half),
        rg.Point3d(center_point.X + half, center_point.Y + half, center_point.Z + half),
        rg.Point3d(center_point.X - half, center_point.Y + half, center_point.Z + half)
    ]
    
    # Define the 12 edges of the cube
    edges = [
        (vertices[0], vertices[1]), (vertices[1], vertices[2]), (vertices[2], vertices[3]), (vertices[3], vertices[0]),
        (vertices[4], vertices[5]), (vertices[5], vertices[6]), (vertices[6], vertices[7]), (vertices[7], vertices[4]),
        (vertices[0], vertices[4]), (vertices[1], vertices[5]), (vertices[2], vertices[6]), (vertices[3], vertices[7])
    ]
    
    lines = []
    for edge in edges:
        lines.append(rg.LineCurve(edge[0], edge[1]))
    
    # Define the 6 faces of the cube
    faces = [
        [vertices[0], vertices[1], vertices[2], vertices[3]],
        [vertices[4], vertices[5], vertices[6], vertices[7]],
        [vertices[0], vertices[1], vertices[5], vertices[4]],
        [vertices[2], vertices[3], vertices[7], vertices[6]],
        [vertices[1], vertices[2], vertices[6], vertices[5]],
        [vertices[3], vertices[0], vertices[4], vertices[7]]
    ]
    
    surfaces = []
    for face in faces:
        surfaces.append(rg.Brep.CreateFromCornerPoints(face[0], face[1], face[2], face[3], 0.01))
    
    return lines, surfaces, vertices

def fold_face(vertices, edge_length, angle_degrees):
    # Define the fold axis (the edge of the face to be folded)
    fold_axis = rg.Line(vertices[0], vertices[1])
    
    # Convert angle to radians
    angle_radians = math.radians(angle_degrees)
    
    # Create a rotation transform
    rotation = rg.Transform.Rotation(angle_radians, fold_axis.Direction, fold_axis.PointAt(0.5))
    
    # Apply rotation to the face vertices
    folded_vertices = [vertex.Clone() for vertex in vertices]
    for i in range(2, 4):
        folded_vertices[i].Transform(rotation)
    
    return folded_vertices

# Inputs
center_point = rg.Point3d(0, 0, 0)  # Modify this as needed
edge_length = edge_length  # Modify this as needed
fold_angle = fold_angle  # Fold angle in degrees, modify this as needed
  # Fold angle in degrees, modify this as needed

# Create the cube
cube_edges, cube_surfaces, cube_vertices = create_cube(center_point, edge_length)

# Fold one face of the cube
folded_face_vertices = fold_face(cube_vertices[:4], edge_length, fold_angle)

# Create surfaces for the folded face
folded_face = rg.Brep.CreateFromCornerPoints(folded_face_vertices[0], folded_face_vertices[1], folded_face_vertices[2], folded_face_vertices[3], 0.01)

# Output the geometries
aOut = cube_edges
bOut = cube_surfaces + [folded_face]

# If you have more geometries, you can output them as cOut, dOut, etc.
# ---------- end platonic_solids_002 ----------
platonic_solids_005 = Script(edge_length=number_slider_10, fold_angle=multiplication_2)  # -> out, aOut, bOut; inputs edge_length: Double, fold_angle: Double; disabled
# ---------- platonic_solids_005: Python ----------
import Rhino.Geometry as rg
import math

def create_cube(center_point, edge_length):
    half = edge_length / 2.0
    
    # Define the 8 vertices of the cube
    vertices = [
        rg.Point3d(center_point.X - half, center_point.Y - half, center_point.Z - half),
        rg.Point3d(center_point.X + half, center_point.Y - half, center_point.Z - half),
        rg.Point3d(center_point.X + half, center_point.Y + half, center_point.Z - half),
        rg.Point3d(center_point.X - half, center_point.Y + half, center_point.Z - half),
        rg.Point3d(center_point.X - half, center_point.Y - half, center_point.Z + half),
        rg.Point3d(center_point.X + half, center_point.Y - half, center_point.Z + half),
        rg.Point3d(center_point.X + half, center_point.Y + half, center_point.Z + half),
        rg.Point3d(center_point.X - half, center_point.Y + half, center_point.Z + half)
    ]
    
    # Define the 12 edges of the cube
    edges = [
        (vertices[0], vertices[1]), (vertices[1], vertices[2]), (vertices[2], vertices[3]), (vertices[3], vertices[0]),
        (vertices[4], vertices[5]), (vertices[5], vertices[6]), (vertices[6], vertices[7]), (vertices[7], vertices[4]),
        (vertices[0], vertices[4]), (vertices[1], vertices[5]), (vertices[2], vertices[6]), (vertices[3], vertices[7])
    ]
    
    lines = []
    for edge in edges:
        lines.append(rg.LineCurve(edge[0], edge[1]))
    
    # Define the 6 faces of the cube
    faces = [
        [vertices[0], vertices[1], vertices[2], vertices[3]],  # bottom face
        [vertices[4], vertices[5], vertices[6], vertices[7]],  # top face
        [vertices[0], vertices[1], vertices[5], vertices[4]],  # side face 1
        [vertices[1], vertices[2], vertices[6], vertices[5]],  # side face 2
        [vertices[2], vertices[3], vertices[7], vertices[6]],  # side face 3
        [vertices[3], vertices[0], vertices[4], vertices[7]]   # side face 4
    ]
    
    surfaces = []
    for face in faces:
        surfaces.append(rg.Brep.CreateFromCornerPoints(face[0], face[1], face[2], face[3], 0.01))
    
    return lines, surfaces, vertices, faces

def fold_face(face_vertices, axis_start, axis_end, angle_degrees):
    # Define the fold axis (the edge of the face to be folded)
    fold_axis = rg.Line(axis_start, axis_end)
    
    # Convert angle to radians
    angle_radians = math.radians(angle_degrees)
    
    # Create a rotation transform
    rotation = rg.Transform.Rotation(angle_radians, fold_axis.Direction, fold_axis.PointAt(0.5))
    
    # Apply rotation to the face vertices
    folded_vertices = [vertex.Clone() for vertex in face_vertices]
    for i in range(4):
        folded_vertices[i].Transform(rotation)
    
    return folded_vertices

# Inputs
center_point = rg.Point3d(0, 0, 0)  # Modify this as needed
edge_length = edge_length  # Modify this as needed
fold_angle = fold_angle  # Fold angle in degrees, parametric input

# Create the cube
cube_edges, cube_surfaces, cube_vertices, cube_faces = create_cube(center_point, edge_length)

# Unfold the bottom face down
bottom_face_vertices = fold_face(cube_faces[0], cube_faces[0][0], cube_faces[0][1], -fold_angle)
bottom_face = rg.Brep.CreateFromCornerPoints(bottom_face_vertices[0], bottom_face_vertices[1], bottom_face_vertices[2], bottom_face_vertices[3], 0.01)

# Unfold the top face up
top_face_vertices = fold_face(cube_faces[1], cube_faces[1][0], cube_faces[1][1], fold_angle)
top_face = rg.Brep.CreateFromCornerPoints(top_face_vertices[0], top_face_vertices[1], top_face_vertices[2], top_face_vertices[3], 0.01)

# Unfold the side faces down
side_faces = []
for i in range(2, 6):
    side_face_vertices = fold_face(cube_faces[i], cube_faces[i][0], cube_faces[i][1], fold_angle)
    side_face = rg.Brep.CreateFromCornerPoints(side_face_vertices[0], side_face_vertices[1], side_face_vertices[2], side_face_vertices[3], 0.01)
    side_faces.append(side_face)

# Output the geometries
aOut = cube_edges
bOut = cube_surfaces + [bottom_face, top_face] + side_faces

# If you have more geometries, you can output them as cOut, dOut, etc.
# ---------- end platonic_solids_005 ----------
param_viewer = ParamViewer(geometry_2)  # disabled
panel_3 = Panel(geometry_2)  # disabled
number_slider_11 = Slider(0.33, range=0..1)  # disabled
panel_4 = Panel(platonic_solids_004.out)  # disabled
panel_5 = Panel(platonic_solids_003.out)  # disabled
geometry_3 = Geometry(platonic_solids_003.bOut)  # disabled
panel_6 = Panel(platonic_solids_002.out)  # disabled
geometry_4 = Geometry(platonic_solids_003.aOut)  # disabled
geometry_5 = Geometry(platonic_solids_004.aOut)  # disabled
geometry_6 = Geometry(platonic_solids_002.bOut)  # disabled
geometry_7 = Geometry(platonic_solids_002.aOut)  # disabled
geometry_8 = Geometry(platonic_solids_004.bOut)  # disabled
brep_edges = BrepEdges(Brep=geometry_8)  # -> Naked, Interior, NonManifold; disabled
panel_7 = Panel(platonic_solids_005.out)  # disabled
geometry_9 = Geometry(platonic_solids_005.aOut)  # disabled
geometry_10 = Geometry(platonic_solids_005.bOut)  # disabled
brep_edges_2 = BrepEdges(Brep=geometry_10)  # -> Naked, Interior, NonManifold; disabled
pipe = Pipe(Curve=brep_edges_2.Naked, Radius=number_slider_11, Caps=0)  # disabled
panel_8 = Panel(geometry_4)  # disabled
panel_9 = Panel(geometry_5)  # disabled
param_viewer_2 = ParamViewer()  # disabled
param_viewer_3 = ParamViewer()  # disabled
panel_10 = Panel(geometry_7)  # disabled
param_viewer_4 = ParamViewer()  # disabled
panel_11 = Panel(geometry_9)  # disabled
param_viewer_5 = ParamViewer()  # disabled
number_slider_12 = Slider(0.81, range=0..10)  # disabled
number_slider_13 = Slider(360, range=-360..360)  # disabled
number_slider_14 = Slider(360, range=-360..360)  # disabled
number_slider_15 = Slider(0.97, range=0..10)  # disabled
number_slider_16 = Slider(90, range=-90..90)  # disabled
number_slider_17 = Slider(10, range=0..10)  # disabled
multiplication_3 = Multiplication(A=number_slider_16, B=multiplication)  # disabled
construct_domain = ConstructDomain(DomainStart=Slider(360, range=-360..360), DomainEnd=Slider(360, range=-360..360))
multiplication_4 = Multiplication(A=multiplication, B=multiplication)  # disabled
construct_domain_2 = ConstructDomain(DomainStart=number_slider_13, DomainEnd=number_slider_14)  # disabled
platonic_solids_006 = Script(edge_length=number_slider_17, fold_angle=multiplication_3)  # -> out, aOut, bOut; inputs edge_length: Double, fold_angle: Double; disabled
# ---------- platonic_solids_006: Python ----------
import Rhino.Geometry as rg
import math

def create_tetrahedron(center_point, edge_length):
    half = edge_length / (2 * math.sqrt(2))
    
    # Define the 4 vertices of the tetrahedron
    vertices = [
        rg.Point3d(center_point.X, center_point.Y, center_point.Z + edge_length * math.sqrt(2/3)),
        rg.Point3d(center_point.X - half, center_point.Y - half * math.sqrt(3), center_point.Z - half),
        rg.Point3d(center_point.X + half, center_point.Y - half * math.sqrt(3), center_point.Z - half),
        rg.Point3d(center_point.X, center_point.Y + half * math.sqrt(3), center_point.Z - half)
    ]
    
    # Define the 6 edges of the tetrahedron
    edges = [
        (vertices[0], vertices[1]), (vertices[0], vertices[2]), (vertices[0], vertices[3]),
        (vertices[1], vertices[2]), (vertices[2], vertices[3]), (vertices[3], vertices[1])
    ]
    
    lines = []
    for edge in edges:
        lines.append(rg.LineCurve(edge[0], edge[1]))
    
    # Define the 4 faces of the tetrahedron
    faces = [
        [vertices[0], vertices[1], vertices[2]],  # face 1
        [vertices[0], vertices[2], vertices[3]],  # face 2
        [vertices[0], vertices[3], vertices[1]],  # face 3
        [vertices[1], vertices[2], vertices[3]]   # base face
    ]
    
    surfaces = []
    for face in faces:
        surfaces.append(rg.Brep.CreateFromCornerPoints(face[0], face[1], face[2], 0.01))
    
    return lines, surfaces, vertices, faces

def fold_face(face_vertices, axis_start, axis_end, angle_degrees):
    # Define the fold axis (the edge of the face to be folded)
    fold_axis = rg.Line(axis_start, axis_end)
    
    # Convert angle to radians
    angle_radians = math.radians(angle_degrees)
    
    # Create a rotation transform
    rotation = rg.Transform.Rotation(angle_radians, fold_axis.Direction, fold_axis.PointAt(0.5))
    
    # Apply rotation to the face vertices
    folded_vertices = [vertex.Clone() for vertex in face_vertices]
    for i in range(3):
        folded_vertices[i].Transform(rotation)
    
    return folded_vertices

# Inputs
center_point = rg.Point3d(0, 0, 0)  # Modify this as needed
edge_length = edge_length # Modify this as needed
fold_angle = fold_angle # Fold angle in degrees, parametric input

# Create the tetrahedron
tetra_edges, tetra_surfaces, tetra_vertices, tetra_faces = create_tetrahedron(center_point, edge_length)

# Unfold the base face to the XY plane (already on the XY plane)
base_face = tetra_faces[3]

# Unfold the other three faces relative to the base face
folded_faces = []
for i in range(3):
    fold_axis_start = base_face[i]
    fold_axis_end = base_face[(i + 1) % 3]
    face_to_fold = tetra_faces[i]
    folded_face_vertices = fold_face(face_to_fold, fold_axis_start, fold_axis_end, fold_angle)
    folded_face = rg.Brep.CreateFromCornerPoints(folded_face_vertices[0], folded_face_vertices[1], folded_face_vertices[2], 0.01)
    folded_faces.append(folded_face)

# Output the geometries
aOut = tetra_edges
bOut = tetra_surfaces + folded_faces

# If you have more geometries, you can output them as cOut, dOut, etc.
# ---------- end platonic_solids_006 ----------
multiplication_5 = Multiplication(A=number_slider_15, B=multiplication)  # disabled
multiplication_6 = Multiplication(A=number_slider_15, B=multiplication)  # disabled
multiplication_7 = Multiplication(A=number_slider_12, B=multiplication_4)  # disabled
panel_12 = Panel("19")  # disabled
range = Range(Domain=construct_domain, Steps="11")
range_2 = Range(Domain=construct_domain_2, Steps=panel_12)  # disabled
number_slider_18 = Slider(90, range=-90..90)  # disabled
number_slider_19 = Slider(0.26, range=0..1)  # disabled
number_slider_20 = Slider(10, range=0..10)  # disabled
number_slider_21 = Slider(90, range=-90..90)  # disabled
panel_13 = Panel(platonic_solids_006.out)  # disabled
number_slider_22 = Slider(10, range=0..10)  # disabled
number_slider_23 = Slider(10, range=0..10)  # disabled
geometry_11 = Geometry(platonic_solids_006.aOut)  # disabled
geometry_12 = Geometry(platonic_solids_006.bOut)  # disabled
brep_edges_3 = BrepEdges(Brep=geometry_12)  # -> Naked, Interior, NonManifold; disabled
construct_point = ConstructPoint(XCoordinate=0, YCoordinate=0, ZCoordinate=0)  # disabled
construct_point_2 = ConstructPoint(XCoordinate=0, YCoordinate=0, ZCoordinate=0)
construct_point_3 = ConstructPoint(XCoordinate=0, YCoordinate=0, ZCoordinate=0)  # disabled
construct_point_4 = ConstructPoint(XCoordinate=multiplication_5, YCoordinate=multiplication_6, ZCoordinate=multiplication_7)  # disabled
multiplication_8 = Multiplication(A=number_slider_18, B=multiplication)  # disabled
multiplication_9 = Multiplication(A=cosine, B=range)
multiplication_10 = Multiplication(A=cosine, B=range_2)  # disabled
multiplication_11 = Multiplication(A=number_slider_21, B=multiplication)  # disabled
pipe_2 = Pipe(Curve=brep_edges_3.Naked, Radius=number_slider_19, Caps=0)  # disabled
platonic_solids_008 = Script(pts=construct_point, edge_length=number_slider_20, fold_angle=multiplication_8)  # -> out, aOut, bOut; inputs pts: Point3d, edge_length: Double, fold_angle: Double; disabled
# ---------- platonic_solids_008: Python ----------
import Rhino.Geometry as rg
import math

def create_icosahedron(center_point, edge_length):
    # Golden ratio
    phi = (1 + math.sqrt(5)) / 2
    
    # Define the 12 vertices of the icosahedron
    vertices = [
        rg.Point3d(-1,  phi, 0), rg.Point3d( 1,  phi, 0), rg.Point3d(-1, -phi, 0), rg.Point3d( 1, -phi, 0),
        rg.Point3d(0, -1,  phi), rg.Point3d(0,  1,  phi), rg.Point3d(0, -1, -phi), rg.Point3d(0,  1, -phi),
        rg.Point3d( phi, 0, -1), rg.Point3d( phi, 0,  1), rg.Point3d(-phi, 0, -1), rg.Point3d(-phi, 0,  1)
    ]
    
    # Normalize vertices and scale to the desired edge length
    for i in range(len(vertices)):
        vertices[i] = rg.Point3d.Multiply(vertices[i], edge_length / 2.0)
        vertices[i] = rg.Point3d(center_point.X + vertices[i].X, center_point.Y + vertices[i].Y, center_point.Z + vertices[i].Z)
    
    # Define the 20 faces of the icosahedron
    faces = [
        [vertices[0], vertices[11], vertices[5]], [vertices[0], vertices[5], vertices[1]], [vertices[0], vertices[1], vertices[7]], [vertices[0], vertices[7], vertices[10]], [vertices[0], vertices[10], vertices[11]],
        [vertices[1], vertices[5], vertices[9]], [vertices[5], vertices[11], vertices[4]], [vertices[11], vertices[10], vertices[2]], [vertices[10], vertices[7], vertices[6]], [vertices[7], vertices[1], vertices[8]],
        [vertices[3], vertices[9], vertices[4]], [vertices[3], vertices[4], vertices[2]], [vertices[3], vertices[2], vertices[6]], [vertices[3], vertices[6], vertices[8]], [vertices[3], vertices[8], vertices[9]],
        [vertices[4], vertices[9], vertices[5]], [vertices[2], vertices[4], vertices[11]], [vertices[6], vertices[2], vertices[10]], [vertices[8], vertices[6], vertices[7]], [vertices[9], vertices[8], vertices[1]]
    ]
    
    surfaces = []
    for face in faces:
        surfaces.append(rg.Brep.CreateFromCornerPoints(face[0], face[1], face[2], 0.01))
    
    return vertices, faces, surfaces

def fold_face(face_vertices, axis_start, axis_end, angle_degrees):
    # Define the fold axis (the edge of the face to be folded)
    fold_axis = rg.Line(axis_start, axis_end)
    
    # Convert angle to radians
    angle_radians = math.radians(angle_degrees)
    
    # Create a rotation transform
    rotation = rg.Transform.Rotation(angle_radians, fold_axis.Direction, fold_axis.PointAt(0.5))
    
    # Apply rotation to the face vertices
    folded_vertices = [vertex.Clone() for vertex in face_vertices]
    for i in range(3):
        folded_vertices[i].Transform(rotation)
    
    return folded_vertices

# Inputs
center_point = rg.Point3d(0, 0, 0)  # Modify this as needed
edge_length = edge_length  # Modify this as needed
fold_angle = fold_angle  # Fold angle in degrees, parametric input

# Create the icosahedron
vertices, faces, icosa_surfaces = create_icosahedron(center_point, edge_length)

# Unfold one of the base faces to the XY plane (already on the XY plane)
base_face = faces[0]

# Unfold the other faces relative to the base face
folded_faces = []
for i in range(1, len(faces)):
    fold_axis_start = base_face[0]
    fold_axis_end = base_face[1]
    face_to_fold = faces[i]
    folded_face_vertices = fold_face(face_to_fold, fold_axis_start, fold_axis_end, fold_angle)
    folded_face = rg.Brep.CreateFromCornerPoints(folded_face_vertices[0], folded_face_vertices[1], folded_face_vertices[2], 0.01)
    folded_faces.append(folded_face)

# Output the geometries
aOut = []
for face in faces:
    for i in range(3):
        aOut.append(rg.LineCurve(face[i], face[(i + 1) % 3]))

bOut = icosa_surfaces + folded_faces

# If you have more geometries, you can output them as cOut, dOut, etc.
# ---------- end platonic_solids_008 ----------
platonic_solids_010 = Script(pts=construct_point_2, edge_length=Slider(10, range=0..10), fold_angles=multiplication_9)  # -> out, aOut, bOut; inputs pts: Point3d, edge_length: Double, fold_angles: list of Double
# ---------- platonic_solids_010: Python ----------
import Rhino.Geometry as rg
import math

def create_dodecahedron(center_point, edge_length):
    phi = (1 + math.sqrt(5)) / 2
    a, b = 1, 1 / phi

    vertices = [
        rg.Point3d(-a, -a, -a), rg.Point3d(-a, -a,  a), rg.Point3d(-a,  a, -a), rg.Point3d(-a,  a,  a),
        rg.Point3d( a, -a, -a), rg.Point3d( a, -a,  a), rg.Point3d( a,  a, -a), rg.Point3d( a,  a,  a),
        rg.Point3d( 0, -b, -1/phi), rg.Point3d( 0, -b,  1/phi), rg.Point3d( 0,  b, -1/phi), rg.Point3d( 0,  b,  1/phi),
        rg.Point3d(-1/phi,  0, -b), rg.Point3d(-1/phi,  0,  b), rg.Point3d( 1/phi,  0, -b), rg.Point3d( 1/phi,  0,  b),
        rg.Point3d(-b, -1/phi,  0), rg.Point3d(-b,  1/phi,  0), rg.Point3d( b, -1/phi,  0), rg.Point3d( b,  1/phi,  0)
    ]

    # Normalize vertices and scale to the desired edge length
    for i in range(len(vertices)):
        vertices[i] = rg.Point3d.Multiply(vertices[i], edge_length / 2.0)
        vertices[i] = rg.Point3d(center_point.X + vertices[i].X, center_point.Y + vertices[i].Y, center_point.Z + vertices[i].Z)

    faces = [
        [vertices[0], vertices[16], vertices[2], vertices[10], vertices[12]], [vertices[1], vertices[13], vertices[3], vertices[17], vertices[0]],
        [vertices[4], vertices[14], vertices[6], vertices[18], vertices[5]], [vertices[7], vertices[19], vertices[6], vertices[11], vertices[15]],
        [vertices[0], vertices[16], vertices[8], vertices[9], vertices[1]], [vertices[2], vertices[17], vertices[3], vertices[13], vertices[12]],
        [vertices[4], vertices[10], vertices[6], vertices[11], vertices[14]], [vertices[7], vertices[5], vertices[18], vertices[19], vertices[15]],
        [vertices[0], vertices[8], vertices[16], vertices[4], vertices[10]], [vertices[2], vertices[12], vertices[13], vertices[1], vertices[3]],
        [vertices[4], vertices[10], vertices[12], vertices[6], vertices[14]], [vertices[7], vertices[15], vertices[5], vertices[11], vertices[19]]
    ]

    surfaces = []
    for face in faces:
        surfaces.append(rg.Brep.CreateFromCornerPoints(face[0], face[1], face[2], 0.01))
        surfaces.append(rg.Brep.CreateFromCornerPoints(face[0], face[2], face[3], 0.01))
        surfaces.append(rg.Brep.CreateFromCornerPoints(face[0], face[3], face[4], 0.01))

    return vertices, faces, surfaces

def fold_face(face_vertices, axis_start, axis_end, angle_degrees):
    fold_axis = rg.Line(axis_start, axis_end)
    angle_radians = math.radians(angle_degrees)
    rotation = rg.Transform.Rotation(angle_radians, fold_axis.Direction, fold_axis.PointAt(0.5))
    folded_vertices = [vertex.Clone() for vertex in face_vertices]
    for i in range(len(folded_vertices)):
        folded_vertices[i].Transform(rotation)
    return folded_vertices

def unfold_dodecahedron(faces, fold_angles):
    unfolded_faces = []
    for i, face in enumerate(faces):
        fold_axis_start = face[0]
        fold_axis_end = face[1]
        angle = fold_angles[i] if i < len(fold_angles) else 0
        folded_face_vertices = fold_face(face, fold_axis_start, fold_axis_end, angle)
        folded_face_1 = rg.Brep.CreateFromCornerPoints(folded_face_vertices[0], folded_face_vertices[1], folded_face_vertices[2], 0.01)
        folded_face_2 = rg.Brep.CreateFromCornerPoints(folded_face_vertices[0], folded_face_vertices[2], folded_face_vertices[3], 0.01)
        folded_face_3 = rg.Brep.CreateFromCornerPoints(folded_face_vertices[0], folded_face_vertices[3], folded_face_vertices[4], 0.01)
        unfolded_faces.append(folded_face_1)
        unfolded_faces.append(folded_face_2)
        unfolded_faces.append(folded_face_3)
    return unfolded_faces

# Inputs
center_point = rg.Point3d(0, 0, 0)  # Modify this as needed
edge_length = edge_length  # Modify this as needed
fold_angles = fold_angles

# Create the dodecahedron
vertices, faces, dodeca_surfaces = create_dodecahedron(center_point, edge_length)

# Unfold the dodecahedron
unfolded_faces = unfold_dodecahedron(faces, fold_angles)

# Output the geometries
aOut = []
for face in faces:
    for i in range(len(face)):
        aOut.append(rg.LineCurve(face[i], face[(i + 1) % len(face)]))

bOut = dodeca_surfaces + unfolded_faces

# If you have more geometries, you can output them as cOut, dOut, etc.
# ---------- end platonic_solids_010 ----------
platonic_solids_009 = Script(pts=construct_point_3, edge_length=number_slider_22, fold_angles=multiplication_10)  # -> out, aOut, bOut; inputs pts: Point3d, edge_length: Double, fold_angles: list of Double; disabled
# ---------- platonic_solids_009: Python ----------
import Rhino.Geometry as rg
import math

def create_icosahedron(center_point, edge_length):
    # Golden ratio
    phi = (1 + math.sqrt(5)) / 2
    
    # Define the 12 vertices of the icosahedron
    vertices = [
        rg.Point3d(-1,  phi, 0), rg.Point3d( 1,  phi, 0), rg.Point3d(-1, -phi, 0), rg.Point3d( 1, -phi, 0),
        rg.Point3d(0, -1,  phi), rg.Point3d(0,  1,  phi), rg.Point3d(0, -1, -phi), rg.Point3d(0,  1, -phi),
        rg.Point3d( phi, 0, -1), rg.Point3d( phi, 0,  1), rg.Point3d(-phi, 0, -1), rg.Point3d(-phi, 0,  1)
    ]
    
    # Normalize vertices and scale to the desired edge length
    for i in range(len(vertices)):
        vertices[i] = rg.Point3d.Multiply(vertices[i], edge_length / 2.0)
        vertices[i] = rg.Point3d(center_point.X + vertices[i].X, center_point.Y + vertices[i].Y, center_point.Z + vertices[i].Z)
    
    # Define the 20 faces of the icosahedron
    faces = [
        [vertices[0], vertices[11], vertices[5]], [vertices[0], vertices[5], vertices[1]], [vertices[0], vertices[1], vertices[7]], [vertices[0], vertices[7], vertices[10]], [vertices[0], vertices[10], vertices[11]],
        [vertices[1], vertices[5], vertices[9]], [vertices[5], vertices[11], vertices[4]], [vertices[11], vertices[10], vertices[2]], [vertices[10], vertices[7], vertices[6]], [vertices[7], vertices[1], vertices[8]],
        [vertices[3], vertices[9], vertices[4]], [vertices[3], vertices[4], vertices[2]], [vertices[3], vertices[2], vertices[6]], [vertices[3], vertices[6], vertices[8]], [vertices[3], vertices[8], vertices[9]],
        [vertices[4], vertices[9], vertices[5]], [vertices[2], vertices[4], vertices[11]], [vertices[6], vertices[2], vertices[10]], [vertices[8], vertices[6], vertices[7]], [vertices[9], vertices[8], vertices[1]]
    ]
    
    surfaces = []
    for face in faces:
        surfaces.append(rg.Brep.CreateFromCornerPoints(face[0], face[1], face[2], 0.01))
    
    return vertices, faces, surfaces

def fold_face(face_vertices, axis_start, axis_end, angle_degrees):
    # Define the fold axis (the edge of the face to be folded)
    fold_axis = rg.Line(axis_start, axis_end)
    
    # Convert angle to radians
    angle_radians = math.radians(angle_degrees)
    
    # Create a rotation transform
    rotation = rg.Transform.Rotation(angle_radians, fold_axis.Direction, fold_axis.PointAt(0.5))
    
    # Apply rotation to the face vertices
    folded_vertices = [vertex.Clone() for vertex in face_vertices]
    for i in range(3):
        folded_vertices[i].Transform(rotation)
    
    return folded_vertices

def unfold_icosahedron(faces, fold_angles):
    unfolded_faces = []
    
    for i, face in enumerate(faces):
        # Determine the fold axis (taking the first edge of each face for simplicity)
        fold_axis_start = face[0]
        fold_axis_end = face[1]
        
        # Get the fold angle for the current face
        angle = fold_angles[i] if i < len(fold_angles) else 0
        
        # Fold the face
        folded_face_vertices = fold_face(face, fold_axis_start, fold_axis_end, angle)
        folded_face = rg.Brep.CreateFromCornerPoints(folded_face_vertices[0], folded_face_vertices[1], folded_face_vertices[2], 0.01)
        unfolded_faces.append(folded_face)
    
    return unfolded_faces

# Inputs
center_point = rg.Point3d(0, 0, 0)  # Modify this as needed
edge_length = 10.0  # Modify this as needed[]
fold_angles = fold_angles  # Parametric fold angles for each face

# Create the icosahedron
vertices, faces, icosa_surfaces = create_icosahedron(center_point, edge_length)

# Unfold the icosahedron
unfolded_faces = unfold_icosahedron(faces, fold_angles)

# Output the geometries
aOut = []
for face in faces:
    for i in range(3):
        aOut.append(rg.LineCurve(face[i], face[(i + 1) % 3]))

bOut = icosa_surfaces + unfolded_faces

# If you have more geometries, you can output them as cOut, dOut, etc.
# ---------- end platonic_solids_009 ----------
platonic_solids_007 = Script(pts=construct_point_4, edge_length=number_slider_23, fold_angle=multiplication_11)  # -> out, aOut, bOut; inputs pts: Point3d, edge_length: Double, fold_angle: Double; disabled
# ---------- platonic_solids_007: Python ----------
import Rhino.Geometry as rg
import math

def create_octahedron(center_point, edge_length):
    half = edge_length / 2.0
    h = math.sqrt(edge_length**2 - half**2)
    
    # Define the 6 vertices of the octahedron
    vertices = [
        rg.Point3d(center_point.X, center_point.Y, center_point.Z + h),
        rg.Point3d(center_point.X, center_point.Y, center_point.Z - h),
        rg.Point3d(center_point.X + half, center_point.Y + half, center_point.Z),
        rg.Point3d(center_point.X + half, center_point.Y - half, center_point.Z),
        rg.Point3d(center_point.X - half, center_point.Y + half, center_point.Z),
        rg.Point3d(center_point.X - half, center_point.Y - half, center_point.Z)
    ]
    
    # Define the 12 edges of the octahedron
    edges = [
        (vertices[0], vertices[2]), (vertices[0], vertices[3]), (vertices[0], vertices[4]), (vertices[0], vertices[5]),
        (vertices[1], vertices[2]), (vertices[1], vertices[3]), (vertices[1], vertices[4]), (vertices[1], vertices[5]),
        (vertices[2], vertices[3]), (vertices[3], vertices[5]), (vertices[5], vertices[4]), (vertices[4], vertices[2])
    ]
    
    lines = []
    for edge in edges:
        lines.append(rg.LineCurve(edge[0], edge[1]))
    
    # Define the 8 faces of the octahedron
    faces = [
        [vertices[0], vertices[2], vertices[3]],  # top face 1
        [vertices[0], vertices[3], vertices[5]],  # top face 2
        [vertices[0], vertices[5], vertices[4]],  # top face 3
        [vertices[0], vertices[4], vertices[2]],  # top face 4
        [vertices[1], vertices[2], vertices[3]],  # bottom face 1
        [vertices[1], vertices[3], vertices[5]],  # bottom face 2
        [vertices[1], vertices[5], vertices[4]],  # bottom face 3
        [vertices[1], vertices[4], vertices[2]]   # bottom face 4
    ]
    
    surfaces = []
    for face in faces:
        surfaces.append(rg.Brep.CreateFromCornerPoints(face[0], face[1], face[2], 0.01))
    
    return lines, surfaces, vertices, faces

def fold_face(face_vertices, axis_start, axis_end, angle_degrees):
    # Define the fold axis (the edge of the face to be folded)
    fold_axis = rg.Line(axis_start, axis_end)
    
    # Convert angle to radians
    angle_radians = math.radians(angle_degrees)
    
    # Create a rotation transform
    rotation = rg.Transform.Rotation(angle_radians, fold_axis.Direction, fold_axis.PointAt(0.5))
    
    # Apply rotation to the face vertices
    folded_vertices = [vertex.Clone() for vertex in face_vertices]
    for i in range(3):
        folded_vertices[i].Transform(rotation)
    
    return folded_vertices

# Inputs
center_point = pts  # Modify this as needed
edge_length = edge_length  # Modify this as needed
fold_angle = fold_angle  # Fold angle in degrees, parametric input

# Create the octahedron
octa_edges, octa_surfaces, octa_vertices, octa_faces = create_octahedron(center_point, edge_length)

# Unfold the bottom faces to the XY plane (already on the XY plane)
base_faces = octa_faces[4:8]

# Unfold the top faces relative to the base faces
folded_faces = []
for i in range(4):
    fold_axis_start = base_faces[i][1]
    fold_axis_end = base_faces[i][2]
    face_to_fold = octa_faces[i]
    folded_face_vertices = fold_face(face_to_fold, fold_axis_start, fold_axis_end, fold_angle)
    folded_face = rg.Brep.CreateFromCornerPoints(folded_face_vertices[0], folded_face_vertices[1], folded_face_vertices[2], 0.01)
    folded_faces.append(folded_face)

# Output the geometries
aOut = octa_edges
bOut = octa_surfaces + folded_faces

# If you have more geometries, you can output them as cOut, dOut, etc.
# ---------- end platonic_solids_007 ----------
panel_14 = Panel(geometry_11)  # disabled
param_viewer_6 = ParamViewer()  # disabled
number_slider_24 = Slider(0.26, range=0..1)  # disabled
number_slider_25 = Slider(0.26, range=0..1)  # disabled
panel_15 = Panel(platonic_solids_008.out)  # disabled
geometry_13 = Geometry(platonic_solids_008.aOut)  # disabled
geometry_14 = Geometry(platonic_solids_008.bOut)  # disabled
brep_edges_4 = BrepEdges(Brep=geometry_14)  # -> Naked, Interior, NonManifold; disabled
panel_16 = Panel(platonic_solids_010.out)
panel_17 = Panel(platonic_solids_009.out)  # disabled
panel_18 = Panel(platonic_solids_007.out)  # disabled
geometry_15 = Geometry(platonic_solids_010.aOut)
geometry_16 = Geometry(platonic_solids_009.aOut)  # disabled
geometry_17 = Geometry(platonic_solids_007.aOut)  # disabled
geometry_18 = Geometry(platonic_solids_010.bOut)
geometry_19 = Geometry(platonic_solids_009.bOut)  # disabled
geometry_20 = Geometry(platonic_solids_007.bOut)  # disabled
brep_edges_5 = BrepEdges(Brep=geometry_20)  # -> Naked, Interior, NonManifold; disabled
brep_edges_6 = BrepEdges(Brep=geometry_18)  # -> Naked, Interior, NonManifold
brep_edges_7 = BrepEdges(Brep=geometry_19)  # -> Naked, Interior, NonManifold; disabled
pipe_3 = Pipe(Curve=brep_edges_4.Naked, Radius=number_slider_24, Caps=0)  # disabled
pipe_4 = Pipe(Curve=brep_edges_5.Naked, Radius=number_slider_25, Caps=0)  # disabled
panel_19 = Panel(geometry_13)  # disabled
panel_20 = Panel(geometry_15)
panel_21 = Panel(geometry_16)  # disabled
panel_22 = Panel(geometry_17)  # disabled
param_viewer_7 = ParamViewer()  # disabled
