# Grasshopper definition 016_Binets_Formula.gh (Grasshopper 1.0.8)
# plug-ins: RhinoCodePluginGH

# ----
# Oscillation Script
trigger = Trigger(Interval=20, TimerInterval=20, Target=data_recorder)
data_recorder = DataRecorder("1", DataLimit=10000000, RecordData=False)
list_length = ListLength(List=data_recorder)
division = Division(A=list_length, B=Slider(110, range=0..1000))
cosine = Cosine(Value=division)
sine = Sine(Value=division)
absolute = Absolute(Value=cosine)
absolute_2 = Absolute(Value=sine)
panel = Panel([absolute_2, absolute])

multiplication = Multiplication(A=Slider(5, range=-5..5), B=sine)
multiplication_2 = Multiplication(A=Slider(1.49, range=0..2), B=cosine)
number_slider = Slider(12, range=0..100)  # disabled
vector_xyz = VectorXYZ(XComponent=Slider(0.37, range=0..1), YComponent=Slider(0.53, range=0..1), ZComponent=Slider(0.18, range=0..1))  # -> Vector, Length
binets_formula_002 = Script(num_points=number_slider)  # -> out, aOut, bOut, cOut, dOut; inputs num_points: Int32; disabled
# ---------- binets_formula_002: Python ----------
import math
import Rhino.Geometry as rg

# Function to calculate Fibonacci numbers using Binet's Formula
def fibonacci_binet(n):
    phi = (1 + math.sqrt(5)) / 2
    psi = (1 - math.sqrt(5)) / 2
    fib_n = (math.pow(phi, n) - math.pow(psi, n)) / math.sqrt(5)
    return round(fib_n)

# Number of Fibonacci points to generate
num_points = num_points

# Generate Fibonacci points
fib_points = []
for i in range(num_points):
    fib = fibonacci_binet(i)
    angle = i * math.pi / 4  # Use angles to create a spiral effect
    x = fib * math.cos(angle)
    y = fib * math.sin(angle)
    z = fib * math.sin(angle / 2)  # Adding a third dimension with a sine wave
    point = rg.Point3d(x, y, z)
    fib_points.append(point)

# Create interpolated curve through Fibonacci points
fib_curve = rg.Curve.CreateInterpolatedCurve(fib_points, 3)

# Apply transformations
transformed_points = []
for pt in fib_points:
    # Rotate around Z-axis
    rotation = rg.Transform.Rotation(math.pi / 6, rg.Vector3d.ZAxis, rg.Point3d.Origin)
    rotated_pt = pt
    rotated_pt.Transform(rotation)
    
    # Scale transformation
    scale = rg.Transform.Scale(rg.Point3d.Origin, 1.2)
    scaled_pt = rotated_pt
    scaled_pt.Transform(scale)
    
    # Translation
    translation = rg.Transform.Translation(rg.Vector3d(5, 5, 0))
    translated_pt = scaled_pt
    translated_pt.Transform(translation)
    
    transformed_points.append(translated_pt)

# Create another interpolated curve through transformed points
transformed_curve = rg.Curve.CreateInterpolatedCurve(transformed_points, 3)

# Outputs
aOut = fib_points
bOut = fib_curve
cOut = transformed_points
dOut = transformed_curve
# ---------- end binets_formula_002 ----------
# 002 Getting Started
# 
# Learning Python in Grasshopper with gpt-4o
# 
# Binets_Formula
# 
# To create a Python script for the Grasshopper
# node editor in Rhino 8 that demonstrates
# interesting geometry inspired by Binet's
# Formula, we'll first interpret the mathematical
# concept. Binet's Formula is used to compute
# Fibonacci numbers, and we can use these
# numbers to generate a geometrical pattern.
binets_formula_001 = Script()  # -> out, aOut, bOut; disabled
# ---------- binets_formula_001: Python ----------
import math
import Rhino.Geometry as rg

# Function to calculate Fibonacci numbers using Binet's Formula
def fibonacci_binet(n):
    phi = (1 + math.sqrt(5)) / 2
    psi = (1 - math.sqrt(5)) / 2
    fib_n = (math.pow(phi, n) - math.pow(psi, n)) / math.sqrt(5)
    return round(fib_n)

# Number of Fibonacci points to generate
num_points = 15

# Generate Fibonacci points
fib_points = []
for i in range(num_points):
    fib = fibonacci_binet(i)
    point = rg.Point3d(i, fib, 0)
    fib_points.append(point)

# Create interpolated curve through Fibonacci points
fib_curve = rg.Curve.CreateInterpolatedCurve(fib_points, 3)

# Outputs
aOut = fib_points
bOut = fib_curve
# ---------- end binets_formula_001 ----------
binets_formula_003 = Script(
    num_points=Slider(12, range=0..100),
    angle_multiplier=multiplication_2,
    z_wave_frequency=multiplication,
    rotation_angle=Slider(146, range=-180..180),
    scale_factor=Slider(0.96, range=0..3),
    translation_vector=vector_xyz.Vector)  # -> out, aOut, bOut, cOut, dOut; inputs num_points: Int32, angle_multiplier: Double, z_wave_frequency: Double, rotation_angle: Double, scale_factor: Double, translation_vector: Vector3d
# ---------- binets_formula_003: Python ----------
import math
import Rhino.Geometry as rg

# Function to calculate Fibonacci numbers using Binet's Formula
def fibonacci_binet(n):
    phi = (1 + math.sqrt(5)) / 2
    psi = (1 - math.sqrt(5)) / 2
    fib_n = (math.pow(phi, n) - math.pow(psi, n)) / math.sqrt(5)
    return round(fib_n)

# Parametric inputs
num_points = num_points  # Number of Fibonacci points to generate (input 'x')
angle_multiplier = angle_multiplier  # Angle multiplier for spiral effect (input 'y')
z_wave_frequency = z_wave_frequency  # Frequency of the sine wave for the Z dimension (input 'z')
rotation_angle = rotation_angle # Rotation angle around the Z-axis (input 'w')
scale_factor = scale_factor  # Scale factor for the points (input 'u')
translation_vector = translation_vector  # Translation vector (input 'v' as a tuple (x, y, z))

# Generate Fibonacci points
fib_points = []
for i in range(num_points):
    fib = fibonacci_binet(i)
    angle = i * angle_multiplier  # Use the angle multiplier
    x_coord = fib * math.cos(angle)
    y_coord = fib * math.sin(angle)
    z_coord = fib * math.sin(angle / z_wave_frequency)  # Use the Z-wave frequency
    point = rg.Point3d(x_coord, y_coord, z_coord)
    fib_points.append(point)

# Create interpolated curve through Fibonacci points
fib_curve = rg.Curve.CreateInterpolatedCurve(fib_points, 3)

# Apply transformations
transformed_points = []
for pt in fib_points:
    # Rotate around Z-axis
    rotation = rg.Transform.Rotation(rotation_angle, rg.Vector3d.ZAxis, rg.Point3d.Origin)
    rotated_pt = pt
    rotated_pt.Transform(rotation)
    
    # Scale transformation
    scale = rg.Transform.Scale(rg.Point3d.Origin, scale_factor)
    scaled_pt = rotated_pt
    scaled_pt.Transform(scale)
    
    # Translation
    translation = rg.Transform.Translation(rg.Vector3d(translation_vector[0], translation_vector[1], translation_vector[2]))
    translated_pt = scaled_pt
    translated_pt.Transform(translation)
    
    transformed_points.append(translated_pt)

# Create another interpolated curve through transformed points
transformed_curve = rg.Curve.CreateInterpolatedCurve(transformed_points, 3)

# Outputs
aOut = fib_points
bOut = fib_curve
cOut = transformed_points
dOut = transformed_curve
# ---------- end binets_formula_003 ----------
panel_2 = Panel(binets_formula_001.out)  # disabled
geometry = Geometry(binets_formula_001.bOut)  # disabled
geometry_2 = Geometry(binets_formula_001.aOut)  # disabled
panel_3 = Panel(binets_formula_002.out)  # disabled
panel_4 = Panel(binets_formula_003.out)
geometry_3 = Geometry(binets_formula_002.aOut)  # disabled
geometry_4 = Geometry(binets_formula_002.bOut)  # disabled
geometry_5 = Geometry(binets_formula_002.cOut)  # disabled
geometry_6 = Geometry(binets_formula_002.dOut)  # disabled
geometry_7 = Geometry(binets_formula_003.aOut)
geometry_8 = Geometry(binets_formula_003.bOut)
geometry_9 = Geometry(binets_formula_003.cOut)
geometry_10 = Geometry(binets_formula_003.dOut)
pipe = Pipe(Curve=[geometry_8, geometry_10], Radius=1, Caps=0)
param_viewer = ParamViewer(geometry_2)
panel_5 = Panel(geometry)  # disabled
loft = Loft(
    Curves=[geometry_4, geometry_6],
    Options={Adjust=False, Closed=False, LoftEnds=0, LoftSimp=0, LoftType=0, Rebuild=10, Refit=0.01})  # disabled
param_viewer_2 = ParamViewer(geometry_3)  # disabled
panel_6 = Panel(geometry_4)  # disabled
loft_2 = Loft(
    Curves=[geometry_8, geometry_10],
    Options={Adjust=False, Closed=False, LoftEnds=0, LoftSimp=0, LoftType=0, Rebuild=10, Refit=0.01})
param_viewer_3 = ParamViewer(geometry_7)
panel_7 = Panel(geometry_8)
