# Grasshopper definition 017_RiemannArrangementTheorem.gh (Grasshopper 1.0.8)
# plug-ins: RhinoCodePluginGH

# ----
# Oscillation Script
trigger = Trigger(Interval=20, TimerInterval=20, Target=data_recorder)
data_recorder = DataRecorder("1", DataLimit=10000000, RecordData=False)
list_length = ListLength(List=data_recorder)
division = Division(A=list_length, B=Slider(126, range=0..1000))
cosine = Cosine(Value=division)
sine = Sine(Value=division)
absolute = Absolute(Value=cosine)
absolute_2 = Absolute(Value=sine)
panel = Panel([absolute_2, absolute])

multiplication = Multiplication(A=Slider(3, range=-3..3), B=cosine)
multiplication_2 = Multiplication(A=Slider(2, range=-2..2), B=sine)
number_slider = Slider(1, range=0..1)  # disabled
number_slider_2 = Slider(0, range=0..1)  # disabled
number_slider_3 = Slider(0.56, range=0..1)  # disabled
number_slider_4 = Slider(4, range=-4..4)  # disabled
construct_point = ConstructPoint(XCoordinate=Slider(1, range=0..1), YCoordinate=Slider(1, range=0..1), ZCoordinate=Slider(0.22, range=0..1))
# 002 Getting Started
# 
# Learning Python in Grasshopper with gpt-4o
# 
# RiemannArrangementTheorem
# 
# To create a Python script for the Grasshopper
# node editor in Rhino 8 that demonstrates
# interesting geometry inspired by the Riemann
# Rearrangement Theorem, we can use the
# concept of rearranging points or curves in a way
# that they visually converge or diverge.
number_slider_5 = Slider(6, range=0..100)  # disabled
number_slider_6 = Slider(0, range=0..1)  # disabled
number_slider_7 = Slider(1.37, range=-3..3)  # disabled
pi = Pi(Factor=multiplication_2)
number_slider_8 = Slider(1.25, range=0.01..3)  # disabled
construct_point_2 = ConstructPoint(XCoordinate=number_slider, YCoordinate=number_slider_2, ZCoordinate=number_slider_3)  # disabled
pi_2 = Pi(Factor=number_slider_4)  # disabled
riemannarrangementtheorem_002 = Script(
    num_points=Slider(4, range=0..100),
    convergence_type=Slider(0, range=0..1),
    z_frequency=multiplication,
    rotation_angle=pi,
    scale_factor=Slider(0.98, range=0.01..3),
    translation_vector=construct_point,
    polar_array_count=Slider(16, range=0..16))  # -> out, aOut, bOut, cOut, dOut, eOut, fOut; inputs num_points: Int32, convergence_type: Int32, z_frequency: Double, rotation_angle: Double, scale_factor: Double, translation_vector: Vector3d, polar_array_count: Int32
# ---------- riemannarrangementtheorem_002: Python ----------
import math
import Rhino.Geometry as rg

# Function to calculate Fibonacci numbers using Binet's Formula
def fibonacci_binet(n):
    phi = (1 + math.sqrt(5)) / 2
    psi = (1 - math.sqrt(5)) / 2
    fib_n = (math.pow(phi, n) - math.pow(psi, n)) / math.sqrt(5)
    return round(fib_n)

# Parametric inputs
num_points = num_points  # Number of points to generate
convergence_type = convergence_type  # Type of convergence: 0 for conditional convergence, 1 for divergence
z_frequency = z_frequency  # Frequency of the sine wave for the Z dimension
rotation_angle = rotation_angle # Rotation angle around the Z-axis
scale_factor = scale_factor  # Scale factor for the points
translation_vector = translation_vector  # Translation vector (input 'v' as a list [x, y, z])
polar_array_count = polar_array_count  # Number of polar array copies

# Generate points based on Riemann Rearrangement Theorem
points = []
for i in range(1, num_points + 1):
    if convergence_type == 0:
        x_coord = 1 / i * (-1) ** (i + 1)
    else:
        x_coord = i * (-1) ** (i + 1)
    
    y_coord = math.log(i + 1)
    z_coord = math.sin(i / z_frequency)
    point = rg.Point3d(x_coord, y_coord, z_coord)
    points.append(point)

# Create interpolated curve through points
curve = rg.Curve.CreateInterpolatedCurve(points, 3)

# Apply transformations
transformed_points = []
for pt in points:
    # Rotate around Z-axis
    rotation = rg.Transform.Rotation(rotation_angle, rg.Vector3d.ZAxis, rg.Point3d.Origin)
    rotated_pt = pt
    rotated_pt.Transform(rotation)
    
    # Scale transformation
    scale = rg.Transform.Scale(rg.Point3d.Origin, scale_factor)
    scaled_pt = rotated_pt
    scaled_pt.Transform(scale)
    
    # Translation
    translation = rg.Transform.Translation(rg.Vector3d(translation_vector[0], translation_vector[1], translation_vector[2]))
    translated_pt = scaled_pt
    translated_pt.Transform(translation)
    
    transformed_points.append(translated_pt)

# Create another interpolated curve through transformed points
transformed_curve = rg.Curve.CreateInterpolatedCurve(transformed_points, 3)

# Generate polar array of curves
polar_curves = []
for i in range(polar_array_count):
    angle = i * (2 * math.pi / polar_array_count)
    rotation = rg.Transform.Rotation(angle, rg.Vector3d.ZAxis, rg.Point3d.Origin)
    
    rotated_curve = curve.DuplicateCurve()
    rotated_curve.Transform(rotation)
    
    polar_curves.append(rotated_curve)
    
    rotated_transformed_curve = transformed_curve.DuplicateCurve()
    rotated_transformed_curve.Transform(rotation)
    
    polar_curves.append(rotated_transformed_curve)

# Create lofted surfaces between paired curves
loft_surfaces = []
for i in range(0, len(polar_curves), 2):
    if i + 1 < len(polar_curves):
        loft = rg.Brep.CreateFromLoft([polar_curves[i], polar_curves[i + 1]], rg.Point3d.Unset, rg.Point3d.Unset, rg.LoftType.Normal, False)
        loft_surfaces.extend(loft)

# Outputs
aOut = points
bOut = curve
cOut = transformed_points
dOut = transformed_curve
eOut = polar_curves
fOut = loft_surfaces
# ---------- end riemannarrangementtheorem_002 ----------
riemannarrangementtheorem_001 = Script(x=number_slider_5, y=number_slider_6, z=number_slider_7, w=pi_2, u=number_slider_8, v=construct_point_2)  # -> out, aOut, bOut, cOut, dOut; inputs x: Int32, y: Int32, z: Double, w: Double, u: Double, v: Vector3d; disabled
# ---------- riemannarrangementtheorem_001: Python ----------
import math
import Rhino.Geometry as rg

# Parametric inputs
num_points = x  # Number of points to generate
convergence_type = y  # Type of convergence: 0 for converge, 1 for diverge
z_frequency = z  # Frequency of the sine wave for the Z dimension
rotation_angle = w  # Rotation angle around the Z-axis
scale_factor = u  # Scale factor for the points
translation_vector = v  # Translation vector as a tuple (x, y, z)

# Generate points based on Riemann Rearrangement Theorem
points = []
for i in range(1, num_points + 1):
    if convergence_type == 0:
        x_coord = 1 / i * (-1) ** (i + 1)
    else:
        x_coord = i * (-1) ** (i + 1)
    
    y_coord = math.log(i + 1)
    z_coord = math.sin(i / z_frequency)
    point = rg.Point3d(x_coord, y_coord, z_coord)
    points.append(point)

# Create interpolated curve through points
curve = rg.Curve.CreateInterpolatedCurve(points, 3)

# Apply transformations
transformed_points = []
for pt in points:
    # Rotate around Z-axis
    rotation = rg.Transform.Rotation(rotation_angle, rg.Vector3d.ZAxis, rg.Point3d.Origin)
    rotated_pt = pt
    rotated_pt.Transform(rotation)
    
    # Scale transformation
    scale = rg.Transform.Scale(rg.Point3d.Origin, scale_factor)
    scaled_pt = rotated_pt
    scaled_pt.Transform(scale)
    
    # Translation
    translation = rg.Transform.Translation(rg.Vector3d(translation_vector[0], translation_vector[1], translation_vector[2]))
    translated_pt = scaled_pt
    translated_pt.Transform(translation)
    
    transformed_points.append(translated_pt)

# Create another interpolated curve through transformed points
transformed_curve = rg.Curve.CreateInterpolatedCurve(transformed_points, 3)

# Outputs
aOut = points
bOut = curve
cOut = transformed_points
dOut = transformed_curve
# ---------- end riemannarrangementtheorem_001 ----------
panel_2 = Panel(riemannarrangementtheorem_002.out)
panel_3 = Panel(riemannarrangementtheorem_001.out)  # disabled
geometry = Geometry(riemannarrangementtheorem_001.aOut)  # disabled
geometry_2 = Geometry(riemannarrangementtheorem_001.bOut)  # disabled
geometry_3 = Geometry(riemannarrangementtheorem_001.cOut)  # disabled
geometry_4 = Geometry(riemannarrangementtheorem_001.dOut)  # disabled
geometry_5 = Geometry(riemannarrangementtheorem_002.fOut)
geometry_6 = Geometry(riemannarrangementtheorem_002.aOut)
geometry_7 = Geometry(riemannarrangementtheorem_002.bOut)
geometry_8 = Geometry(riemannarrangementtheorem_002.cOut)
geometry_9 = Geometry(riemannarrangementtheorem_002.dOut)
geometry_10 = Geometry(riemannarrangementtheorem_002.eOut)
loft = Loft(
    Curves=[geometry_2, geometry_4],
    Options={Adjust=False, Closed=False, LoftEnds=0, LoftSimp=0, LoftType=0, Rebuild=10, Refit=0.01})  # disabled
param_viewer = ParamViewer(geometry_6)
panel_4 = Panel(geometry_9)
param_viewer_2 = ParamViewer(geometry)  # disabled
panel_5 = Panel(geometry_4)  # disabled
