# Grasshopper definition 018_Epycicloid.gh (Grasshopper 1.0.8)
# plug-ins: RhinoCodePluginGH

# ----
# Oscillation Script
trigger = Trigger(Interval=20, TimerInterval=20, Target=data_recorder)
data_recorder = DataRecorder("1", DataLimit=10000000, RecordData=False)
list_length = ListLength(List=data_recorder)
division = Division(A=list_length, B=Slider(323, range=0..1000))
cosine = Cosine(Value=division)
sine = Sine(Value=division)
absolute = Absolute(Value=cosine)
absolute_2 = Absolute(Value=sine)
panel = Panel([absolute_2, absolute])

number_slider = Slider(3, range=-3..3)
number_slider_2 = Slider(2, range=-2..2)
multiplication = Multiplication(A=Slider(3, range=-3..3), B=cosine)
multiplication_2 = Multiplication(A=Slider(-3, range=-3..3), B=sine)
# 002 Getting Started
# 
# Learning Python in Grasshopper with gpt-4o
# 
# Epycicloid
# 
# Sure, let's create a Python script in the
# Grasshopper node editor for Rhino 8 that
# generates geometry based on the epycicloid
# formula provided in the image. An epicycloid is a
#  type of curve created by tracing a point on the
# circumference of a circle that rolls around the
# outside of another circle.
number_slider_3 = Slider(5.61, range=0..100)
pi = Pi(Factor=Slider(71, range=0..100))
pi_2 = Pi(Factor=Slider(71, range=0..100))
epycicloid_001 = Script(
    r_large=number_slider_3,
    r_small=Slider(6.86, range=0..10),
    num_points=Slider(60, range=0..100),
    theta_step=Slider(1.07, range=0..10))  # -> out, aOut, bOut; inputs r_large: Double, r_small: Double, num_points: Int32, theta_step: Double; disabled
# ---------- epycicloid_001: Python ----------
import math
import Rhino.Geometry as rg

# Parametric inputs
R = r_large  # Radius of the large circle
r = r_small  # Radius of the small circle
num_points = num_points  # Number of points to generate for the epicycloid
theta_step = theta_step  # Step size for theta

# Generate epicycloid points
epicycloid_points = []
for i in range(num_points):
    theta = i * theta_step
    x_coord = (R + r) * math.cos(theta) - r * math.cos((R + r) / r * theta)
    y_coord = (R + r) * math.sin(theta) - r * math.sin((R + r) / r * theta)
    point = rg.Point3d(x_coord, y_coord, 0)
    epicycloid_points.append(point)

# Create interpolated curve through epicycloid points
epicycloid_curve = rg.Curve.CreateInterpolatedCurve(epicycloid_points, 3)

# Outputs
aOut = epicycloid_points
bOut = epicycloid_curve
# ---------- end epycicloid_001 ----------
epycicloid_002 = Script(
    r_large=Slider(5.61, range=0..100),
    r_small=Slider(6.86, range=0..10),
    num_points=Slider(60, range=0..100),
    theta_step=Slider(0.91, range=0..10),
    z_amp=multiplication,
    z_freq=multiplication_2)  # -> out, aOut, bOut; inputs r_large: Double, r_small: Double, num_points: Int32, theta_step: Double, z_amp: Double, z_freq: Double
# ---------- epycicloid_002: Python ----------
import math
import Rhino.Geometry as rg

# Parametric inputs
R = r_large  # Radius of the large circle
r = r_small  # Radius of the small circle
num_points = num_points  # Number of points to generate for the epicycloid
theta_step = theta_step  # Step size for theta
z_amplitude = z_amp  # Amplitude for the Z-coordinate trigonometric function
z_frequency = z_freq  # Frequency for the Z-coordinate trigonometric function

# Generate epicycloid points with complex trigonometric polynomials for Z-coordinates
epicycloid_points = []
for i in range(num_points):
    theta = i * theta_step
    x_coord = (R + r) * math.cos(theta) - r * math.cos((R + r) / r * theta)
    y_coord = (R + r) * math.sin(theta) - r * math.sin((R + r) / r * theta)
    z_coord = z_amplitude * math.sin(z_frequency * theta)  # Adding complexity in the Z dimension
    point = rg.Point3d(x_coord, y_coord, z_coord)
    epicycloid_points.append(point)

# Create interpolated curve through epicycloid points
epicycloid_curve = rg.Curve.CreateInterpolatedCurve(epicycloid_points, 3)

# Apply polar array transformation to generate multiple copies in a circular pattern
polar_curves = []
polar_array_count = 8  # Number of polar array copies
for i in range(polar_array_count):
    angle = i * (2 * math.pi / polar_array_count)
    rotation = rg.Transform.Rotation(angle, rg.Vector3d.ZAxis, rg.Point3d.Origin)
    
    rotated_curve = epicycloid_curve.DuplicateCurve()
    rotated_curve.Transform(rotation)
    
    polar_curves.append(rotated_curve)

# Create lofted surfaces between paired curves
loft_surfaces = []
for i in range(len(polar_curves) - 1):
    loft = rg.Brep.CreateFromLoft([polar_curves[i], polar_curves[i + 1]], rg.Point3d.Unset, rg.Point3d.Unset, rg.LoftType.Normal, False)
    loft_surfaces.extend(loft)

# Loft the last curve with the first to close the surface
loft = rg.Brep.CreateFromLoft([polar_curves[-1], polar_curves[0]], rg.Point3d.Unset, rg.Point3d.Unset, rg.LoftType.Normal, False)
loft_surfaces.extend(loft)

# Outputs
aOut = epicycloid_points
bOut = epicycloid_curve
cOut = polar_curves
dOut = loft_surfaces
# ---------- end epycicloid_002 ----------
panel_2 = Panel(epycicloid_001.out)  # disabled
panel_3 = Panel(epycicloid_002.out)
geometry = Geometry(epycicloid_001.aOut)  # disabled
geometry_2 = Geometry(epycicloid_001.bOut)  # disabled
geometry_3 = Geometry(epycicloid_002.aOut)
geometry_4 = Geometry(epycicloid_002.bOut)
param_viewer = ParamViewer(geometry)
panel_4 = Panel(geometry_2)
param_viewer_2 = ParamViewer(geometry_3)
panel_5 = Panel(geometry_4)
