# Grasshopper definition 019_Borsuk_Ulam_Theorem.gh (Grasshopper 1.0.8)
# plug-ins: RhinoCodePluginGH

# ----
# Oscillation Script
trigger = Trigger(Interval=20, TimerInterval=20, Target=data_recorder)
data_recorder = DataRecorder("1", DataLimit=10000000, RecordData=False)
list_length = ListLength(List=data_recorder)
division = Division(A=list_length, B=Slider(138, range=0..1000))
cosine = Cosine(Value=division)
sine = Sine(Value=division)
absolute = Absolute(Value=cosine)
absolute_2 = Absolute(Value=sine)
panel = Panel([absolute_2, absolute])

multiplication = Multiplication(A=Slider(3, range=-3..3), B=cosine)
multiplication_2 = Multiplication(A=Slider(3, range=-3..3), B=sine)
# 002 Getting Started
# 
# Learning Python in Grasshopper with gpt-4o
# 
# Borsuk_Ulam_Theorem
# 
# The Borsuk-Ulam Theorem states that any
# continuous function from an
# n-dimensional sphere to
# n-dimensional Euclidean space maps at least one
# pair of antipodal points to the same point. To create
# a script inspired by this theorem, we'll generate
# points on a 3D sphere and create an interesting
# geometry by connecting antipodal points with curves.
borsuk_ulam_theorem_001 = Script(radius=Slider(3.42, range=0..10), num_points=Slider(100, range=0..100))  # -> out, aOut, bOut, cOut, dOut; inputs radius: Double, num_points: Int32
# ---------- borsuk_ulam_theorem_001: Python ----------
import math
import Rhino.Geometry as rg

# Parametric inputs
radius = radius  # Radius of the sphere
num_points = num_points  # Number of points to generate on the sphere

# Generate points on the sphere
points = []
for i in range(num_points):
    theta = i * (2 * math.pi / num_points)  # Angle around the Z-axis
    phi = math.acos(1 - 2 * (i + 0.5) / num_points)  # Angle from the Z-axis
    x = radius * math.sin(phi) * math.cos(theta)
    y = radius * math.sin(phi) * math.sin(theta)
    z = radius * math.cos(phi)
    point = rg.Point3d(x, y, z)
    points.append(point)

# Generate antipodal points
antipodal_points = []
for pt in points:
    antipodal_point = rg.Point3d(-pt.X, -pt.Y, -pt.Z)
    antipodal_points.append(antipodal_point)

# Create curves connecting each point to its antipodal point
curves = []
for i in range(num_points):
    curve = rg.LineCurve(points[i], antipodal_points[i])
    curves.append(curve)

# Generate lofted surfaces between pairs of curves
loft_surfaces = []
for i in range(num_points - 1):
    loft = rg.Brep.CreateFromLoft([curves[i], curves[i + 1]], rg.Point3d.Unset, rg.Point3d.Unset, rg.LoftType.Normal, False)
    loft_surfaces.extend(loft)

# Loft the last curve with the first to close the surface
loft = rg.Brep.CreateFromLoft([curves[-1], curves[0]], rg.Point3d.Unset, rg.Point3d.Unset, rg.LoftType.Normal, False)
loft_surfaces.extend(loft)

# Outputs
aOut = points
bOut = antipodal_points
cOut = curves
dOut = loft_surfaces
# ---------- end borsuk_ulam_theorem_001 ----------
borsuk_ulam_theorem_002 = Script(radius=Slider(2.37, range=0..100), num_points=Slider(40, range=0..40), z_amp=multiplication, z_freq=multiplication_2)  # -> out, aOut, bOut, cOut, dOut, eOut; inputs radius: Double, num_points: Int32, z_amp: Double, z_freq: Double
# ---------- borsuk_ulam_theorem_002: Python ----------
import math
import Rhino.Geometry as rg

# Parametric inputs
radius = radius  # Radius of the sphere
num_points = num_points  # Number of points to generate on the sphere
z_amplitude = z_amp  # Amplitude for the Z-coordinate trigonometric function
z_frequency = z_freq  # Frequency for the Z-coordinate trigonometric function

# Generate points on the sphere with complex trigonometric polynomials for Z-coordinates
points = []
for i in range(num_points):
    theta = i * (2 * math.pi / num_points)  # Angle around the Z-axis
    phi = math.acos(1 - 2 * (i + 0.5) / num_points)  # Angle from the Z-axis
    x = radius * math.sin(phi) * math.cos(theta)
    y = radius * math.sin(phi) * math.sin(theta)
    z = radius * math.cos(phi) + z_amplitude * math.sin(z_frequency * theta)  # Adding complexity in the Z dimension
    point = rg.Point3d(x, y, z)
    points.append(point)

# Generate antipodal points
antipodal_points = []
for pt in points:
    antipodal_point = rg.Point3d(-pt.X, -pt.Y, -pt.Z)
    antipodal_points.append(antipodal_point)

# Create curves connecting each point to its antipodal point
curves = []
for i in range(num_points):
    curve = rg.LineCurve(points[i], antipodal_points[i])
    curves.append(curve)

# Apply polar array transformation to generate multiple copies in a circular pattern
polar_curves = []
polar_array_count = 8  # Number of polar array copies
for i in range(polar_array_count):
    angle = i * (2 * math.pi / polar_array_count)
    rotation = rg.Transform.Rotation(angle, rg.Vector3d.ZAxis, rg.Point3d.Origin)
    
    for curve in curves:
        rotated_curve = curve.DuplicateCurve()
        rotated_curve.Transform(rotation)
        polar_curves.append(rotated_curve)

# Create lofted surfaces between pairs of curves
loft_surfaces = []
for i in range(0, len(polar_curves), 2):
    if i + 1 < len(polar_curves):
        loft = rg.Brep.CreateFromLoft([polar_curves[i], polar_curves[i + 1]], rg.Point3d.Unset, rg.Point3d.Unset, rg.LoftType.Normal, False)
        loft_surfaces.extend(loft)

# Outputs
aOut = points
bOut = antipodal_points
cOut = curves
dOut = polar_curves
eOut = loft_surfaces
# ---------- end borsuk_ulam_theorem_002 ----------
panel_2 = Panel(borsuk_ulam_theorem_001.out)  # disabled
geometry = Geometry(borsuk_ulam_theorem_001.aOut)  # disabled
geometry_2 = Geometry(borsuk_ulam_theorem_001.bOut)  # disabled
geometry_3 = Geometry(borsuk_ulam_theorem_001.cOut)  # disabled
geometry_4 = Geometry(borsuk_ulam_theorem_001.dOut)  # disabled
panel_3 = Panel(borsuk_ulam_theorem_002.out)  # disabled
param_viewer = ParamViewer(geometry)
panel_4 = Panel(geometry_4)
geometry_5 = Geometry(borsuk_ulam_theorem_002.aOut)
geometry_6 = Geometry(borsuk_ulam_theorem_002.bOut)
geometry_7 = Geometry(borsuk_ulam_theorem_002.cOut)
geometry_8 = Geometry(borsuk_ulam_theorem_002.dOut)
geometry_9 = Geometry(borsuk_ulam_theorem_002.eOut)
param_viewer_2 = ParamViewer(geometry_5)
panel_5 = Panel(geometry_9)
