# Grasshopper definition 021_CavalierisQuadratureFormula.gh (Grasshopper 1.0.8)
# plug-ins: RhinoCodePluginGH

# ----
# Oscillation Script
trigger = Trigger(Interval=20, TimerInterval=20, Target=data_recorder)
data_recorder = DataRecorder("1", DataLimit=10000000, RecordData=False)
list_length = ListLength(List=data_recorder)
division = Division(A=list_length, B=Slider(64, range=0..1000))
cosine = Cosine(Value=division)
sine = Sine(Value=division)
absolute = Absolute(Value=cosine)
absolute_2 = Absolute(Value=sine)
panel = Panel([absolute_2, absolute])

# ----
# 002 Getting Started
# 
# Learning Python in Grasshopper with gpt-4o
# 
# Rolle's Theorem
# 
# To create a Python script for the Grasshopper
# node editor in Rhino 8 that demonstrates
# geometry inspired by Rolle's Theorem, we can
# generate a curve that satisfies the conditions of
# Rolle's Theorem. This includes ensuring the
# curve is continuous on a closed interval and
# differentiable on an open interval, with the same
#  function value at both endpoints.
number_slider = Slider(2.39, range=0..10)
multiplication = Multiplication(A=Slider(3, range=-3..3), B=absolute_2)
multiplication_2 = Multiplication(A=Slider(3, range=-3..3), B=absolute)
rolles_theorem_001 = Script(
    start=number_slider,
    end=Slider(8.13, range=0..10),
    num_points=Slider(100, range=0..100),
    z_amp=Slider(2.39, range=-3..3),
    z_freq=Slider(-0.51, range=-3..3))  # -> out, aOut, bOut, cOut, dOut, eOut, fOut; inputs start: Double, end: Double, num_points: Int32, z_amp: Double, z_freq: Double
# ---------- rolles_theorem_001: Python ----------
import math
import Rhino.Geometry as rg

# Parametric inputs
a = start  # Start of the interval
b = end  # End of the interval
num_points = num_points  # Number of points to generate on the curve
z_amplitude = z_amp  # Amplitude for the Z-coordinate trigonometric function
z_frequency = z_freq  # Frequency for the Z-coordinate trigonometric function

# Function to generate points based on Rolle's Theorem
def rolle_curve(a, b, num_points):
    points = []
    for i in range(num_points + 1):
        t = a + (b - a) * i / num_points  # Parametric value
        x = t
        y = math.sin(t * math.pi / (b - a))  # Ensures f(a) = f(b)
        z = z_amplitude * math.sin(z_frequency * t)
        point = rg.Point3d(x, y, z)
        points.append(point)
    return points

# Generate Rolle's curve points
rolle_points = rolle_curve(a, b, num_points)

# Create interpolated curve through Rolle's curve points
rolle_curve = rg.Curve.CreateInterpolatedCurve(rolle_points, 3)

# Apply transformations
transformed_points = []
for pt in rolle_points:
    # Scale transformation
    scale_factor = 1.2  # Arbitrary scale factor for demonstration
    scale = rg.Transform.Scale(rg.Point3d.Origin, scale_factor)
    scaled_pt = pt
    scaled_pt.Transform(scale)
    
    # Translation
    translation_vector = (2, 2, 0)  # Arbitrary translation vector for demonstration
    translation = rg.Transform.Translation(rg.Vector3d(translation_vector[0], translation_vector[1], translation_vector[2]))
    translated_pt = scaled_pt
    translated_pt.Transform(translation)
    
    transformed_points.append(translated_pt)

# Create another interpolated curve through transformed points
transformed_curve = rg.Curve.CreateInterpolatedCurve(transformed_points, 3)

# Apply polar array transformation to generate multiple copies in a circular pattern
polar_curves = []
polar_array_count = 8  # Number of polar array copies
for i in range(polar_array_count):
    angle = i * (2 * math.pi / polar_array_count)
    rotation = rg.Transform.Rotation(angle, rg.Vector3d.ZAxis, rg.Point3d.Origin)
    
    rotated_curve = rolle_curve.DuplicateCurve()
    rotated_curve.Transform(rotation)
    
    polar_curves.append(rotated_curve)
    
    rotated_transformed_curve = transformed_curve.DuplicateCurve()
    rotated_transformed_curve.Transform(rotation)
    
    polar_curves.append(rotated_transformed_curve)

# Create lofted surfaces between pairs of curves
loft_surfaces = []
for i in range(0, len(polar_curves), 2):
    if i + 1 < len(polar_curves):
        loft = rg.Brep.CreateFromLoft([polar_curves[i], polar_curves[i + 1]], rg.Point3d.Unset, rg.Point3d.Unset, rg.LoftType.Normal, False)
        loft_surfaces.extend(loft)

# Outputs
aOut = rolle_points
bOut = rolle_curve
cOut = transformed_points
dOut = transformed_curve
eOut = polar_curves
fOut = loft_surfaces
# ---------- end rolles_theorem_001 ----------
panel_2 = Panel(rolles_theorem_001.out)  # disabled
geometry = Geometry(rolles_theorem_001.aOut)
geometry_2 = Geometry(rolles_theorem_001.bOut)
geometry_3 = Geometry(rolles_theorem_001.cOut)
geometry_4 = Geometry(rolles_theorem_001.dOut)
geometry_5 = Geometry(rolles_theorem_001.eOut)
geometry_6 = Geometry(rolles_theorem_001.fOut)
rolles_theorem_002 = Script(
    start=Slider(4.02, range=0..10),
    end=Slider(10, range=0..10),
    num_points=Slider(100, range=0..100),
    z_amp=multiplication_2,
    z_freq=multiplication,
    cyl_radius=Slider(2.66, range=0..10),
    cyl_height=Slider(9.76, range=0..10),
    sph_radius=Slider(5.16, range=0..10))  # -> out, aOut, bOut, cOut, dOut, eOut, fOut, gOut, hOut; inputs start: Double, end: Double, num_points: Int32, z_amp: Double, z_freq: Double, cyl_radius: Double, cyl_height: Double, sph_radius: Double
# ---------- rolles_theorem_002: Python ----------
import math
import Rhino.Geometry as rg

# Parametric inputs
a = start  # Start of the interval
b = end  # End of the interval
num_points = num_points  # Number of points to generate on the curve
z_amplitude = z_amp  # Amplitude for the Z-coordinate trigonometric function
z_frequency = z_freq  # Frequency for the Z-coordinate trigonometric function
cylinder_radius = cyl_radius  # Radius of the center cylinder
cylinder_height = cyl_height  # Height of the center cylinder
sphere_radius = sph_radius  # Radius of the center sphere

# Function to generate points based on Rolle's Theorem
def rolle_curve(a, b, num_points):
    points = []
    for i in range(num_points + 1):
        t = a + (b - a) * i / num_points  # Parametric value
        x = t
        y = math.sin(t * math.pi / (b - a))  # Ensures f(a) = f(b)
        z = z_amplitude * math.sin(z_frequency * t) + z_amplitude * math.sin(z_frequency * t / 2)  # Added complexity
        point = rg.Point3d(x, y, z)
        points.append(point)
    return points

# Generate Rolle's curve points
rolle_points = rolle_curve(a, b, num_points)

# Create interpolated curve through Rolle's curve points
rolle_curve = rg.Curve.CreateInterpolatedCurve(rolle_points, 3)

# Apply transformations
transformed_points = []
for pt in rolle_points:
    # Scale transformation
    scale_factor = 1.2  # Arbitrary scale factor for demonstration
    scale = rg.Transform.Scale(rg.Point3d.Origin, scale_factor)
    scaled_pt = pt
    scaled_pt.Transform(scale)
    
    # Translation
    translation_vector = (2, 2, 0)  # Arbitrary translation vector for demonstration
    translation = rg.Transform.Translation(rg.Vector3d(translation_vector[0], translation_vector[1], translation_vector[2]))
    translated_pt = scaled_pt
    translated_pt.Transform(translation)
    
    transformed_points.append(translated_pt)

# Create another interpolated curve through transformed points
transformed_curve = rg.Curve.CreateInterpolatedCurve(transformed_points, 3)

# Apply polar array transformation to generate multiple copies in a circular pattern
polar_curves = []
polar_array_count = 8  # Number of polar array copies
for i in range(polar_array_count):
    angle = i * (2 * math.pi / polar_array_count)
    rotation = rg.Transform.Rotation(angle, rg.Vector3d.ZAxis, rg.Point3d.Origin)
    
    rotated_curve = rolle_curve.DuplicateCurve()
    rotated_curve.Transform(rotation)
    
    polar_curves.append(rotated_curve)
    
    rotated_transformed_curve = transformed_curve.DuplicateCurve()
    rotated_transformed_curve.Transform(rotation)
    
    polar_curves.append(rotated_transformed_curve)

# Create lofted surfaces between pairs of curves
loft_surfaces = []
for i in range(0, len(polar_curves), 2):
    if i + 1 < len(polar_curves):
        loft = rg.Brep.CreateFromLoft([polar_curves[i], polar_curves[i + 1]], rg.Point3d.Unset, rg.Point3d.Unset, rg.LoftType.Normal, False)
        loft_surfaces.extend(loft)

# Add center cylinder
cylinder_base = rg.Point3d(0, 0, -cylinder_height / 2)
cylinder_top = rg.Point3d(0, 0, cylinder_height / 2)
center_cylinder = rg.Cylinder(rg.Circle(rg.Plane.WorldXY, cylinder_radius), cylinder_height).ToBrep(True, True)

# Add center sphere
center_sphere = rg.Sphere(rg.Point3d(0, 0, 0), sphere_radius).ToBrep()

# Outputs
aOut = rolle_points
bOut = rolle_curve
cOut = transformed_points
dOut = transformed_curve
eOut = polar_curves
fOut = loft_surfaces
gOut = center_cylinder
hOut = center_sphere
# ---------- end rolles_theorem_002 ----------
param_viewer = ParamViewer(geometry)
panel_3 = Panel(geometry_4)
panel_4 = Panel(rolles_theorem_002.out)  # disabled
geometry_7 = Geometry(rolles_theorem_002.fOut)
geometry_8 = Geometry(rolles_theorem_002.gOut)
geometry_9 = Geometry(rolles_theorem_002.hOut)
geometry_10 = Geometry(rolles_theorem_002.aOut)
geometry_11 = Geometry(rolles_theorem_002.bOut)
geometry_12 = Geometry(rolles_theorem_002.cOut)
geometry_13 = Geometry(rolles_theorem_002.dOut)
geometry_14 = Geometry(rolles_theorem_002.eOut)
param_viewer_2 = ParamViewer(geometry_10)
panel_5 = Panel(geometry_13)
