# Grasshopper definition 022_Folium_of_Descartes.gh (Grasshopper 1.0.8)
# plug-ins: RhinoCodePluginGH

# @decorator
# animate
number_slider = Slider(3.06, range=0..10)
trigger = Trigger(Interval=10, TimerInterval=10, Target=cavalierisquadratureformula_001)  # disabled
# Certainly! In Python, decorators are used to
# modify the behavior of functions or methods.
# While decorators are not typically used in the
# context of Grasshopper scripts, we can certainly
#  create a function that acts as a decorator to
# modify the input parameters or points before
# generating the geometry. This can add some
# dynamic behavior or additional transformations
# to the geometry.
cavalierisquadratureformula_001 = Script(
    end=number_slider,
    num_points=Slider(100, range=0..100),
    exponent=Slider(2, range=0..10),
    scale=Slider(3, range=0.01..3),
    z_amp=Slider(-3, range=-3..3),
    z_freq=Slider(3, range=-3..3),
    cyl_radius=Slider(2.14, range=0..10),
    cyl_height=Slider(10, range=0..10),
    sph_radius=Slider(4.08, range=0..10))  # -> out, aOut, bOut, cOut, dOut, eOut, fOut, gOut, hOut; inputs end: Double, num_points: Int32, exponent: Int32, scale: Double, z_amp: Double, z_freq: Double, cyl_radius: Double, cyl_height: Double, sph_radius: Double; disabled
# ---------- cavalierisquadratureformula_001: Python ----------
import math
import random
import Rhino.Geometry as rg
import time

# Decorator to add noise to points
def add_noise(noise_amplitude):
    def decorator(func):
        def wrapper(*args, **kwargs):
            points = func(*args, **kwargs)
            noisy_points = []
            for pt in points:
                noise = rg.Vector3d(
                    noise_amplitude * (2 * random.random() - 1),
                    noise_amplitude * (2 * random.random() - 1),
                    noise_amplitude * (2 * random.random() - 1)
                )
                noisy_point = rg.Point3d(pt.X + noise.X, pt.Y + noise.Y, pt.Z + noise.Z)
                noisy_points.append(noisy_point)
            return noisy_points
        return wrapper
    return decorator

# Decorator to scale points
def scale_points(scale_factor):
    def decorator(func):
        def wrapper(*args, **kwargs):
            points = func(*args, **kwargs)
            scaled_points = []
            for pt in points:
                scaled_point = rg.Point3d(pt.X * scale_factor, pt.Y * scale_factor, pt.Z * scale_factor)
                scaled_points.append(scaled_point)
            return scaled_points
        return wrapper
    return decorator

# Decorator to animate z_amplitude and z_frequency
def animate_z_params(amplitude_range, frequency_range, speed):
    def decorator(func):
        def wrapper(*args, **kwargs):
            time_elapsed = time.time() * speed
            z_amplitude = amplitude_range[0] + (amplitude_range[1] - amplitude_range[0]) * (0.5 * (1 + math.sin(time_elapsed)))
            z_frequency = frequency_range[0] + (frequency_range[1] - frequency_range[0]) * (0.5 * (1 + math.cos(time_elapsed)))
            return func(*args, z_amplitude=z_amplitude, z_frequency=z_frequency, **kwargs)
        return wrapper
    return decorator

# Function to generate points based on Cavalieri's quadrature formula with decorators
@add_noise(0.1)
@scale_points(1.5)
@animate_z_params(amplitude_range=(-3, 3), frequency_range=(-3, 3), speed=1)
def cavalieri_curve(a, num_points, n, z_amplitude=1, z_frequency=1):
    points = []
    for i in range(num_points + 1):
        t = i / num_points * a  # Parametric value
        x = t
        y = (1 / (n + 1)) * (t ** (n + 1))
        z = z_amplitude * math.sin(z_frequency * t) + z_amplitude * math.sin(z_frequency * t / 2)  # Adding complexity
        point = rg.Point3d(x, y, z)
        points.append(point)
    return points

# Parametric inputs
a = end  # Upper limit of the integral
num_points = num_points  # Number of points to generate on the curve
n = exponent  # Exponent in the function x^n
scale_factor = scale  # Scale factor for the generated geometry
z_amplitude = z_amp  # Amplitude for the Z-coordinate trigonometric function
z_frequency = z_freq  # Frequency for the Z-coordinate trigonometric function
cylinder_radius = cyl_radius  # Radius of the center cylinder
cylinder_height = cyl_height  # Height of the center cylinder
sphere_radius = sph_radius  # Radius of the center sphere

# Generate Cavalieri's curve points
cavalieri_points = cavalieri_curve(a, num_points, n)

# Create interpolated curve through Cavalieri's curve points
cavalieri_curve = rg.Curve.CreateInterpolatedCurve(cavalieri_points, 3)

# Apply transformations
transformed_points = []
for pt in cavalieri_points:
    # Scale transformation
    scaled_pt = pt
    scaled_pt.Transform(rg.Transform.Scale(rg.Point3d.Origin, scale_factor))
    
    # Translation
    translation_vector = (2, 2, 0)  # Arbitrary translation vector for demonstration
    translated_pt = scaled_pt
    translated_pt.Transform(rg.Transform.Translation(rg.Vector3d(translation_vector[0], translation_vector[1], translation_vector[2])))
    
    transformed_points.append(translated_pt)

# Create another interpolated curve through transformed points
transformed_curve = rg.Curve.CreateInterpolatedCurve(transformed_points, 3)

# Apply polar array transformation to generate multiple copies in a circular pattern
polar_curves = []
polar_array_count = 8  # Number of polar array copies
for i in range(polar_array_count):
    angle = i * (2 * math.pi / polar_array_count)
    rotation = rg.Transform.Rotation(angle, rg.Vector3d.ZAxis, rg.Point3d.Origin)
    
    rotated_curve = cavalieri_curve.DuplicateCurve()
    rotated_curve.Transform(rotation)
    
    polar_curves.append(rotated_curve)
    
    rotated_transformed_curve = transformed_curve.DuplicateCurve()
    rotated_transformed_curve.Transform(rotation)
    
    polar_curves.append(rotated_transformed_curve)

# Create lofted surfaces between pairs of curves
loft_surfaces = []
for i in range(0, len(polar_curves), 2):
    if i + 1 < len(polar_curves):
        loft = rg.Brep.CreateFromLoft([polar_curves[i], polar_curves[i + 1]], rg.Point3d.Unset, rg.Point3d.Unset, rg.LoftType.Normal, False)
        loft_surfaces.extend(loft)

# Add center cylinder
cylinder_base = rg.Point3d(0, 0, -cylinder_height / 2)
cylinder_top = rg.Point3d(0, 0, cylinder_height / 2)
center_cylinder = rg.Cylinder(rg.Circle(rg.Plane.WorldXY, cylinder_radius), cylinder_height).ToBrep(True, True)

# Add center sphere
center_sphere = rg.Sphere(rg.Point3d(0, 0, 0), sphere_radius).ToBrep()

# Outputs
aOut = cavalieri_points
bOut = cavalieri_curve
cOut = transformed_points
dOut = transformed_curve
eOut = polar_curves
fOut = loft_surfaces
gOut = center_cylinder
hOut = center_sphere
# ---------- end cavalierisquadratureformula_001 ----------
panel = Panel(cavalierisquadratureformula_001.out)
geometry = Geometry(cavalierisquadratureformula_001.aOut)  # disabled
geometry_2 = Geometry(cavalierisquadratureformula_001.bOut)  # disabled
geometry_3 = Geometry(cavalierisquadratureformula_001.cOut)  # disabled
geometry_4 = Geometry(cavalierisquadratureformula_001.dOut)  # disabled
geometry_5 = Geometry(cavalierisquadratureformula_001.eOut)  # disabled
geometry_6 = Geometry(cavalierisquadratureformula_001.fOut)  # disabled
geometry_7 = Geometry(cavalierisquadratureformula_001.gOut)  # disabled
geometry_8 = Geometry(cavalierisquadratureformula_001.hOut)  # disabled
param_viewer = ParamViewer(geometry)
panel_2 = Panel(geometry_4)
trigger_2 = Trigger(Interval=10, TimerInterval=10, Target=folium_of_descartes_001)  # disabled
# 002 Getting Started
# 
# Learning Python in Grasshopper with gpt-4o
# 
# Folium_of_Descartes
# 
# To create a Python script for the Grasshopper
# node editor in Rhino 8 that demonstrates
# interesting geometry inspired by the Folium of
# Descartes, we can use the provided polar
# coordinates equation. The equation in polar
# coordinates is:
number_slider_2 = Slider(0.23, range=0.01..3)
folium_of_descartes_001 = Script(
    scale=number_slider_2,
    scale_factor=Slider(1.87, range=0.01..3),
    cyl_radius=Slider(0.66, range=0..10),
    cyl_height=Slider(2.64, range=0..10),
    sph_radius=Slider(1.15, range=0..10))  # -> out, aOut, bOut, cOut, dOut, eOut, fOut, gOut, hOut; inputs scale: Double, scale_factor: Double, cyl_radius: Double, cyl_height: Double, sph_radius: Double
# ---------- folium_of_descartes_001: Python ----------
import math
import random
import Rhino.Geometry as rg
import time

# Decorator to add noise to points
def add_noise(noise_amplitude):
    def decorator(func):
        def wrapper(*args, **kwargs):
            points = func(*args, **kwargs)
            noisy_points = []
            for pt in points:
                noise = rg.Vector3d(
                    noise_amplitude * (2 * random.random() - 1),
                    noise_amplitude * (2 * random.random() - 1),
                    noise_amplitude * (2 * random.random() - 1)
                )
                noisy_point = rg.Point3d(pt.X + noise.X, pt.Y + noise.Y, pt.Z + noise.Z)
                noisy_points.append(noisy_point)
            return noisy_points
        return wrapper
    return decorator

# Decorator to scale points
def scale_points(scale_factor):
    def decorator(func):
        def wrapper(*args, **kwargs):
            points = func(*args, **kwargs)
            scaled_points = []
            for pt in points:
                scaled_point = rg.Point3d(pt.X * scale_factor, pt.Y * scale_factor, pt.Z * scale_factor)
                scaled_points.append(scaled_point)
            return scaled_points
        return wrapper
    return decorator

# Decorator to animate z_amplitude and z_frequency
def animate_z_params(amplitude_range, frequency_range, speed):
    def decorator(func):
        def wrapper(*args, **kwargs):
            time_elapsed = time.time() * speed
            z_amplitude = amplitude_range[0] + (amplitude_range[1] - amplitude_range[0]) * (0.5 * (1 + math.sin(time_elapsed)))
            z_frequency = frequency_range[0] + (frequency_range[1] - frequency_range[0]) * (0.5 * (1 + math.cos(time_elapsed)))
            return func(*args, z_amplitude=z_amplitude, z_frequency=z_frequency, **kwargs)
        return wrapper
    return decorator

# Function to generate points based on the Folium of Descartes with decorators
@add_noise(0.1)
@scale_points(1.5)
@animate_z_params(amplitude_range=(-3, 3), frequency_range=(-3, 3), speed=1)
def folium_descartes(a, num_points, z_amplitude=1, z_frequency=1):
    points = []
    for i in range(num_points):
        theta = i * (2 * math.pi / num_points)
        sin_theta = math.sin(theta)
        cos_theta = math.cos(theta)
        r = (3 * a * sin_theta * cos_theta) / (sin_theta**3 + cos_theta**3)
        x = r * cos_theta
        y = r * sin_theta
        z = z_amplitude * math.sin(z_frequency * theta)  # Adding complexity to the Z dimension
        point = rg.Point3d(x, y, z)
        points.append(point)
    return points

# Parametric inputs
a = scale  # Scale parameter for the folium
num_points = 100  # Number of points to generate on the curve
scale_factor = scale_factor # Scale factor for the generated geometry
cylinder_radius = cyl_radius  # Radius of the center cylinder
cylinder_height = cyl_height  # Height of the center cylinder
sphere_radius = sph_radius  # Radius of the center sphere

# Generate Folium of Descartes points
folium_points = folium_descartes(a, num_points)

# Create interpolated curve through Folium of Descartes points
folium_curve = rg.Curve.CreateInterpolatedCurve(folium_points, 3)

# Apply transformations
transformed_points = []
for pt in folium_points:
    # Scale transformation
    scaled_pt = pt
    scaled_pt.Transform(rg.Transform.Scale(rg.Point3d.Origin, scale_factor))
    
    # Translation
    translation_vector = (2, 2, 0)  # Arbitrary translation vector for demonstration
    translated_pt = scaled_pt
    translated_pt.Transform(rg.Transform.Translation(rg.Vector3d(translation_vector[0], translation_vector[1], translation_vector[2])))
    
    transformed_points.append(translated_pt)

# Create another interpolated curve through transformed points
transformed_curve = rg.Curve.CreateInterpolatedCurve(transformed_points, 3)

# Apply polar array transformation to generate multiple copies in a circular pattern
polar_curves = []
polar_array_count = 8  # Number of polar array copies
for i in range(polar_array_count):
    angle = i * (2 * math.pi / polar_array_count)
    rotation = rg.Transform.Rotation(angle, rg.Vector3d.ZAxis, rg.Point3d.Origin)
    
    rotated_curve = folium_curve.DuplicateCurve()
    rotated_curve.Transform(rotation)
    
    polar_curves.append(rotated_curve)
    
    rotated_transformed_curve = transformed_curve.DuplicateCurve()
    rotated_transformed_curve.Transform(rotation)
    
    polar_curves.append(rotated_transformed_curve)

# Decorator to animate z_amplitude and z_frequency
def animate_z_params(amplitude_range, frequency_range, speed):
    def decorator(func):
        def wrapper(*args, **kwargs):
            time_elapsed = time.time() * speed
            z_amplitude = amplitude_range[0] + (amplitude_range[1] - amplitude_range[0]) * (0.5 * (1 + math.sin(time_elapsed)))
            z_frequency = frequency_range[0] + (frequency_range[1] - frequency_range[0]) * (0.5 * (1 + math.cos(time_elapsed)))
            return func(*args, z_amplitude=z_amplitude, z_frequency=z_frequency, **kwargs)
        return wrapper
    return decorator

# Create lofted surfaces between pairs of curves
loft_surfaces = []
for i in range(0, len(polar_curves), 2):
    if i + 1 < len(polar_curves):
        loft = rg.Brep.CreateFromLoft([polar_curves[i], polar_curves[i + 1]], rg.Point3d.Unset, rg.Point3d.Unset, rg.LoftType.Normal, False)
        loft_surfaces.extend(loft)

# Add center cylinder
cylinder_base = rg.Point3d(0, 0, -cylinder_height / 2)
cylinder_top = rg.Point3d(0, 0, cylinder_height / 2)
center_cylinder = rg.Cylinder(rg.Circle(rg.Plane.WorldXY, cylinder_radius), cylinder_height).ToBrep(True, True)

# Add center sphere
center_sphere = rg.Sphere(rg.Point3d(0, 0, 0), sphere_radius).ToBrep()

# Outputs
aOut = folium_points
bOut = folium_curve
cOut = transformed_points
dOut = transformed_curve
eOut = polar_curves
fOut = loft_surfaces
gOut = center_cylinder
hOut = center_sphere
# ---------- end folium_of_descartes_001 ----------
panel_3 = Panel(folium_of_descartes_001.out)
geometry_9 = Geometry(folium_of_descartes_001.fOut)
geometry_10 = Geometry(folium_of_descartes_001.aOut)
geometry_11 = Geometry(folium_of_descartes_001.bOut)
geometry_12 = Geometry(folium_of_descartes_001.cOut)
geometry_13 = Geometry(folium_of_descartes_001.dOut)
geometry_14 = Geometry(folium_of_descartes_001.eOut)
geometry_15 = Geometry(folium_of_descartes_001.gOut)
geometry_16 = Geometry(folium_of_descartes_001.hOut)
param_viewer_2 = ParamViewer(geometry_10)
panel_4 = Panel(geometry_13)
