# Grasshopper definition 024_De_Moivres_Formula.gh (Grasshopper 1.0.8)
# plug-ins: RhinoCodePluginGH

trigger = Trigger(Interval=10, TimerInterval=10, Target=wolstenholmes_theorem_002)  # disabled
# @decorators
# noise & animation
# Sure! Here is a more advanced Python script fo
#  the Grasshopper node editor in Rhino 8,
# inspired by Wolstenholme's Theorem,
# incorporating spiral formations, modular
# structures, and using decorators to add noise
# and animation functionality. This script will
# create complex and beautiful geometric
# patterns.
number_slider = Slider(100, range=0..100)
wolstenholmes_theorem_002 = Script(
    iterations=number_slider,
    noise_scale=Slider(13, range=0.01..13),
    animation_speed=Slider(5, range=0..5),
    seed=Slider(42, range=0..100),
    prime_limit=Slider(200, range=0..200))  # -> out, aOut, bOut; inputs iterations: Int32, animation_speed: Double, seed: Int32, prime_limit: Int32; disabled
# ---------- wolstenholmes_theorem_002: Python ----------
import Rhino
import math
import random
import time

def add_noise(points, scale):
    noisy_points = []
    for pt in points:
        x = pt.X + (random.random() - 0.5) * scale
        y = pt.Y + (random.random() - 0.5) * scale
        z = pt.Z + (random.random() - 0.5) * scale
        noisy_points.append(Rhino.Geometry.Point3d(x, y, z))
    return noisy_points

def animate_points(points, speed, time_value):
    animated_points = []
    for pt in points:
        x = pt.X + math.sin(time_value * speed)
        y = pt.Y + math.cos(time_value * speed)
        z = pt.Z + math.sin(time_value * speed) * math.cos(time_value * speed)
        animated_points.append(Rhino.Geometry.Point3d(x, y, z))
    return animated_points

def wolstenholme_geometry(n, prime_list):
    points = []
    curves = []

    for i in range(1, n + 1):
        if i == 1 or i not in prime_list:
            continue
        theta = 2 * math.pi * (1 - 1/i)  # Angle inspired by the formula
        radius = i * 10  # Scaling factor for visualization
        x = radius * math.cos(theta)
        y = radius * math.sin(theta)
        z = 0

        pt = Rhino.Geometry.Point3d(x, y, z)
        points.append(pt)

        if len(points) > 1:
            curve = Rhino.Geometry.Curve.CreateInterpolatedCurve(points, 3)
            curves.append(curve)

    return points, curves

# Function to generate a list of prime numbers up to a given limit
def generate_primes(limit):
    primes = []
    for num in range(2, limit + 1):
        is_prime = True
        for i in range(2, int(math.sqrt(num)) + 1):
            if num % i == 0:
                is_prime = False
                break
        if is_prime:
            primes.append(num)
    return primes

# Set the parameters
iterations = iterations
noise_scale = noise_scale
animation_speed = animation_speed
seed = seed
prime_limit = prime_limit

# Seed the random generator
random.seed(seed)

# Generate a list of prime numbers up to the prime_limit
prime_list = generate_primes(prime_limit)

# Generate the geometry
points, curves = wolstenholme_geometry(iterations, prime_list)

# Add noise to the points
noisy_points = add_noise(points, noise_scale)

# Use the system time for animation
current_time = time.time()
time_value = current_time % (2 * math.pi)  # Ensuring time_value is within a reasonable range

# Animate the noisy points
animated_points = animate_points(noisy_points, animation_speed, time_value)

# Output the results
aOut = animated_points
bOut = curves
# ---------- end wolstenholmes_theorem_002 ----------
geometry = Geometry(wolstenholmes_theorem_002.aOut)  # disabled
geometry_2 = Geometry(wolstenholmes_theorem_002.bOut)  # disabled
panel = Panel(wolstenholmes_theorem_002.out)  # disabled
param_viewer = ParamViewer(geometry)  # disabled
interpolate = Interpolate(Vertices=geometry, Degree=3, Periodic=False, KnotStyle=1)  # -> Curve, Length, Domain; disabled
panel_2 = Panel(geometry_2)
# 002 Getting Started
# 
# Learning Python in Grasshopper with gpt-4o
# 
# De_Moivres_Formula
# 
# Let's create a new Python script for the
# Grasshopper node editor in Rhino 8 that
# demonstrates interesting geometry inspired by
# De Moivre's Formula.
number_slider_2 = Slider(100, range=0..100)
trigger_2 = Trigger(Interval=10, TimerInterval=10, Target=de_moivres_formula_001)  # disabled
de_moivres_formula_001 = Script(
    iterations=number_slider_2,
    noise_scale=Slider(2.48, range=0..10),
    animation_speed=Slider(3, range=0.1..3),
    seed=Slider(42, range=0..100),
    Moivre=Slider(3, range=0..10))  # -> out, aOut; inputs iterations: Int32, noise_scale: Double, animation_speed: Double, seed: Int32, Moivre: Int32
# ---------- de_moivres_formula_001: Python ----------
import Rhino
import math
import random
import time

def add_noise(points, scale):
    noisy_points = []
    for pt in points:
        x = pt.X + (random.random() - 0.5) * scale
        y = pt.Y + (random.random() - 0.5) * scale
        z = pt.Z + (random.random() - 0.5) * scale
        noisy_points.append(Rhino.Geometry.Point3d(x, y, z))
    return noisy_points

def animate_points(points, speed, time_value):
    animated_points = []
    for pt in points:
        x = pt.X + math.sin(time_value * speed)
        y = pt.Y + math.cos(time_value * speed)
        z = pt.Z + math.sin(time_value * speed) * math.cos(time_value * speed)
        animated_points.append(Rhino.Geometry.Point3d(x, y, z))
    return animated_points

def de_moivre_geometry(n, iterations):
    points = []
    for i in range(iterations):
        theta = 2 * math.pi * i / iterations  # Angle in radians
        cos_nx = math.cos(n * theta)
        sin_nx = math.sin(n * theta)
        
        x = cos_nx * 10  # Scale factor for visualization
        y = sin_nx * 10
        z = 0  # Start with z = 0 for 2D visualization
        
        pt = Rhino.Geometry.Point3d(x, y, z)
        points.append(pt)
    
    return points

# Set the parameters
iterations = iterations
noise_scale = noise_scale
animation_speed = 0.1
seed = seed
n = Moivre  # De Moivre's Formula parameter

# Seed the random generator
random.seed(seed)

# Generate the geometry
points = de_moivre_geometry(n, iterations)

# Add noise to the points
noisy_points = add_noise(points, noise_scale)

# Use the system time for animation
current_time = time.time()
time_value = current_time % (2 * math.pi)  # Ensuring time_value is within a reasonable range

# Animate the noisy points
animated_points = animate_points(noisy_points, animation_speed, time_value)

# Output the results
aOut = animated_points
# ---------- end de_moivres_formula_001 ----------
geometry_3 = Geometry(de_moivres_formula_001.aOut)
interpolate_2 = Interpolate(Vertices=geometry_3, Degree=3, Periodic=False, KnotStyle=1)  # -> Curve, Length, Domain
panel_3 = Panel(de_moivres_formula_001.out)
param_viewer_2 = ParamViewer(geometry_3)
panel_4 = Panel(geometry_3)
